# Grasshopper definition plan_to_abb_track_IT.gh (Grasshopper 1.0.7)

# ----
# Change to where you save the coop_assembly repo!
panel = Panel("D:\code_ws\pb_ws")

# ---- group: end effector definition from flange
robot_dof = Panel("7")
point = Point("0,0,0.3705")

# ----
rhino_doc_dir = RhinoDocDir()  # -> rhino_doc_dir
# ---------- rhino_doc_dir: Python ----------
import scriptcontext as sc
from os import path

rhino_doc_dir = path.abspath(path.dirname(sc.doc.Path))
# ---------- end rhino_doc_dir ----------
concatenate = Concatenate(FragmentA=panel, FragmentB="\coop_assembly\src\coop_assembly\data\models")
text = Text(rhino_doc_dir)
ghpython_script = GhPythonScript(x=text, y="1_exp_tets_regression-z__solution_20-12-17_11-57-43.json")  # -> out, a
# ---------- ghpython_script: Python ----------
import os

a = os.path.abspath(os.path.join(x, y))
# ---------- end ghpython_script ----------
panel_2 = Panel(ghpython_script.a)
ghpython_script_2 = GhPythonScript(result_file_path=ghpython_script.a, ee_link_name="eef_tcp_frame", scale="1")  # -> out, paths, ee_paths, elements, tags, grasps, axispts_from_index, radius, goal_poses
# ---------- ghpython_script_2: Python ----------
import rhinoscriptsyntax as rs
import Rhino.Geometry.Plane as Plane
import Rhino.Geometry.Point3d as Point3d
import Rhino.Geometry.Vector3d as Vector3d
import Rhino.Geometry.Quaternion as Quat
import Rhino.Geometry.Line as Line
import Rhino.Geometry.Transform as Transform
import Grasshopper.DataTree as DataTree # Add, AddRange(list, GHPath(i, j))
import Grasshopper.Kernel.Data.GH_Path as GHPath
import System

from ghpythonlib.treehelpers import list_to_tree, tree_to_list

import json
from compas.geometry import Frame
from compas.geometry import scale_points
from compas_ghpython import draw_pipes, draw_frame
from itertools import islice

######################################

def pose_from_frame(frame, scale=1.0):
    """Returns a PyBullet pose from a frame.
    Parameters
    ----------
    frame : :class:`compas.geometry.Frame`
    Returns
    -------
    point, quaternion : tuple
    """
    return ([v*scale for v in frame.point], frame.quaternion.xyzw)


def frame_from_pose(pose, scale=1.0):
    """Returns a frame from a PyBullet pose.
    Parameters
    ----------
    point, quaternion : tuple
    Returns
    -------
    :class:`compas.geometry.Frame`
    """
    point, (x, y, z, w) = pose
    return Frame.from_quaternion([w, x, y, z], point=[v*scale for v in point])

#########################################

with open(result_file_path) as json_file:
    data = json.load(json_file)

print('file_name: {}'.format(data['problem']))
try:
    print('write_time: {}'.format(data['write_time']))
except:
    pass

paths = DataTree[System.Double]()
ee_paths = DataTree[Plane]()
elements = DataTree[System.Int32]()
tags = DataTree[System.String]()
grasps = DataTree[Plane]()
for seq_id, e_trajs in enumerate(data['plan']):
    if seq_id == 0:
        del e_trajs[0]
    for sp_id, traj in enumerate(e_trajs):
        path = traj['path']
        epath = traj['link_path'][ee_link_name]
        for t_id, (conf, epose) in enumerate(zip(path, epath)):
            conf = [float(v) for v in conf]
            paths.AddRange(conf, GHPath(seq_id, sp_id, t_id))
            ee_paths.Add(draw_frame(frame_from_pose(epose, scale)), GHPath(seq_id, sp_id, t_id))
            
        if traj['element'] is not None: 
            elements.Add(traj['element'], GHPath(seq_id, sp_id))
        else:
            elements.Add(-1000, GHPath(seq_id, sp_id))
        tags.Add(traj['tag'], GHPath(seq_id, sp_id))
        
        for attach_data in traj['attachments']:
            g_frame = frame_from_pose(attach_data['grasp_pose'], scale=scale)
            grasps.Add(draw_frame(g_frame), GHPath(seq_id, sp_id))
            
            
axispts_from_index = DataTree[Point3d]()
radius = DataTree[System.Double]()
goal_poses = DataTree[Plane]()
for e_id, edata in data['element_from_index'].items():
    radius.Add(edata['radius']*scale, GHPath(int(e_id)))
    
    goal_frame = frame_from_pose(edata['goal_pose']['value'], scale=scale)
    goal_poses.Add(draw_frame(goal_frame), GHPath(int(e_id)))
    
    scaled_pts = scale_points(edata['axis_endpoints'], scale)
    for i in range(2):
        axispts_from_index.Add(Point3d(*scaled_pts[i]), GHPath(int(e_id)))
# ---------- end ghpython_script_2 ----------
panel_3 = Panel(ghpython_script_2.tags)
panel_4 = Panel(ghpython_script_2.out)
panel_5 = Panel("""{*;0}
{*;1}
{*;2}
{*;3}""")
list_item = ListItem(List=panel_5, Index=0, Wrap=True)  # -> Item, Item1, Item2, Item3
shift_paths = ShiftPaths(Data=ghpython_script_2.paths, Offset=-1)
panel_6 = Panel(shift_paths)
split_tree = SplitTree(Data=shift_paths, Masks=flatten(list_item.Item1))  # -> Positive, Negative
split_tree_2 = SplitTree(Data=shift_paths, Masks=flatten(list_item.Item2))  # -> Positive, Negative
split_tree_3 = SplitTree(Data=shift_paths, Masks=flatten(list_item.Item))  # -> Positive, Negative
split_tree_4 = SplitTree(Data=shift_paths, Masks=flatten(list_item.Item3))  # -> Positive, Negative
partition_list = PartitionList(List=split_tree_2.Positive, Size=robot_dof)
partition_list_2 = PartitionList(List=split_tree.Positive, Size=robot_dof)
partition_list_3 = PartitionList(List=split_tree_4.Positive, Size=robot_dof)
partition_list_4 = PartitionList(List=split_tree_3.Positive, Size=robot_dof)
integer = Integer(ghpython_script_2.elements)
shift_paths_2 = ShiftPaths(Data=integer, Offset=-1)

# ---- group: transfer
number = Number(partition_list_4)

# ---- group: place retreat
number_2 = Number(partition_list)

# ---- group: transit
number_3 = Number(partition_list_3)

# ---- group: place approach
number_4 = Number(partition_list_2)

# ----
list_item_2 = ListItem(List=shift_paths_2, Index=0, Wrap=True)
text_2 = Text(ghpython_script_2.tags)
panel_7 = Panel("open gripper")
panel_8 = Panel("close gripper")
concatenate_2 = Concatenate(Fragment_A="; element #", Fragment_B=integer, A=", ", B=text_2)

# ----
# Slide me to anim the robot!
traj_id = Slider(0, range=0..1268)

merge = Merge(Data2=number, Data3=number_4, Data5=number_2, Data6=number_3)
panel_9 = Panel(concatenate_2)
tree_statistics = TreeStatistics(Tree=merge)  # -> Paths, Length, Count
panel_10 = Panel(tree_statistics.Paths)
list_item_3 = ListItem(List=tree_statistics.Paths, Index=traj_id, Wrap=True)
tree_branch = TreeBranch(Tree=merge, Path=list_item_3, MaintainPaths=True)

# ----
# Robot
# (click Load to load the robot!)
load = Button()
ghpython_script_3 = PythonScript(load=load, pkg_path=concatenate, pkg_name="abb_irb4600_40_255", urdf_file="ECL_robot1_with_track.urdf")  # -> out, robot
# ---------- ghpython_script_3: Python ----------
from scriptcontext import sticky as st
import os
import compas

from compas.robots import RobotModel
from compas.robots import GithubPackageMeshLoader
from compas.robots import LocalPackageMeshLoader
from compas_fab.robots import Robot
from compas_ghpython.artists import RobotModelArtist

# Robot meshes are usually in meters
# Set a high percision to prevent parsing errors
# and configure Rhino itself in meters
compas.PRECISION = '12f'

# Store robot in component-based key
robot_key = 'robot_{}'.format(str(ghenv.Component.InstanceGuid))

if robot_key not in st:
    st[robot_key] = None

if load:
    # Also load geometry
    loader = LocalPackageMeshLoader(pkg_path, pkg_name)
    
    # Create robot model from URDF
    model = RobotModel.from_urdf_string(loader.load_urdf(urdf_file).read())
    model.load_geometry(loader)

    artist = RobotModelArtist(model)
    robot = Robot(model, artist)
    st[robot_key] = robot

robot = st[robot_key]

#repo    = 'ros-industrial/abb'
#package = 'abb_irb6600_support'
#branch  = 'kinetic-devel'
#
#github = GithubPackageMeshLoader(repo, package, branch)
#
#model = RobotModel.from_urdf_file(github.load_urdf('irb6640.urdf'))
#model.load_geometry(github)
#artist = RobotModelArtist(model)
#robot = Robot(model, artist)
# ---------- end ghpython_script_3 ----------
robot = Data(ghpython_script_3.robot)

panel_11 = Panel(ghpython_script_3.out)
panel_12 = Panel(robot)

# ---- group: meter, degree
# Configuration
gantry = Slider(0, range=0..4)
a2 = Slider(-40, range=-360..360)
a4 = Slider(0, range=-360..360)
a5 = Slider(0, range=-360..360)
a1 = Slider(-27, range=-360..360)
a3 = Slider(-20, range=-360..360)
a6 = Slider(0, range=-360..360)
forward_kinematics = PythonScript(robot=robot, x=gantry, a1=a1, a2=a2, a3=a3, a4=a4, a5=a5, a6=a6)  # -> configuration
# ---------- forward_kinematics: Python ----------
import math
from compas_fab.robots import Configuration

if robot:
    joint_values = [a1, a2, a3, a4, a5, a6]
    joint_names = robot.get_configurable_joint_names()
    configuration = Configuration.from_prismatic_and_revolute_values([x], 
        [math.radians(a) for a in joint_values])
# ---------- end forward_kinematics ----------

# ---- group: meter, radians
# Configuration
list_item_4 = ListItem(List=tree_branch, Index=0, Wrap=True)  # -> Item, Item1, Item2, Item3, Item4, Item5, Item6
forward_kinematics_2 = PythonScript(
    robot=robot,
    x=list_item_4.Item,
    a1=list_item_4.Item1,
    a2=list_item_4.Item2,
    a3=list_item_4.Item3,
    a4=list_item_4.Item4,
    a5=list_item_4.Item5,
    a6=list_item_4.Item6)  # -> configuration
# ---------- forward_kinematics_2: Python ----------
import math
from compas_fab.robots import Configuration

if robot:
    joint_values = [a1, a2, a3, a4, a5, a6]
    joint_names = robot.get_configurable_joint_names()
    configuration = Configuration.from_prismatic_and_revolute_values([x], 
        [a for a in joint_values])
# ---------- end forward_kinematics_2 ----------

# ----
configurations_at_pickup = Data(forward_kinematics_2)

# ---- group: environment collision objects
mesh = Mesh([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])

# ----
# Visualisation
show_end_effector_frame = BooleanToggle(False)
show_base_frame = BooleanToggle(False)
show_collision = BooleanToggle(False)
show_frames = BooleanToggle(True)
show_visual = BooleanToggle(True)
visualize = PythonScript(
    robot=robot,
    configuration=configurations_at_pickup,
    show_visual=show_visual,
    show_collision=show_collision,
    show_frames=show_frames,
    show_base_frame=show_base_frame,
    show_end_effector_frame=show_end_effector_frame)  # -> out, visual, collision, frames, ee_frame, base_frame
# ---------- visualize: Python ----------
"""Visualizes a robot.
    Inputs:
        robot: The robot
        configuration: :class:`compas_fab.robots.Configuration`
            The robot's full configuration to display.
        show_visual: bool
           Whether or not to show the robot's visual meshes.
        show_collision: bool
           Whether or not to show the robot's collision meshes.
        show_frames: bool
           Whether or not to show the robot's joint frames.
        show_base_frame: bool
           Whether or not to show the robot's base frame.
        show_end_effector_frame: bool
            Whether or not to show the robot's end-effector frame.
    Output:
        visual: The robot's visual meshes.
        collision: The robot's collision meshes.
        frames: The robot's joint frames.
        base_frame: The robot's base frame.
        ee_frame: The robot's end-effector frame.
"""
from __future__ import print_function

if robot and configuration:
    group = group or robot.main_group_name if robot.semantics else None
    robot.update(configuration, group, visual=show_visual, collision=show_collision)
    
    if show_visual:
        visual = robot.artist.draw_visual()

    if show_collision:
        collision = robot.artist.draw_collision()

    if show_frames:
        axes = robot.transformed_axes(configuration, group)
        frames = robot.transformed_frames(configuration, group)

    if show_base_frame:
        frames = robot.transformed_frames(configuration, group)
        base_frame = frames[0]

    if show_end_effector_frame:
        ee_frame = robot.forward_kinematics(configuration, group)
        print("End-effector", ee_frame)
# ---------- end visualize ----------
draw = GhPythonScript(frames=[visualize.frames, visualize.ee_frame, visualize.base_frame], scale=Slider(0.1, range=0..1))  # -> P, V, C, W, flatten(planes); inputs frames: list
# ---------- draw: Python ----------
from System.Drawing import Color
from compas_ghpython import draw_frame

red = Color.FromArgb(255, 0, 0)
green = Color.FromArgb(0, 255, 0)
blue = Color.FromArgb(0, 0, 255)

P = []
V = []
C = []
planes = []

scale = float(scale)

for frame in frames:
    if not frame:
        continue
    plane = draw_frame(frame)
    P += [plane.Origin] * 3
    V.append(plane.XAxis * scale)
    V.append(plane.YAxis * scale)
    V.append(plane.ZAxis * scale)
    C += [red, green, blue]
    planes.append(plane)

W = 3
# ---------- end draw ----------
vector_display_ex = VectorDisplayEx(Point=draw.P, Vector=draw.V, Colour=draw.C, Width=draw.W)
geometry = Geometry(visualize.collision)
geometry_2 = Geometry(visualize.visual)
