# Grasshopper definition ground_connector_setup.gh (Grasshopper 1.0.7)
# plug-ins: goat

z = Slider(4.2, range=0..15)
rhino_doc_dir = RhinoDocDir()  # -> rhino_doc_dir
# ---------- rhino_doc_dir: Python ----------
import scriptcontext as sc
from os import path

rhino_doc_dir = path.abspath(path.dirname(sc.doc.Path))
# ---------- end rhino_doc_dir ----------
panel = Panel("""600
0
25""")
number_slider = Slider(300, range=0..1000)
list_item = ListItem(List=panel, Index=0, Wrap=True)  # -> Item, Item1, Item2
concatenate = Concatenate(FragmentA=rhino_doc_dir, FragmentB="\..\..\tests\test_data")
negative = Negative(Value=number_slider)
construct_point = ConstructPoint(XCoordinate=list_item.Item, YCoordinate=list_item.Item1, ZCoordinate=list_item.Item2)
construct_domain = ConstructDomain(DomainStart=negative, DomainEnd=number_slider)
xy_plane = XYPlane(Origin=construct_point)
text = Text(concatenate)

# ---- group: load generated truss
ghpython_script = GhPythonScript(file_dir=text, file_name="cube.json")  # -> out, node_points, connectors, connector_points, element_grounded, radius
# ---------- ghpython_script: Python ----------
import rhinoscriptsyntax as rs
import Rhino.Geometry.Plane as Plane
import Rhino.Geometry.Point3d as Point3d
import Rhino.Geometry.Vector3d as Vector3d
import Rhino.Geometry.Curve as Curve
import Rhino.Geometry.Quaternion as Quat
import Grasshopper.DataTree as DataTree # Add, AddRange(list, GHPath(i, j))
import Grasshopper.Kernel.Data.GH_Path as GHPath
import System

from ghpythonlib.treehelpers import list_to_tree, tree_to_list
import os
import json
from compas.geometry import distance_point_point
from compas_ghpython import draw_pipes, draw_frame, draw_network

from compas.datastructures import Network
#Curve.PointAtStart

with open(os.path.join(file_dir, file_name)) as json_file:
    data = json.load(json_file)

net = Network.from_data(data['bar_structure'])

node_points = [[Point3d(*v['axis_endpoints'][0]), Point3d(*v['axis_endpoints'][1])] for k, v in net.nodes(True)]
element_grounded = [v['grounded'] for k, v in net.nodes(True)]
connectors = [k for k, _ in net.edges(True)]
connector_points = [[Point3d(*e['endpoints']['0'][0]), Point3d(*e['endpoints']['0'][1])] for k, e in net.edges(True)]

connectors = list_to_tree(connectors, source=[])
node_points = list_to_tree(node_points, source=[])
connector_points = list_to_tree(connector_points, source=[])

radius = data['radius']
# ---------- end ghpython_script ----------

# ----
tree_statistics = TreeStatistics(Tree=ghpython_script.node_points)  # -> Paths, Length, Count
boolean = Boolean(ghpython_script.element_grounded)
rectangle = Rectangle(Plane=xy_plane, XSize=construct_domain, YSize=construct_domain, Radius=0)  # -> Rectangle, Length
sift_pattern = SiftPattern(List=tree_statistics.Paths, SiftPattern=boolean)  # -> Output0, Output1
clean_tree = CleanTree(RemoveNulls=True, RemoveInvalid=True, RemoveEmpty=False, Tree=sift_pattern.Output1)
point = Point(ghpython_script.node_points)
point_2 = Point(flatten(point))
cluster = Cluster_2(values_a=point_2)
point_3 = Point(cluster)
deconstruct = Deconstruct(Point=point_3)  # -> XComponent, YComponent, ZComponent
negative_2 = Negative(Value=deconstruct.ZComponent)
addition = Addition(A=negative_2, B=z)
construct_point_2 = ConstructPoint(XCoordinate=0, YCoordinate=0, ZCoordinate=addition)
addition_2 = Addition(A=construct_point_2, B=construct_point)
point_4 = Point(ghpython_script.connector_points)
move = Move(Motion=addition_2)  # -> Geometry, Transform
surface = Surface(rectangle.Rectangle)
cluster_2 = Cluster(list=point)
cluster_3 = Cluster(list=point_4)
point_5 = Point(point_4)
point_6 = Point(point)
length = Length(Curve=cluster_2)
custom_preview = CustomPreview(Geometry=cluster_2, Material=ColourSwatch(SwatchColor=RGB(0, 72, 255)))
transform = Transform(Geometry=point_6, Transform=move.Transform)
transform_2 = Transform(Geometry=point_5, Transform=move.Transform)
custom_preview_2 = CustomPreview(Geometry=cluster_3, Material=ColourSwatch(SwatchColor=RGB(255, 0, 0)))
data_path = DataPath(clean_tree)
series = Series(Start=0, Step=1, Count=Slider(4, range=0..7))
panel_2 = Panel(length)
cluster_4 = Cluster(list=transform)
curve = Curve(cluster_4)
cluster_5 = Cluster(list=transform_2)
list_item_2 = ListItem(List=data_path, Index=series, Wrap=True)
split_tree = SplitTree(Data=curve, Masks=flatten(list_item_2))  # -> Positive, Negative

# ---- group: bake this
curve_2 = Curve(split_tree.Positive)

# ----
custom_preview_3 = CustomPreview(Geometry=cluster_5, Material=ColourSwatch(SwatchColor=RGB(255, 0, 0)))
custom_preview_4 = CustomPreview(Geometry=cluster_4, Material=ColourSwatch(SwatchColor=RGB(0, 72, 255)))
end_points = EndPoints(Curve=curve_2)  # -> Start, End
merge = Merge(Data1=end_points.Start, Data2=end_points.End)

# ---- group: ground buffer value
panel_3 = Panel("1.0")

# ---- group: bar radius
number = Number(ghpython_script.radius)

# ----
goat = Goat(fitness=number_3, gene=z)
addition_3 = Addition(A=number, B=panel_3)

# ---- group: lower point of the two
point_7 = Point(merge)

# ----
cluster_6 = Cluster_2(values_a=point_7)

# ---- group: lower point of the two (continued)
point_8 = Point(cluster_6)

# ----
point_9 = Point(point_8)
brep_closest_point = BrepClosestPoint(Point=point_9, Brep=surface)  # -> Point, Normal, Distance
number_2 = Number(flatten(brep_closest_point.Distance))
line = Line(StartPoint=point_9, EndPoint=brep_closest_point.Point)
subtraction = Subtraction(A=number_2, B=addition_3)
panel_4 = Panel(subtraction)
ghpython_script_2 = GhPythonScript(x=subtraction)  # -> out, a
# ---------- ghpython_script_2: Python ----------
a = x if x > 0 else 1e3 * abs(x)
# ---------- end ghpython_script_2 ----------
custom_preview_5 = CustomPreview(Geometry=line, Material=ColourSwatch(SwatchColor=RGB(0, 255, 123)))
mass_addition = MassAddition(Input=ghpython_script_2.a)  # -> Result, PartialResults
panel_5 = Panel(ghpython_script_2.a)
number_3 = Number(mass_addition.Result)
panel_6 = Panel(number_3)

# ==== cluster Cluster
list = ClusterInput()
list_item = ListItem(List=list, Index=0, Wrap=True)  # -> Item, Item1
line = Line(StartPoint=list_item.Item, EndPoint=list_item.Item1)
line_2 = ClusterOutput(line)

# ==== cluster Cluster_2
values_a = ClusterInput()
deconstruct = Deconstruct(Point=values_a)  # -> XComponent, YComponent, ZComponent
sort_list = SortList(Keys=deconstruct.ZComponent, ValuesValuesA=values_a)  # -> Keys, ValuesValuesA
list_item = ListItem(List=sort_list.ValuesValuesA, Index=0, Wrap=True)
i = ClusterOutput(list_item)
