# Grasshopper definition plan_to_abb_track.ghx (Grasshopper 1.0.7)
# plug-ins: karambaGH

panel = Panel("d:\code_ws\pb_ws\coop_assembly\tests\results\1_exp_tets_regression-z__solution_20-12-18_10-39-18.json")

# ---- group: end effector definition from flange
robot_dof = Panel("7")
point = Point("0,0,0.3705")

# ----
rhino_doc_dir = RhinoDocDir()  # -> rhino_doc_dir
# ---------- rhino_doc_dir: Python ----------
import scriptcontext as sc
from os import path

rhino_doc_dir = path.abspath(path.dirname(sc.doc.Path))
# ---------- end rhino_doc_dir ----------
text = Text(rhino_doc_dir)
ghpython_script = GhPythonScript(x=text, y="1_exp_tets_regression-z__solution_20-12-17_11-57-43.json")  # -> out, a
# ---------- ghpython_script: Python ----------
import os

a = os.path.abspath(os.path.join(x, '..', '..', 
    'tests', 'results', y))
# ---------- end ghpython_script ----------
panel_2 = Panel(panel)
ghpython_script_2 = GhPythonScript(result_file_path=panel, ee_link_name="eef_tcp_frame", scale="1")  # -> out, paths, ee_paths, elements, tags, grasps, axispts_from_index, radius, goal_poses
# ---------- ghpython_script_2: Python ----------
import rhinoscriptsyntax as rs
import Rhino.Geometry.Plane as Plane
import Rhino.Geometry.Point3d as Point3d
import Rhino.Geometry.Vector3d as Vector3d
import Rhino.Geometry.Quaternion as Quat
import Rhino.Geometry.Line as Line
import Rhino.Geometry.Transform as Transform
import Grasshopper.DataTree as DataTree # Add, AddRange(list, GHPath(i, j))
import Grasshopper.Kernel.Data.GH_Path as GHPath
import System

from ghpythonlib.treehelpers import list_to_tree, tree_to_list

import json
from compas.geometry import Frame
from compas.geometry import scale_points
from compas_ghpython import draw_pipes, draw_frame
from itertools import islice

######################################

def pose_from_frame(frame, scale=1.0):
    """Returns a PyBullet pose from a frame.
    Parameters
    ----------
    frame : :class:`compas.geometry.Frame`
    Returns
    -------
    point, quaternion : tuple
    """
    return ([v*scale for v in frame.point], frame.quaternion.xyzw)


def frame_from_pose(pose, scale=1.0):
    """Returns a frame from a PyBullet pose.
    Parameters
    ----------
    point, quaternion : tuple
    Returns
    -------
    :class:`compas.geometry.Frame`
    """
    point, (x, y, z, w) = pose
    return Frame.from_quaternion([w, x, y, z], point=[v*scale for v in point])

#########################################

with open(result_file_path) as json_file:
    data = json.load(json_file)

print('file_name: {}'.format(data['problem']))
try:
    print('write_time: {}'.format(data['write_time']))
except:
    pass

paths = DataTree[System.Double]()
ee_paths = DataTree[Plane]()
elements = DataTree[System.Int32]()
tags = DataTree[System.String]()
grasps = DataTree[Plane]()
for seq_id, e_trajs in enumerate(data['plan']):
    if seq_id == 0:
        del e_trajs[0]
    for sp_id, traj in enumerate(e_trajs):
        path = traj['path']
        epath = traj['link_path'][ee_link_name]
        for t_id, (conf, epose) in enumerate(zip(path, epath)):
            conf = [float(v) for v in conf]
            paths.AddRange(conf, GHPath(seq_id, sp_id, t_id))
            ee_paths.Add(draw_frame(frame_from_pose(epose, scale)), GHPath(seq_id, sp_id, t_id))
            
        if traj['element'] is not None: 
            elements.Add(traj['element'], GHPath(seq_id, sp_id))
        else:
            elements.Add(-1000, GHPath(seq_id, sp_id))
        tags.Add(traj['tag'], GHPath(seq_id, sp_id))
        
        for attach_data in traj['attachments']:
            g_frame = frame_from_pose(attach_data['grasp_pose'], scale=scale)
            grasps.Add(draw_frame(g_frame), GHPath(seq_id, sp_id))
            
            
axispts_from_index = DataTree[Point3d]()
radius = DataTree[System.Double]()
goal_poses = DataTree[Plane]()
for e_id, edata in data['element_from_index'].items():
    radius.Add(edata['radius']*scale, GHPath(int(e_id)))
    
    goal_frame = frame_from_pose(edata['goal_pose']['value'], scale=scale)
    goal_poses.Add(draw_frame(goal_frame), GHPath(int(e_id)))
    
    scaled_pts = scale_points(edata['axis_endpoints'], scale)
    for i in range(2):
        axispts_from_index.Add(Point3d(*scaled_pts[i]), GHPath(int(e_id)))
# ---------- end ghpython_script_2 ----------
rhino_doc_dir_2 = RhinoDocDir()  # -> rhino_doc_dir; same code as rhino_doc_dir
ghpython_script_3 = GhPythonScript(x=rhino_doc_dir_2)  # -> out, a
# ---------- ghpython_script_3: Python ----------
import os

a = os.path.abspath(os.path.join(x,"..","..","..","conmech"))
# ---------- end ghpython_script_3 ----------
panel_3 = Panel(ghpython_script_3.a)

# ---- group: bar radius
number = Number(ghpython_script_2.radius)

# ---- group: axis end pts (indexed by bar id)
point_2 = Point(ghpython_script_2.axispts_from_index)

# ---- group: bar goal poses
plane = Plane(ghpython_script_2.goal_poses)

# ---- group: ee_path
plane_2 = Plane(ghpython_script_2.ee_paths)

# ---- group: tool link
point_3 = Point(point)

# ---- group: grasp, indexed in seq_id
plane_3 = Plane(ghpython_script_2.grasps)

# ----
text_2 = Text(panel)
panel_4 = Panel(ghpython_script_2.out)
panel_5 = Panel("""{*;0}
{*;1}
{*;2}
{*;3}""")
list_item = ListItem(List=point_2, Index=0, Wrap=True)  # -> Item, Item1
list_item_2 = ListItem(List=panel_5, Index=0, Wrap=True)  # -> Item, Item1, Item2, Item3
line = Line(StartPoint=list_item.Item, EndPoint=list_item.Item1)
ghpython_script_4 = GhPythonScript(conmech_dir=ghpython_script_3.a, result_file_path=text_2, limit_distance="1e-12")  # -> out, Model_out, fem_element_from_bar_id, deform_history, element_sequence
# ---------- ghpython_script_4: Python ----------
import rhinoscriptsyntax as rs
import Rhino.Geometry.Plane as Plane
import Rhino.Geometry.Point3d as Point3d
import Rhino.Geometry.Vector3d as Vector3d
import Rhino.Geometry.Quaternion as Quat
import Grasshopper.DataTree as DataTree # Add, AddRange(list, GHPath(i, j))
import Grasshopper.Kernel.Data.GH_Path as GHPath
import System
from System.Collections.Generic import List

from ghpythonlib.treehelpers import list_to_tree, tree_to_list
import os
import json
##############################

import clr
# https://ironpython.net/documentation/dotnet/dotnet.html

clr.AddReferenceToFileAndPath("C:\Program Files\Rhino 6\Plug-ins\Karamba.gha")
clr.AddReferenceToFileAndPath("C:\Program Files\Rhino 6\Plug-ins\KarambaCommon.dll")

import feb # Karamba's C++ library (undocumented in the API)
import Karamba.Models.Model as Model
import Karamba.GHopper.Models.GH_Model as GH_Model
#
import Karamba
import Karamba.Elements.ModelTruss as Truss
from Karamba.Geometry import Point3, Line3, Vector3
from Karamba.CrossSections import CroSec
from Karamba.Supports import Support
from Karamba.Loads import Load
#
from Karamba.Utilities import MessageLogger, UnitsConversionFactories
import KarambaCommon
#
import System
from System import GC
from System.Collections.Generic import List

#####################################
# add path to conmech script folder
import os, sys 
sys.path.append(os.path.join(conmech_dir, "src", "pyconmech", "frame_analysis"))
#from io_base import Model
import io_base
import karamba_io
reload(io_base)
reload(karamba_io)
from karamba_io import KarambaModel
from io_base import LoadCase, GravityLoad

#####################################

with open(os.path.join(result_file_path), 'r') as f:
    data = json.load(f)
    conmech_data = data['conmech_model']

print('{} | {}'.format(conmech_data["model_name"], conmech_data['generate_time']))
km = KarambaModel.from_data(conmech_data)
#lc = LoadCase.from_data(data['loadcases']['0'])

model = km.to_karamba(LoadCase(gravity_load=GravityLoad([0,0,-1])), limit_dist=limit_distance)

## calculate Th.I response
#logger = MessageLogger();
#k3d = KarambaCommon.Toolkit();
#max_disp = clr.Reference[List[float]]()
#out_g = clr.Reference[List[float]]()
#out_comp = clr.Reference[List[float]]()
#message = clr.Reference[str]()
#model = k3d.Algorithms.AnalyzeThI(model, max_disp, out_g, out_comp, message);
#
#ucf = UnitsConversionFactories.Conv();
#cm = ucf.cm();
#print "max disp: {} {}".format(cm.toUnit(max_disp.Value[0]), cm.unitB)
#
Model_out = Karamba.GHopper.Models.GH_Model(model);
#
#from Karamba.GHopper.CrossSections import GH_CrossSection
#a = List[GH_CrossSection]([GH_CrossSection(cs.to_karamba()) for cs in km.crosssecs])

fem_data = conmech_data['fem_element_from_bar_id']
fem_element_from_bar_id = DataTree[int]()
for i, es in fem_data.items():
    if int(i) >= 0:
        fem_element_from_bar_id.AddRange(es, GHPath(int(i)))

deform_history = [trans[1] for trans in data['stiffness_history']]

element_sequence = DataTree[System.Int32]()
for seq_id, e_trajs in enumerate(data['plan']):
    if seq_id == 0:
        del e_trajs[0]
    for sp_id, traj in enumerate(e_trajs):
        if traj['element'] is not None: 
            element_sequence.Add(traj['element'], GHPath(seq_id, sp_id))
        else:
            element_sequence.Add(-1000, GHPath(seq_id, sp_id))
# ---------- end ghpython_script_4 ----------
shift_paths = ShiftPaths(Data=ghpython_script_2.paths, Offset=-1)
xy_plane = XYPlane(Origin=Point(0, 0, 0))
shift_paths_2 = ShiftPaths(Data=plane_2, Offset=-1)

# ---- group: transit, place approach
panel_6 = Panel("""{*;0}
{*;1}""")

# ----
shift_paths_3 = ShiftPaths(Data=ghpython_script_4.element_sequence, Offset=-1)
python_karamba_model_converter = PythonKarambaModelConverter(
    Model_in=ghpython_script_4.Model_out,
    Reference=["C:\Program Files\Rhino 6\Plug-ins\karambaCommon.dll", "C:\Program Files\Rhino 6\Plug-ins\karamba.gha"])  # -> out, flatten(Model_out)
# ---------- python_karamba_model_converter: Python usings ----------
using Karamba.Models;
using Karamba.GHopper.Models;
# ---------- python_karamba_model_converter: Python ----------
    var model = Model_in as Model;
    if (model == null) {
      throw new ArgumentException("The input in 'Model_in' is not of type karamba.Models.Model!");
    }

    Model_out = new GH_Model(model);

    Print("Everything OK");
# ---------- end python_karamba_model_converter ----------
disassemble_model_karamba3d = DisassembleModelKaramba3D(Model=python_karamba_model_converter.Model_out)  # -> Model, Point, Beam, Shell, Support, Load, Line, Mesh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
list_length = ListLength(List=disassemble_model_karamba3d.Beam)
length = Length(Curve=line)
pipe = Pipe(Curve=line, Radius=number, Caps=0)
panel_7 = Panel(shift_paths)
split_tree = SplitTree(Data=shift_paths, Masks=flatten(list_item_2.Item1))  # -> Positive, Negative
split_tree_2 = SplitTree(Data=shift_paths, Masks=flatten(list_item_2.Item2))  # -> Positive, Negative
split_tree_3 = SplitTree(Data=shift_paths, Masks=flatten(list_item_2.Item))  # -> Positive, Negative
split_tree_4 = SplitTree(Data=shift_paths, Masks=flatten(list_item_2.Item3))  # -> Positive, Negative
clean = Button()
split_tree_5 = SplitTree(Data=shift_paths_2, Masks=flatten(panel_6))  # -> Positive, Negative
list_item_3 = ListItem(List=shift_paths_3, Index=0, Wrap=True)  # -> flatten(Item)
orient = Orient(Geometry=line, Source=plane, Target=xy_plane)  # -> Geometry, Transform
partition_list = PartitionList(List=split_tree_2.Positive, Size=robot_dof)
wirecleaner = WireCleaner(on=clean, wire_type=Slider(1, range=0..2))  # -> out, a
# ---------- wirecleaner: Python ----------
from Grasshopper.Kernel import GH_ParamWireDisplay
from Grasshopper.Kernel import GH_RuntimeMessageLevel 

# A dictionary of wire types 
wire_display = {'0':GH_ParamWireDisplay.default, 
                '1':GH_ParamWireDisplay.faint,
                '2':GH_ParamWireDisplay.hidden}

# Get selected components and change the wire display
if on:
    doc = ghenv.Component.OnPingDocument()
    sel_objs = doc.SelectedObjects()
    if not len(sel_objs):
        ghenv.Component.AddRuntimeMessage(GH_RuntimeMessageLevel.Warning, 'Nothing was selected')
    for sel_obj  in sel_objs:
        if hasattr(sel_obj, 'Params'):
            for p in sel_obj.Params.Input:
                if hasattr(p, 'WireDisplay'):
                    p.WireDisplay = wire_display[wire_type]
        else:
            if hasattr(sel_obj, 'WireDisplay'):
                sel_obj.WireDisplay = wire_display[wire_type]
# ---------- end wirecleaner ----------
partition_list_2 = PartitionList(List=split_tree.Positive, Size=robot_dof)
partition_list_3 = PartitionList(List=split_tree_4.Positive, Size=robot_dof)
partition_list_4 = PartitionList(List=split_tree_3.Positive, Size=robot_dof)
panel_8 = Panel(ghpython_script_4.deform_history)
panel_9 = Panel(wirecleaner.out)
shift_paths_4 = ShiftPaths(Data=split_tree_5.Positive, Offset=-1)

# ---- group: tags
integer = Integer(ghpython_script_2.elements)
shift_paths_5 = ShiftPaths(Data=integer, Offset=-1)
list_item_4 = ListItem(List=shift_paths_5, Index=0, Wrap=True)
text_3 = Text(ghpython_script_2.tags)
concatenate = Concatenate(Fragment_A="; element #", Fragment_B=integer, A=", ", B=text_3)

# ---- group: seq_id : beam_id
integer_2 = Integer(list_item_4)

# ---- group: Map seq_id to beam_id / bar sequence
integer_3 = Integer(flatten(integer_2))

# ---- group: Map seq_id to beam_id
shift_paths_6 = ShiftPaths(Data=plane_3, Offset=-1)
tree_statistics = TreeStatistics(Tree=shift_paths_6)  # -> Paths, Length, Count
replace_paths = ReplacePaths(Data=shift_paths_6, Search=tree_statistics.Paths, Replace=integer_3)

# ---- group: transfer
number_2 = Number(partition_list_4)

# ---- group: place retreat
number_3 = Number(partition_list)

# ---- group: transit
number_4 = Number(partition_list_3)

# ---- group: place approach
number_5 = Number(partition_list_2)

# ---- group: bar base, do not change
xy_plane_2 = XYPlane(Origin=Point(0, 0, 0))

# ----
list_item_5 = ListItem(List=replace_paths, Index=0, Wrap=True)

# ---- group: bar at origin
geometry = Geometry(orient.Geometry)

# ---- group: world_from_tool * tool_from_bar
orient_2 = Orient(Geometry=list_item_5, Source=xy_plane_2, Target=shift_paths_4)  # -> Geometry, Transform

# ----
panel_10 = Panel("open gripper")
panel_11 = Panel("close gripper")
merge = Merge(Data2=number_2, Data3=number_5, Data5=number_3, Data6=number_4)

# ---- group: tool_from_bar
orient_3 = Orient(Geometry=geometry, Source=xy_plane_2, Target=list_item_5)  # -> Geometry, Transform

# ---- group: bar sequence
integer_4 = Integer(integer_2)

# ----
tree_statistics_2 = TreeStatistics(Tree=merge)  # -> Paths, Length, Count

# ---- group: tool link
xy_plane_3 = XYPlane(Origin=point_3)

# ---- group: flange_from_bar (indexed by bar id)
orient_4 = Orient(Geometry=orient_3.Geometry, Source=xy_plane_2, Target=xy_plane_3)  # -> Geometry, Transform

# ----
panel_12 = Panel("D:\code_ws\pb_ws\coop_assembly\src\coop_assembly\data\models")
list_item_6 = ListItem(List=tree_statistics_2.Paths, Index=Slider(2, range=0..1268), Wrap=False)
tree_branch = TreeBranch(Tree=merge, Path=list_item_6, MaintainPaths=True)

# ----
# Robot
load = Button()
ghpython_script_5 = PythonScript(load=load, pkg_path=panel_12, pkg_name="abb_irb4600_40_255", urdf_file="ECL_robot1_with_track.urdf")  # -> out, robot
# ---------- ghpython_script_5: Python ----------
from scriptcontext import sticky as st
import os
import compas

from compas.robots import RobotModel
from compas.robots import GithubPackageMeshLoader
from compas.robots import LocalPackageMeshLoader
from compas_fab.robots import Robot
from compas_ghpython.artists import RobotModelArtist

# Robot meshes are usually in meters
# Set a high percision to prevent parsing errors
# and configure Rhino itself in meters
compas.PRECISION = '12f'

# Store robot in component-based key
robot_key = 'robot_{}'.format(str(ghenv.Component.InstanceGuid))

if robot_key not in st:
    st[robot_key] = None

if load:
    # Also load geometry
    loader = LocalPackageMeshLoader(pkg_path, pkg_name)
    
    # Create robot model from URDF
    model = RobotModel.from_urdf_string(loader.load_urdf(urdf_file).read())
    model.load_geometry(loader)

    artist = RobotModelArtist(model)
    robot = Robot(model, artist)
    st[robot_key] = robot

robot = st[robot_key]

#repo    = 'ros-industrial/abb'
#package = 'abb_irb6600_support'
#branch  = 'kinetic-devel'
#
#github = GithubPackageMeshLoader(repo, package, branch)
#
#model = RobotModel.from_urdf_file(github.load_urdf('irb6640.urdf'))
#model.load_geometry(github)
#artist = RobotModelArtist(model)
#robot = Robot(model, artist)
# ---------- end ghpython_script_5 ----------
robot = Data(ghpython_script_5.robot)

# ---- group: Current bar in grasped pose (flange_from_bar) / indexed by bar ids
curve = Curve(orient_4.Geometry)
number_6 = Number(number)

# ----
panel_13 = Panel(ghpython_script_5.out)
panel_14 = Panel(robot)

# ---- group: meter, degree
# Configuration
gantry = Slider(0, range=0..4)
a1 = Slider(-10, range=-360..360)
a2 = Slider(-36, range=-360..360)
a4 = Slider(0, range=-360..360)
a5 = Slider(0, range=-360..360)
a3 = Slider(-20, range=-360..360)
a6 = Slider(0, range=-360..360)
forward_kinematics = PythonScript(robot=robot, x=gantry, a1=a1, a2=a2, a3=a3, a4=a4, a5=a5, a6=a6)  # -> out, configuration
# ---------- forward_kinematics: Python ----------
import math
from compas_fab.robots import Configuration

if robot:
    joint_values = [a1, a2, a3, a4, a5, a6]
    joint_names = robot.get_configurable_joint_names()
    configuration = Configuration.from_prismatic_and_revolute_values([x], 
        [math.radians(a) for a in joint_values])
    print configuration
# ---------- end forward_kinematics ----------

# ---- group: These numbers are just for viz
construct_point = ConstructPoint(XCoordinate=Slider(3.8, range=0..10), YCoordinate=Slider(0, range=0..10), ZCoordinate=Slider(0, range=0..10))

# ----
radians = Radians(Degrees=a2)

# ---- group: bar length (indexed by bar id)
number_7 = Number(flatten(length))

# ---- group: seq_id : bar id
integer_5 = Integer(flatten(integer_2))

# ---- group: tool_link point
point_4 = Point(point_3)

# ----
panel_15 = Panel(radians)
panel_16 = Panel(forward_kinematics.out)
xy_plane_4 = XYPlane(Origin=Point(0, 0, 0))
xy_plane_5 = XYPlane(Origin=construct_point)

# ---- group: environment collision objects
mesh = Mesh([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])

# ----
conf_id = Slider(75, range=0..78)
assembly_seq = Slider(4, range=0..5)

# ----
# bar seq id
integer_6 = Integer(assembly_seq)
concatenate_2 = Concatenate(Fragment_A="{", Fragment_B=integer_6, A=";", C="*", B="}")
construct_path = ConstructPath(Indices=graft(integer_6))  # -> flatten(Branch)

# ---- group: chosen assembly seq id
integer_7 = Integer(assembly_seq)

# ----
addition = Addition(A=integer_7, B=1)
split_list = SplitList(List=list_item_3, Index=addition)  # -> ListA, ListB
ghpython_script_6 = GhPythonScript(nE=list_length, bar_ids=split_list.ListA, fem_element_from_bar_id=ghpython_script_4.fem_element_from_bar_id)  # -> out, flatten(element_activation); inputs nE: Int32, bar_ids: list of Int32, fem_element_from_bar_id: tree of Int32
# ---------- ghpython_script_6: Python ----------
import rhinoscriptsyntax as rs
import Rhino.Geometry.Plane as Plane
import Rhino.Geometry.Point3d as Point3d
import Rhino.Geometry.Vector3d as Vector3d
import Rhino.Geometry.Quaternion as Quat
import Grasshopper.DataTree as DataTree # Add, AddRange(list, GHPath(i, j))
import Grasshopper.Kernel.Data.GH_Path as GHPath
import System

from ghpythonlib.treehelpers import list_to_tree, tree_to_list

fem_elements_from_bar = tree_to_list(fem_element_from_bar_id, lambda x:x)
#print fem_elements_from_bar
element_activation = [False for i in range(nE)]
for b in bar_ids:
    for e in fem_elements_from_bar[b]:
        element_activation[e] = True
# ---------- end ghpython_script_6 ----------
element_activation_karamba3d = ElementActivationKaramba3D(Model=python_karamba_model_converter.Model_out, IsActive=ghpython_script_6.element_activation)
analyze_karamba3d = AnalyzeKaramba3D(Model=element_activation_karamba3d)  # -> CalculatedModel, MaximumDisplacement_cm, ResultingForceOfGravity_kN, ElasticEnergy_kNm
list_item_7 = ListItem(List=panel_8, Index=integer_7, Wrap=True)
eigen_modes_karamba3d = EigenModesKaramba3D(
    Model=analyze_karamba3d.CalculatedModel,
    FromIndex=Slider(1, range=1..50),
    NumberOfModes=1,
    MaximumNumberOfIterations=300,
    Epsilon=1e-07)  # -> ModelWithEigenModesAsLoadCaseResults, Eigenvalues; disabled
multiplication = Multiplication(A=analyze_karamba3d.MaximumDisplacement_cm, B=0.01)
karamba_max_deform = Panel(multiplication)
conmech_max_deform = Panel(list_item_7)

# ----
# Current bar in goal pose
addition_2 = Addition(A=integer_6, B=1)
split_list_2 = SplitList(List=flatten(integer_4), Index=addition_2)  # -> simplify(graft(ListA)), ListB
construct_path_2 = ConstructPath(Indices=split_list_2.ListA)  # -> flatten(Branch)
brep = Brep(simplify(pipe))
split_tree_6 = SplitTree(Data=brep, Masks=flatten(construct_path_2))  # -> Positive, Negative
brep_2 = Brep(split_tree_6.Positive)
custom_preview = CustomPreview(Geometry=brep_2, Material=ColourSwatch(SwatchColor=RGBA(0, 0, 255, 1)))

panel_17 = Panel(eigen_modes_karamba3d.Eigenvalues)  # disabled

# ---- group: bar path
construct_path_3 = ConstructPath(Indices=assembly_seq)
orient_5 = Orient(Geometry=geometry, Source=xy_plane_2, Target=orient_2.Geometry)  # -> Geometry, Transform
tree_branch_2 = TreeBranch(Tree=orient_5.Geometry, Path=construct_path_3, MaintainPaths=True)
custom_preview_2 = CustomPreview(Geometry=tree_branch_2, Material=ColourSwatch(SwatchColor=RGBA(33, 2, 255, 74)))

# ----
model_view_karamba3d = ModelViewKaramba3D(Model=element_activation_karamba3d, ResultFactors=1, ResultCase=-1)  # -> Model, DeformedMesh, DeformedAxes, DeformedModel
concatenate_3 = Concatenate(A="{", Fragment_A=assembly_seq, Fragment_B=";", B="*", C=";", D="*", E="}")
split_tree_7 = SplitTree(Data=concatenate, Masks=flatten(concatenate_3))  # -> Positive, Negative
panel_18 = Panel(split_tree_7.Positive)
split_tree_8 = SplitTree(Data=merge, Masks=flatten(concatenate_3))  # -> Positive, Negative
tree_statistics_3 = TreeStatistics(Tree=split_tree_8.Positive)  # -> Paths, Length, Count
total_traj_length = Panel(tree_statistics_3.Count)
list_item_8 = ListItem(List=tree_statistics_3.Paths, Index=conf_id, Wrap=False)
tree_branch_3 = TreeBranch(Tree=split_tree_8.Positive, Path=list_item_8, MaintainPaths=True)

# ---- group: Current bar in grasped pose (flange_from_bar)
tree_branch_4 = TreeBranch(Tree=integer_4, Path=construct_path, MaintainPaths=True)
construct_path_4 = ConstructPath(Indices=tree_branch_4)
split_tree_9 = SplitTree(Data=curve, Masks=flatten(construct_path_4))  # -> Positive, Negative
split_tree_10 = SplitTree(Data=number_6, Masks=flatten(construct_path))  # -> Positive, Negative
curve_2 = Curve(split_tree_9.Positive)
pipe_2 = Pipe(Curve=curve_2, Radius=split_tree_10.Positive, Caps=0)

# ---- group: meter, radians
# Configuration
list_item_9 = ListItem(List=tree_branch_3, Index=0, Wrap=True)  # -> Item, Item1, Item2, Item3, Item4, Item5, Item6
forward_kinematics_2 = PythonScript(
    robot=robot,
    x=list_item_9.Item,
    a1=list_item_9.Item1,
    a2=list_item_9.Item2,
    a3=list_item_9.Item3,
    a4=list_item_9.Item4,
    a5=list_item_9.Item5,
    a6=list_item_9.Item6)  # -> configuration
# ---------- forward_kinematics_2: Python ----------
import math
from compas_fab.robots import Configuration

if robot:
    joint_values = [a1, a2, a3, a4, a5, a6]
    joint_names = robot.get_configurable_joint_names()
    configuration = Configuration.from_prismatic_and_revolute_values([x], 
        [a for a in joint_values])
# ---------- end forward_kinematics_2 ----------

# ---- group: beam geometry
mesh_2 = Mesh()

# ----
configurations_at_pickup = Data(forward_kinematics_2)

# ----
# . . . . . . . . . . . . . . . . . .
# .                                 .
# .   <<><><>    <<><><>  <<        .
# .   <<         <<       <<        .
#   .   <<><><>    <<><><   <<        .
# .   <<         <<       <<        .
# .   <<         <<       <<        .
# .   <<><><>    <<       <<><><>   .
# .                                 .
# .             GKR 2016/17         .
# . . . . . . . . . . . . . . . . . .
# 
# Created on 10.12.2016
# 
# @author: kathrind, stefanap
unload_abb_communication_lib = Button()
# i. IP settings ipv4 automatically assign (ping test)
# ii. start the program on pendant (pp to main -> play)
# 1. Init in GH
# 2. R on in GH
# 3. Send commands
py = PythonScript(unload=unload_abb_communication_lib)
# ---------- py: Python ----------
from abb_communication.useful import unload_rfl_lib

if unload:
    unload_rfl_lib()
# ---------- end py ----------

# ----
# Visualisation
show_end_effector_frame = BooleanToggle(False)
show_base_frame = BooleanToggle(False)
show_collision = BooleanToggle(True)
show_frames = BooleanToggle(True)
show_visual = BooleanToggle(True)
visualize = PythonScript(
    robot=robot,
    configuration=configurations_at_pickup,
    show_visual=show_visual,
    show_collision=show_collision,
    show_frames=show_frames,
    show_base_frame=show_base_frame,
    show_end_effector_frame=show_end_effector_frame)  # -> out, visual, collision, frames, ee_frame, base_frame
# ---------- visualize: Python ----------
"""Visualizes a robot.
    Inputs:
        robot: The robot
        configuration: :class:`compas_fab.robots.Configuration`
            The robot's full configuration to display.
        show_visual: bool
           Whether or not to show the robot's visual meshes.
        show_collision: bool
           Whether or not to show the robot's collision meshes.
        show_frames: bool
           Whether or not to show the robot's joint frames.
        show_base_frame: bool
           Whether or not to show the robot's base frame.
        show_end_effector_frame: bool
            Whether or not to show the robot's end-effector frame.
    Output:
        visual: The robot's visual meshes.
        collision: The robot's collision meshes.
        frames: The robot's joint frames.
        base_frame: The robot's base frame.
        ee_frame: The robot's end-effector frame.
"""
from __future__ import print_function

if robot and configuration:
    group = group or robot.main_group_name if robot.semantics else None
    robot.update(configuration, group, visual=show_visual, collision=show_collision)
    
    if show_visual:
        visual = robot.artist.draw_visual()

    if show_collision:
        collision = robot.artist.draw_collision()

    if show_frames:
        axes = robot.transformed_axes(configuration, group)
        frames = robot.transformed_frames(configuration, group)

    if show_base_frame:
        frames = robot.transformed_frames(configuration, group)
        base_frame = frames[0]

    if show_end_effector_frame:
        ee_frame = robot.forward_kinematics(configuration, group)
        print("End-effector", ee_frame)
# ---------- end visualize ----------
draw = GhPythonScript(frames=[visualize.frames, visualize.ee_frame, visualize.base_frame], scale=Slider(0.1, range=0..1))  # -> P, V, C, W, flatten(planes); inputs frames: list
# ---------- draw: Python ----------
from System.Drawing import Color
from compas_ghpython import draw_frame

red = Color.FromArgb(255, 0, 0)
green = Color.FromArgb(0, 255, 0)
blue = Color.FromArgb(0, 0, 255)

P = []
V = []
C = []
planes = []

scale = float(scale)

for frame in frames:
    if not frame:
        continue
    plane = draw_frame(frame)
    P += [plane.Origin] * 3
    V.append(plane.XAxis * scale)
    V.append(plane.YAxis * scale)
    V.append(plane.ZAxis * scale)
    C += [red, green, blue]
    planes.append(plane)

W = 3
# ---------- end draw ----------
vector_display_ex = VectorDisplayEx(Point=draw.P, Vector=draw.V, Colour=draw.C, Width=draw.W)
geometry_2 = Geometry(visualize.collision)
geometry_3 = Geometry(visualize.visual)

list_item_10 = ListItem(List=visualize.frames, Index=Slider(21, range=0..43), Wrap=True)
ghpython_script_7 = GhPythonScript(x=list_item_10)  # -> out, a
# ---------- ghpython_script_7: Python ----------
from compas_ghpython import draw_frame

a = draw_frame(x)
# ---------- end ghpython_script_7 ----------
xy_plane_6 = XYPlane(Origin=Point(0, 0, 0))
plane_4 = Plane(ghpython_script_7.a)
curve_3 = Curve(curve_2)
orient_6 = Orient(Geometry=mesh_2, Source=xy_plane_6, Target=plane_4)  # -> Geometry, Transform
list = ValueList({"joints_meshmould_left_low": "98.54 -20.98 45.48 0.0 65.50 68.54", "joints_meshmould_left_high": "98.54 -23.4 23.9 0.0 89.50 68.54", "joints_meshmould_right_low": "-81.46 -20.98 45.48 0.0 65.50 68.54", "joints_meshmould_parking_high": "0 -20.98 45.48 0.0 65.50 -111.46", "joints_meshmould_parking_mid": "0 -60.94 66.90 0.0 84.28 63.15", "joints_meshmould_parking_low": "0 -70.8 72.19 0.0 88.92 61.82"}, selected="joints_meshmould_parking_high")
panel_19 = Panel("""10
0
10
0
0
0
500.0""")
send_joints_sequence = Button()
open_gripper = Button()
close_gripper = Button()

# ---- group: ABB Communication
number_slider = Slider(1, range=1..2)
set_joint_6_to_zero = Button()
list_2 = ValueList({"Fast": 1, "Mid": 2, "Slow": 3}, selected="Fast")
testb = Button()
python = PythonScript(
    testB=testb,
    send_joints_sequence=send_joints_sequence,
    open_gripper=open_gripper,
    close_gripper=close_gripper,
    rob_num=number_slider,
    rob_speed=list_2)  # -> out, a; inputs joints_abb_list: tree, joints_sequence: tree
# ---------- python: Python ----------
from abb_communication.clients.rfl_robot.communication.messages.messagetypes import *

import Rhino.Geometry as rg
from ghpythonlib.treehelpers import list_to_tree, tree_to_list

from abb_communication.geometry import Frame
from scriptcontext import sticky as st
import math as m
from threading import Thread


#ext_axesA = [3532,0,0]
#ext_axesB = [168,0,0]
robot = st["rfl_robot"]

if robot:    
    robot.comm.float_arbitrary = int(rob_num)
    print("robot found")
    
    
    if rob_speed == 1:
        print "robot speed: fast"
        robot.comm.send_set_speed(250)
    if rob_speed == 2:
        print "robot speed: mid"
        robot.comm.send_set_speed(100)
    if rob_speed == 3:
        print "robot speed: slow"
        robot.comm.send_set_speed(10)
    
    
    
    
    if robot.comm.running:
        print "ROBOT IS ONLINE"
        
        joints_print = robot.comm.get_current_pose_joint()
        print "current joints:", joints_print
        joints_deg = [m.degrees(j) for j in joints_print]
        joints_deg = [round(x, 2) for x in joints_deg]
        print "current pose:", joints_deg
        
    else:
        print "ROBOT IS OFFLINE"
        
        
#==================================================================
    
    
#if testA:
#    robot.comm.float_arbitrary = 1
#    robot.comm.send_stop()
#    robot.comm.send_set_speed(200, 5)
#    robot.comm.send_pose_cartesian(LocationA, ext_axesA)
#    robot.comm.send_stop()
    
    
if send_joints_single:
    robot.comm.send_stop()
    if len(joints_abb) < 9:
        joints_abb.extend([0,0])
    joints_abb = [float(x) for x in joints_abb]
    print(joints_abb)
    robot.comm.send_axes_absolute(joints_abb, int_arr = None)
    
#get data tree into list of lists of floats
joints_abb_list = tree_to_list(joints_abb_list, 0)
joints_abb_list_2 = []
for joints_abb in joints_abb_list:
    joints_abb = [float(item) for item in joints_abb]
    joints_abb_list_2.append(joints_abb)
#send list of joints
if send_joints_list:
    robot.comm.send_stop()
    print(type(joints_abb_list_2[0][0]))
    robot.comm.send_axes_absolute_list(joints_abb_list_2, int_arr = None)
    
    
    
joints_sequence = tree_to_list(joints_sequence, 0)
joints_abb_sequence = []
for sequence in joints_sequence:
    move_new = []
    for move in sequence:
        joints_new = []
        for joints in move:
#            print(joints)
            joints.append(joints.pop(0))
            joints.extend([0,0])
    #        joints_list = [float(item) for item in joints_list]
            joints[:6] = [m.degrees(item) for item in joints[:6]]
            joints[6] = joints[6] * 1000
            joints_new.append(joints)
#            print(joints)
        move_new.append(move)           
    joints_abb_sequence.append(sequence)       
#print(len(joints_sequence[0][0]))
#print(len(joints_abb_sequence[0][0]))

if send_joints_sequence:
    robot.comm.send_stop()
    for sequence in joints_abb_sequence:
        transfer = sequence[0]
        place_approach = sequence[1]
        place_retreat = sequence[2]
        transit = sequence[3]
        print(transfer)
        
        robot.comm.send_close_gripper()
        robot.comm.send_axes_absolute_list(transfer, int_arr = None)
        robot.comm.send_axes_absolute_list(place_approach, int_arr = None)
        robot.comm.send_open_gripper()
        robot.comm.send_axes_absolute_list(place_retreat, int_arr = None)
        robot.comm.send_axes_absolute_list(transit, int_arr = None)
        robot.comm.send_stop()
        
        #MULTIPLE MOVES
#    if PICKUP_all:
#        list_ext_axes = []
#        for i in range(len(list_planes1)):
#            list_ext_axes.append(ext_axes)
#        
#        robot.float_arbitrary = int(rob_num)
#        
#        robot.comm.send_pose_cartesian(list_planes1[0], list_ext_axes[0])
#        robot.comm.send_open_gripper()
#        robot.comm.send_pose_cartesian(list_planes1[1], list_ext_axes[1])
#        robot.comm.send_close_gripper()
#        robot.comm.send_pose_cartesian(list_planes1[0], list_ext_axes[0])
        
if open_gripper:
    robot.comm.send_open_gripper()
    
if close_gripper:
    robot.comm.send_close_gripper()
    
#==================================================================

#Right now, this command always moves the track. WIP
#if set_joint_6_to_zero:
#    robot.float_arbitrary = int(rob_num)
#    
#    posej = robot.comm.get_current_pose_joint()
#    posej_deg = [m.degrees(j) for j in posej]
#    
#    joints_list = posej_deg[0:9]
#    joints_list[5] = 0
#    joints_list[3] = 0
#    joints_list.append(0)
#    joints_list.append(0)
#    joints_list.append(0)
#    joints_list = [float(x) for x in joints_list]
#    print(joints_list)
#    
#    robot.comm.send_stop()
#    robot.comm.send_axes_absolute(joints_list, int_arr = None)
# ---------- end python ----------
panel_20 = Panel(python.out)

# ----
python_2 = PythonScript(
    testB=testb,
    send_joints_sequence=send_joints_sequence,
    open_gripper=open_gripper,
    close_gripper=close_gripper,
    rob_num=number_slider,
    rob_speed=list_2)  # -> out, a; inputs joints_abb_list: tree, joints_sequence: tree
# ---------- python_2: Python ----------
from abb_communication.clients.rfl_robot.communication.messages.messagetypes import *

import Rhino.Geometry as rg
from ghpythonlib.treehelpers import list_to_tree, tree_to_list

from abb_communication.geometry import Frame
from scriptcontext import sticky as st
import math as m
from threading import Thread


#ext_axesA = [3532,0,0]
#ext_axesB = [168,0,0]
robot = st["rfl_robot"]

if robot:    
    robot.comm.float_arbitrary = int(rob_num)
    print("robot found")
    
    
    if rob_speed == 1:
        print "robot speed: fast"
        robot.comm.send_set_speed(250)
    if rob_speed == 2:
        print "robot speed: mid"
        robot.comm.send_set_speed(100)
    if rob_speed == 3:
        print "robot speed: slow"
        robot.comm.send_set_speed(10)
    
    if robot.comm.running:
        print "ROBOT IS ONLINE"
        
        joints_print = robot.comm.get_current_pose_joint()
        print "current joints:", joints_print
        joints_deg = [m.degrees(j) for j in joints_print]
        joints_deg = [round(x, 2) for x in joints_deg]
        print "current pose:", joints_deg
        
    else:
        print "ROBOT IS OFFLINE"
        
        
#==================================================================
    
    
#if testA:
#    robot.comm.float_arbitrary = 1
#    robot.comm.send_stop()
#    robot.comm.send_set_speed(200, 5)
#    robot.comm.send_pose_cartesian(LocationA, ext_axesA)
#    robot.comm.send_stop()
    
    
if send_joints_single:
    robot.comm.send_stop()
    if len(joints_abb) < 9:
        joints_abb.extend([0,0])
    joints_abb = [float(x) for x in joints_abb]
    print(joints_abb)
    robot.comm.send_axes_absolute(joints_abb, int_arr = None)
    
#get data tree into list of lists of floats
joints_abb_list = tree_to_list(joints_abb_list, 0)
joints_abb_list_2 = []
for joints_abb in joints_abb_list:
    joints_abb = [float(item) for item in joints_abb]
    joints_abb_list_2.append(joints_abb)
#send list of joints
if send_joints_list:
    robot.comm.send_stop()
    print(type(joints_abb_list_2[0][0]))
    robot.comm.send_axes_absolute_list(joints_abb_list_2, int_arr = None)
    
    
joints_sequence = tree_to_list(joints_sequence, lambda x:x) #0
joints_abb_sequence = []
for sequence in joints_sequence:
    move_new = []
    for move in sequence:
        joints_new = []
        for joints in move:
#            print(joints)
            joints.append(joints.pop(0))
            joints.extend([0,0])
    #        joints_list = [float(item) for item in joints_list]
            joints[:6] = [m.degrees(item) for item in joints[:6]]
            joints[6] = joints[6] * 1000
            joints_new.append(joints)
#            print(joints)
        move_new.append(move)           
    joints_abb_sequence.append(sequence)       
#print(len(joints_sequence[0][0]))
#print(len(joints_abb_sequence[0][0]))

if send_joints_sequence:
    robot.comm.send_stop()
    for sequence in joints_abb_sequence:
        transfer = sequence[0]
        place_approach = sequence[1]
        place_retreat = sequence[2]
        transit = sequence[3]
        print(transfer)
        
        robot.comm.send_close_gripper()
        robot.comm.send_axes_absolute_list(transfer, int_arr = None)
        robot.comm.send_axes_absolute_list(place_approach, int_arr = None)
        robot.comm.send_open_gripper()
        robot.comm.send_axes_absolute_list(place_retreat, int_arr = None)
        robot.comm.send_axes_absolute_list(transit, int_arr = None)
        robot.comm.send_stop()
        
        #MULTIPLE MOVES
#    if PICKUP_all:
#        list_ext_axes = []
#        for i in range(len(list_planes1)):
#            list_ext_axes.append(ext_axes)
#        
#        robot.float_arbitrary = int(rob_num)
#        
#        robot.comm.send_pose_cartesian(list_planes1[0], list_ext_axes[0])
#        robot.comm.send_open_gripper()
#        robot.comm.send_pose_cartesian(list_planes1[1], list_ext_axes[1])
#        robot.comm.send_close_gripper()
#        robot.comm.send_pose_cartesian(list_planes1[0], list_ext_axes[0])
        
if open_gripper:
    robot.comm.send_open_gripper()
    
if close_gripper:
    robot.comm.send_close_gripper()
    
#==================================================================

#Right now, this command always moves the track. WIP
#if set_joint_6_to_zero:
#    robot.float_arbitrary = int(rob_num)
#    
#    posej = robot.comm.get_current_pose_joint()
#    posej_deg = [m.degrees(j) for j in posej]
#    
#    joints_list = posej_deg[0:9]
#    joints_list[5] = 0
#    joints_list[3] = 0
#    joints_list.append(0)
#    joints_list.append(0)
#    joints_list.append(0)
#    joints_list = [float(x) for x in joints_list]
#    print(joints_list)
#    
#    robot.comm.send_stop()
#    robot.comm.send_axes_absolute(joints_list, int_arr = None)
# ---------- end python_2 ----------
toggle = BooleanToggle(False)
label_font_size = Slider(0.02, range=0.01..0.1)

# ---- group: Init Robot
# tools
list_3 = ValueList({"no tool": 10, "ecl gripper": 0}, selected="ecl gripper")

# 1
init = Button()
list_4 = ValueList({"192.168.125.1", "127.0.0.1", "192.168.0.21", "192.168.0.11"}, selected="192.168.125.1")
abb_4600 = ABB_4600(init=init, ip_abb=list_4)
tool = Tool(int=list_3)
set_tool_and_base = PythonScript(robot=abb_4600, tool=tool)  # -> out, robot, gantry_geo, tool_geo
# ---------- set_tool_and_base: Python ----------
from scriptcontext import sticky as st


robot.set_tool(tool)
#robot.set_gantry(gantry)
#robot.set_robot_origin(base_plane1, 1)
# set_robot_origin_with_measured_base(self, base_plane):

st["rfl_robot"] = robot

if tool:
    tool_geo = tool.geo
#gantry_geo = gantry.geo
# ---------- end set_tool_and_base ----------
mesh_3 = Mesh(set_tool_and_base.tool_geo)

# ---- group: Connect Robot
# 3
refresh_text_window = Button()
# 2
r_on = Button()
r_off = Button()
reset_robot = Button()
if_connection = PythonScript(
    robot=set_tool_and_base.robot,
    connect_robot=r_on,
    close_robot=r_off,
    refresh=refresh_text_window,
    reset_robot=reset_robot)  # -> out; inputs connect_robot: Boolean, close_robot: Boolean, refresh: Boolean
# ---------- if_connection: Python ----------
import Rhino.Geometry as rg
from abb_communication.clients.rfl_robot.communication.messages.clientstates import *

print robot.comm.running

# =========================================================================================    
if connect_robot == True:
    if robot.comm.running == False:
        robot.comm.start()
    else:
        pass

# =========================================================================================    
if close_robot == True:
    if robot.comm.running == True:
        robot.comm.close()
        robot.comm.cmd_counter_to_client = 0
        robot.comm.cmd_exec_counter_from_client = 0
        robot.comm.publish_state(1)
    else:
        pass

if reset_robot:
    robot.comm.close()
    robot.comm.cmd_counter_to_client = 0
    robot.comm.cmd_exec_counter_from_client = 0
    robot.comm.publish_state(1)
    try:
        robot.comm.start()
    except:
        print "CONNECTION TO ABB FAILED"

robot_conncection_state = "online" if robot.comm.running else "offline"
print "ABB CONNECTION STATE:", robot_conncection_state
print "ABB STATE: ", client_states_str_array[robot.comm.state]
print "Sent commands to ABB: ",  robot.comm.get_cmd_counter()
print "Executed commands from ABB: ",  robot.comm.cmd_exec_counter_from_client
# ---------- end if_connection ----------
panel_21 = Panel(if_connection)

# ----
scale = Scale(Geometry=mesh_3, Center=Point(0, 0, 0), Factor="1e-3")  # -> Geometry, Transform

# ---- group: gripper mesh (meter)
mesh_4 = Mesh(scale.Geometry)

# ---- group: move gripper and bar to a better place for viz
orient_7 = Orient(Geometry=flatten(mesh_4), Source=xy_plane_4, Target=xy_plane_5)  # -> Geometry, Transform

# ---- group: jaw geometry
list_item_11 = ListItem(
    List=orient_7.Geometry,
    Index=[Slider(26, range=0..54), Slider(28, range=0..54), Slider(31, range=0..54), Slider(29, range=0..54)],
    Wrap=True)

# ----
list_item_12 = ListItem(List=orient_7.Transform, Index=0, Wrap=True)
bounding_box = BoundingBox(Content=list_item_11, Plane=PlaneXY(0, 0, 0), UnionBox=True)  # -> Box, Box_2
transform = Transform(Geometry=pipe_2, Transform=list_item_12)
transform_2 = Transform(Geometry=curve_3, Transform=list_item_12)
deconstruct_brep = DeconstructBrep(Brep=bounding_box.Box)  # -> Faces, Edges, Vertices
deconstruct_box_length = DeconstructBoxLength(box=bounding_box.Box)  # -> x_length_width, y_length_length, z_length_height

# ---- group: jaw width
number_8 = Number(deconstruct_box_length.x_length_width)

# ----
end_points = EndPoints(Curve=transform_2)  # -> Start, End
list_item_13 = ListItem(List=deconstruct_brep.Edges, Index=Slider(7, range=0..11), Wrap=True)
concatenate_4 = Concatenate(FragmentA=deconstruct_box_length.x_length_width, FragmentB=" (meter)")
merge_2 = Merge(Data1=end_points.Start, Data2=end_points.End)
deconstruct = Deconstruct(Point=merge_2)  # -> XComponent, YComponent, ZComponent
point_5 = Point(merge_2)

# ---- group: jaw bounding box
box = Box(bounding_box.Box)

# ----
sort_list = SortList(Keys=deconstruct.YComponent, ValuesValuesA=point_5)  # -> Keys, ValuesValuesA
deconstruct_brep_2 = DeconstructBrep(Brep=box)  # -> Faces, Edges, Vertices
list_item_14 = ListItem(List=deconstruct_brep_2.Faces, Index=0, Wrap=True)  # -> Item, Item1, Item2
list_item_15 = ListItem(List=sort_list.ValuesValuesA, Index=0, Wrap=True)  # -> Item, Item1
brep_closest_point = BrepClosestPoint(Point=list_item_15.Item1, Brep=list_item_14.Item2)  # -> Point, unitize(Normal), Distance
brep_closest_point_2 = BrepClosestPoint(Point=list_item_15.Item, Brep=list_item_14.Item)  # -> Point, unitize(Normal), Distance
line_2 = Line(StartPoint=list_item_15.Item, EndPoint=brep_closest_point_2.Point)
multiplication_2 = Multiplication(A=brep_closest_point.Normal, B=brep_closest_point.Distance)
line_3 = Line(StartPoint=list_item_15.Item1, EndPoint=brep_closest_point.Point)
multiplication_3 = Multiplication(A=brep_closest_point_2.Normal, B=brep_closest_point_2.Distance)
deconstruct_vector = DeconstructVector(Vector=multiplication_3)  # -> XComponent, YComponent, ZComponent
deconstruct_vector_2 = DeconstructVector(Vector=multiplication_2)  # -> XComponent, YComponent, ZComponent
brep_3 = Brep(transform)
format = Format(Format="{0:0.0000}", Culture=127, Data0=deconstruct_vector.YComponent)
format_2 = Format(Format="{0:0.0000}", Culture=127, Data0=deconstruct_vector_2.YComponent)
custom_preview_3 = CustomPreview(Geometry=brep_3, Material=ColourSwatch(SwatchColor=RGBA(255, 59, 255, 40)))
line_dimension = LineDimension(Line=list_item_13, Text=concatenate_4, Size=label_font_size)
line_dimension_2 = LineDimension(Line=line_2, Text=format, Size=label_font_size)
line_dimension_3 = LineDimension(Line=line_3, Text=format_2, Size=label_font_size)

# ----
# Overall bar cut / grasp statistics
curve_4 = Curve(orient_4.Geometry)
cluster = Cluster(point=point_4, A=number_8, curve=curve_4)  # -> result_2, result
list_item_16 = ListItem(List=number_7, Index=integer_5, Wrap=True)

# ---- group: distance between left end of the bar and the haw and the left jaw's edge
number_9 = Number(flatten(cluster.result_2))

# ---- group: distance between RIGHT end of the bar and the haw and the RIGHT jaw's edge
number_10 = Number(flatten(cluster.result))

# ----
list_item_17 = ListItem(List=number_9, Index=integer_5, Wrap=True)
list_item_18 = ListItem(List=number_10, Index=integer_5, Wrap=True)

format_3 = Format(Format="{0:0.0000}", Culture=127, Data0=list_item_18)
format_4 = Format(Format="{0:0.0000}", Culture=127, Data0=list_item_16)
format_5 = Format(Format="{0:0.0000}", Culture=127, Data0=list_item_17)

seq_id_bar_length_in_meter = Panel(format_4)
seq_id_jaw_left_length_meter = Panel(format_5)
seq_id_jaw_right_length_meter = Panel(format_3)
seq_id_element_id = Panel(integer_5)

# ==== cluster Tool
init = ClusterInput()
mesh = Mesh([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])
pln = Plane(Plane(origin=(0.0867109651, 1.472961418, 319.9745917), x=(-0.99999089, -0.004254372967, 0.0003466928643), y=(0.004257543076, -0.9999436638, 0.009723299055)))
plane = Plane(PlaneXY(0, 0, 0))
int = ClusterInput()
int_2 = Integer(int)

set_tool = PythonScript(init=init, tool_geo=mesh, tool_plane=plane)  # -> out, tool, tool_plane, tool_geo, tool_axes, tool_axes_colors; inputs tool_geo: list of Mesh, tool_plane: Plane
# ---------- set_tool: Python ----------
import Rhino.Geometry as rg
import ghpythonlib.components as ghcomp
import math as m


from abb_communication.clients.rfl_robot import MeshMouldTool
from abb_communication.clients.rfl_robot.tool import LwsGripperTool
#from abb_communication.clients.rfl_robot import Tool
from abb_communication.geometry import Frame


tool = LwsGripperTool(tool_geo, tool_plane)

tool_plane = tool.get_plane()
tool_axes, tool_axes_colors = tool.get_frame_axes_as_lines()
# ---------- end set_tool ----------
pln_2 = Plane(set_tool.tool_plane)
preview = CustomPreview(Geometry=set_tool.tool_axes, Shader=set_tool.tool_axes_colors)
geo = Geometry(set_tool.tool_geo)
preview_2 = CustomPreview(Geometry=geo, Shader=ColourSwatch(SwatchColor=RGBA(100, 168, 178, 162)))

select_tool = StreamFilter(Gate=int_2, Stream0=set_tool.tool)
tool = Data(select_tool)
tool_2 = ClusterOutput(tool)

# ==== cluster ABB_4600
base = Mesh([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])
l1 = Mesh(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)
l3 = Mesh(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)
l4 = Mesh(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)
l5 = Mesh(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)
l6 = Mesh(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)
l2 = Mesh(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)
mesh = Mesh([l1, l2, l3, l4, l5, l6])
ip_abb = ClusterInput()
init = ClusterInput()
plane = Plane([PlaneXY(-1.185867404e-09, 0, 0), Plane(origin=(175, 0, 495), x=(0, 0, 1), y=(1, 0, 0)), Plane(origin=(175, 0, 1590), x=(0, 0, 1), y=(1, 0, 0)), Plane(origin=(175, 0, 1765), x=(0, 0, -1), y=(0, 1, 0)), Plane(origin=(1446, 0, 1765), x=(0, 0, 1), y=(1, 0, 0)), Plane(origin=(1581, 0, 1765), x=(-1.94917184e-05, 1.016258774e-11, -0.9999999998), y=(-2.075117433e-05, 0.9999999998, 4.146386344e-10))])
if = PythonScript(init=init, ip_abb=ip_abb, joint_planes=plane, base_geo=base, link_geo=mesh)  # -> robot; inputs joint_planes: list of Plane, base_geo: list of Mesh, link_geo: list of Mesh
# ---------- if: Python ----------
from abb_communication.clients import Robot

robot = Robot(link_geo, base_geo, joint_planes, ip_abb = ip_abb)
# ---------- end if ----------
robot = ClusterOutput(if)

# ==== cluster DeconstructBoxLength
box = ClusterInput()
deconstruct_box = DeconstructBox(Box=box)  # -> Plane, X, Y, Z
deconstruct_domain = DeconstructDomain(Domain=deconstruct_box.X)  # -> Start, End
deconstruct_domain_2 = DeconstructDomain(Domain=deconstruct_box.Y)  # -> Start, End
deconstruct_domain_3 = DeconstructDomain(Domain=deconstruct_box.Z)  # -> Start, End
subtraction = Subtraction(A=deconstruct_domain_2.End, B=deconstruct_domain_2.Start)
subtraction_2 = Subtraction(A=deconstruct_domain.End, B=deconstruct_domain.Start)
subtraction_3 = Subtraction(A=deconstruct_domain_3.End, B=deconstruct_domain_3.Start)
y_length_length = ClusterOutput(subtraction)  # Y length (length)
x_length_width = ClusterOutput(subtraction_2)  # X length (width)
z_length_height = ClusterOutput(subtraction_3)  # Z length (height)

# ==== cluster Cluster
curve = ClusterInput()
point = ClusterInput()
end_points = EndPoints(Curve=curve)  # -> Start, End
point_2 = Point(point)

# ---- group: left point
merge = Merge(Data1=end_points.Start, Data2=end_points.End)
deconstruct = Deconstruct(Point=merge)  # -> XComponent, YComponent, ZComponent
point_3 = Point(merge)
sort_list = SortList(Keys=deconstruct.YComponent, ValuesValuesA=point_3)  # -> Keys, ValuesValuesA
list_item = ListItem(List=sort_list.ValuesValuesA, Index=0, Wrap=True)  # -> Item, Item1

# ----
A = ClusterInput()
distance = Distance(PointA=list_item.Item, PointB=point_2)
distance_2 = Distance(PointA=list_item.Item1, PointB=point_2)
division = Division(A=A, B="2")
number = Number(division)
subtraction = Subtraction(A=distance_2, B=number)
subtraction_2 = Subtraction(A=distance, B=number)
result = ClusterOutput(subtraction)
result_2 = ClusterOutput(subtraction_2)
