# Grasshopper definition plan_to_abb_track_YJ_V2.ghx (Grasshopper 1.0.7)
# plug-ins: karambaGH

panel = Panel("IA_Arch_subset_4_tets_regression-z_solution_20-12-19_20-19-02.json")
panel_2 = Panel("1_exp_tets_regression-z_solution_20-12-19_13-54-08.json")
concatenate = Concatenate(FragmentA="d:\code_ws\pb_ws\coop_assembly\tests\results\", FragmentB=panel)

# ---- group: end effector definition from flange
robot_dof = Panel("7")
point = Point("0,0,0.3705")

# ----
rhino_doc_dir = RhinoDocDir()  # -> rhino_doc_dir
# ---------- rhino_doc_dir: Python ----------
import scriptcontext as sc
from os import path

rhino_doc_dir = path.abspath(path.dirname(sc.doc.Path))
# ---------- end rhino_doc_dir ----------
text = Text(rhino_doc_dir)
ghpython_script = GhPythonScript(x=text, y="1_exp_tets_regression-z__solution_20-12-19_11-29-23.json")  # -> out, a
# ---------- ghpython_script: Python ----------
import os

a = os.path.abspath(os.path.join(x, '..', '..', 
    'tests', 'results', y))
# ---------- end ghpython_script ----------
panel_3 = Panel(concatenate)
rhino_doc_dir_2 = RhinoDocDir()  # -> rhino_doc_dir; same code as rhino_doc_dir
panel_4 = Panel("eef_base_link")
ghpython_script_2 = GhPythonScript(x=rhino_doc_dir_2)  # -> out, a
# ---------- ghpython_script_2: Python ----------
import os

a = os.path.abspath(os.path.join(x,"..","..","..","conmech"))
# ---------- end ghpython_script_2 ----------
panel_5 = Panel(ghpython_script_2.a)
text_2 = Text(concatenate)
ghpython_script_3 = GhPythonScript(result_file_path=concatenate, ee_link_name="eef_tcp_frame", scale="1")  # -> out, paths, ee_paths, elements, tags, grasps, axispts_from_index, radius, goal_poses
# ---------- ghpython_script_3: Python ----------
import rhinoscriptsyntax as rs
import Rhino.Geometry.Plane as Plane
import Rhino.Geometry.Point3d as Point3d
import Rhino.Geometry.Vector3d as Vector3d
import Rhino.Geometry.Quaternion as Quat
import Rhino.Geometry.Line as Line
import Rhino.Geometry.Transform as Transform
import Grasshopper.DataTree as DataTree # Add, AddRange(list, GHPath(i, j))
import Grasshopper.Kernel.Data.GH_Path as GHPath
import System

from ghpythonlib.treehelpers import list_to_tree, tree_to_list

import json
from compas.geometry import Frame
from compas.geometry import scale_points
from compas_ghpython import draw_pipes, draw_frame
from itertools import islice

######################################

def pose_from_frame(frame, scale=1.0):
    """Returns a PyBullet pose from a frame.
    Parameters
    ----------
    frame : :class:`compas.geometry.Frame`
    Returns
    -------
    point, quaternion : tuple
    """
    return ([v*scale for v in frame.point], frame.quaternion.xyzw)


def frame_from_pose(pose, scale=1.0):
    """Returns a frame from a PyBullet pose.
    Parameters
    ----------
    point, quaternion : tuple
    Returns
    -------
    :class:`compas.geometry.Frame`
    """
    point, (x, y, z, w) = pose
    return Frame.from_quaternion([w, x, y, z], point=[v*scale for v in point])

#########################################

with open(result_file_path) as json_file:
    data = json.load(json_file)

print('file_name: {}'.format(data['problem']))
try:
    print('write_time: {}'.format(data['write_time']))
    print('parameters: {}'.format(data['parameters']))
except:
    pass

# parse trajectories and EE paths (indexed by sequence index)
paths = DataTree[System.Double]()
ee_paths = DataTree[Plane]()
elements = DataTree[System.Int32]()
tags = DataTree[System.String]()
grasps = DataTree[Plane]()
for seq_id, e_trajs in enumerate(data['plan']):
    if seq_id == 0:
        del e_trajs[0]
    for sp_id, traj in enumerate(e_trajs):
        path = traj['path']
        epath = traj['link_path'][ee_link_name]
        for t_id, (conf, epose) in enumerate(zip(path, epath)):
            conf = [float(v) for v in conf]
            paths.AddRange(conf, GHPath(seq_id, sp_id, t_id))
            ee_paths.Add(draw_frame(frame_from_pose(epose, scale)), GHPath(seq_id, sp_id, t_id))
            
        if traj['element'] is not None: 
            elements.Add(traj['element'], GHPath(seq_id, sp_id))
        else:
            elements.Add(-1000, GHPath(seq_id, sp_id))
        tags.Add(traj['tag'], GHPath(seq_id, sp_id))
        
        for attach_data in traj['attachments']:
            g_frame = frame_from_pose(attach_data['grasp_pose'], scale=scale)
            grasps.Add(draw_frame(g_frame), GHPath(seq_id, sp_id))

# reconstruct shape (indexed by bar index)
axispts_from_index = DataTree[Point3d]()
radius = DataTree[System.Double]()
goal_poses = DataTree[Plane]()
for e_id, edata in data['element_from_index'].items():
    radius.Add(edata['radius']*scale, GHPath(int(e_id)))
    
    goal_frame = frame_from_pose(edata['goal_pose']['value'], scale=scale)
    goal_poses.Add(draw_frame(goal_frame), GHPath(int(e_id)))
    
    scaled_pts = scale_points(edata['axis_endpoints'], scale)
    for i in range(2):
        axispts_from_index.Add(Point3d(*scaled_pts[i]), GHPath(int(e_id)))
# ---------- end ghpython_script_3 ----------
ghpython_script_4 = GhPythonScript(conmech_dir=ghpython_script_2.a, result_file_path=text_2, limit_distance="1e-12")  # -> out, Model_out, fem_element_from_bar_id, deform_history, element_sequence
# ---------- ghpython_script_4: Python ----------
import rhinoscriptsyntax as rs
import Rhino.Geometry.Plane as Plane
import Rhino.Geometry.Point3d as Point3d
import Rhino.Geometry.Vector3d as Vector3d
import Rhino.Geometry.Quaternion as Quat
import Grasshopper.DataTree as DataTree # Add, AddRange(list, GHPath(i, j))
import Grasshopper.Kernel.Data.GH_Path as GHPath
import System
from System.Collections.Generic import List

from ghpythonlib.treehelpers import list_to_tree, tree_to_list
import os
import json
##############################

import clr
# https://ironpython.net/documentation/dotnet/dotnet.html

clr.AddReferenceToFileAndPath("C:\Program Files\Rhino 6\Plug-ins\Karamba.gha")
clr.AddReferenceToFileAndPath("C:\Program Files\Rhino 6\Plug-ins\KarambaCommon.dll")

import feb # Karamba's C++ library (undocumented in the API)
import Karamba.Models.Model as Model
import Karamba.GHopper.Models.GH_Model as GH_Model
#
import Karamba
import Karamba.Elements.ModelTruss as Truss
from Karamba.Geometry import Point3, Line3, Vector3
from Karamba.CrossSections import CroSec
from Karamba.Supports import Support
from Karamba.Loads import Load
#
from Karamba.Utilities import MessageLogger, UnitsConversionFactories
import KarambaCommon
#
import System
from System import GC
from System.Collections.Generic import List

#####################################
# add path to conmech script folder
import os, sys 
sys.path.append(os.path.join(conmech_dir, "src", "pyconmech", "frame_analysis"))
#from io_base import Model
import io_base
import karamba_io
reload(io_base)
reload(karamba_io)
from karamba_io import KarambaModel
from io_base import LoadCase, GravityLoad

#####################################

with open(os.path.join(result_file_path), 'r') as f:
    data = json.load(f)
    conmech_data = data['conmech_model']

print('{} | {}'.format(conmech_data["model_name"], conmech_data['generate_time']))
km = KarambaModel.from_data(conmech_data)
#lc = LoadCase.from_data(data['loadcases']['0'])

model = km.to_karamba(LoadCase(gravity_load=GravityLoad([0,0,-1])), limit_dist=limit_distance)

## calculate Th.I response
#logger = MessageLogger();
#k3d = KarambaCommon.Toolkit();
#max_disp = clr.Reference[List[float]]()
#out_g = clr.Reference[List[float]]()
#out_comp = clr.Reference[List[float]]()
#message = clr.Reference[str]()
#model = k3d.Algorithms.AnalyzeThI(model, max_disp, out_g, out_comp, message);
#
#ucf = UnitsConversionFactories.Conv();
#cm = ucf.cm();
#print "max disp: {} {}".format(cm.toUnit(max_disp.Value[0]), cm.unitB)
#
Model_out = Karamba.GHopper.Models.GH_Model(model);
#
#from Karamba.GHopper.CrossSections import GH_CrossSection
#a = List[GH_CrossSection]([GH_CrossSection(cs.to_karamba()) for cs in km.crosssecs])

fem_data = conmech_data['fem_element_from_bar_id']
fem_element_from_bar_id = DataTree[int]()
for i, es in fem_data.items():
    if int(i) >= 0:
        fem_element_from_bar_id.AddRange(es, GHPath(int(i)))

deform_history = [trans[1] for trans in data['stiffness_history']]

element_sequence = DataTree[System.Int32]()
for seq_id, e_trajs in enumerate(data['plan']):
    if seq_id == 0:
        del e_trajs[0]
    for sp_id, traj in enumerate(e_trajs):
        if traj['element'] is not None: 
            element_sequence.Add(traj['element'], GHPath(seq_id, sp_id))
        else:
            element_sequence.Add(-1000, GHPath(seq_id, sp_id))
# ---------- end ghpython_script_4 ----------
panel_6 = Panel(ghpython_script_3.out)

# ---- group: bar radius
number = Number(ghpython_script_3.radius)

# ---- group: axis end pts (indexed by bar id)
point_2 = Point(ghpython_script_3.axispts_from_index)

# ---- group: bar goal poses
plane = Plane(ghpython_script_3.goal_poses)

# ---- group: ee_path, indexed by seq_id
plane_2 = Plane(ghpython_script_3.ee_paths)

# ---- group: tool link
point_3 = Point(point)

# ---- group: grasp, indexed in seq_id
plane_3 = Plane(ghpython_script_3.grasps)

# ----
shift_paths = ShiftPaths(Data=ghpython_script_4.element_sequence, Offset=-1)
python_karamba_model_converter = PythonKarambaModelConverter(
    Model_in=ghpython_script_4.Model_out,
    Reference=["C:\Program Files\Rhino 6\Plug-ins\karambaCommon.dll", "C:\Program Files\Rhino 6\Plug-ins\karamba.gha"])  # -> out, flatten(Model_out)
# ---------- python_karamba_model_converter: Python usings ----------
using Karamba.Models;
using Karamba.GHopper.Models;
# ---------- python_karamba_model_converter: Python ----------
    var model = Model_in as Model;
    if (model == null) {
      throw new ArgumentException("The input in 'Model_in' is not of type karamba.Models.Model!");
    }

    Model_out = new GH_Model(model);

    Print("Everything OK");
# ---------- end python_karamba_model_converter ----------
disassemble_model_karamba3d = DisassembleModelKaramba3D(Model=python_karamba_model_converter.Model_out)  # -> Model, Point, Beam, Shell, Support, Load, Line, Mesh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
list_length = ListLength(List=disassemble_model_karamba3d.Beam)
panel_7 = Panel("""{*;0}
{*;1}
{*;2}
{*;3}""")
list_item = ListItem(List=point_2, Index=0, Wrap=True)  # -> Item, Item1
list_item_2 = ListItem(List=panel_7, Index=0, Wrap=True)  # -> Item, Item1, Item2, Item3
list_item_3 = ListItem(List=shift_paths, Index=0, Wrap=True)  # -> flatten(Item)
line = Line(StartPoint=list_item.Item, EndPoint=list_item.Item1)
shift_paths_2 = ShiftPaths(Data=ghpython_script_3.paths, Offset=-1)
shift_paths_3 = ShiftPaths(Data=plane_3, Offset=-1)
panel_8 = Panel(ghpython_script_4.deform_history)
xy_plane = XYPlane(Origin=Point(0, 0, 0))
shift_paths_4 = ShiftPaths(Data=plane_2, Offset=-1)

# ---- group: transit, place approach
panel_9 = Panel("""{*;0}
{*;1}""")

# ----
length = Length(Curve=line)
pipe = Pipe(Curve=line, Radius=number, Caps=0)
wire_type = Slider(1, range=0..2)
panel_10 = Panel(shift_paths_2)
split_tree = SplitTree(Data=shift_paths_2, Masks=flatten(list_item_2.Item1))  # -> Positive, Negative
split_tree_2 = SplitTree(Data=shift_paths_2, Masks=flatten(list_item_2.Item2))  # -> Positive, Negative
split_tree_3 = SplitTree(Data=shift_paths_2, Masks=flatten(list_item_2.Item))  # -> Positive, Negative
split_tree_4 = SplitTree(Data=shift_paths_2, Masks=flatten(list_item_2.Item3))  # -> Positive, Negative
clean = Button()
orient = Orient(Geometry=pipe, Source=plane, Target=xy_plane)  # -> Geometry, Transform
orient_2 = Orient(Geometry=line, Source=plane, Target=xy_plane)  # -> Geometry, Transform
split_tree_5 = SplitTree(Data=shift_paths_4, Masks=flatten(panel_9))  # -> Positive, Negative

# ---- group: indexed by seq_id
list_item_4 = ListItem(List=shift_paths_3, Index=0, Wrap=True)

# ----
partition_list = PartitionList(List=split_tree_2.Positive, Size=robot_dof)
wirecleaner = WireCleaner(on=clean, wire_type=wire_type)  # -> out, a
# ---------- wirecleaner: Python ----------
from Grasshopper.Kernel import GH_ParamWireDisplay
from Grasshopper.Kernel import GH_RuntimeMessageLevel 

# A dictionary of wire types 
wire_display = {'0':GH_ParamWireDisplay.default, 
                '1':GH_ParamWireDisplay.faint,
                '2':GH_ParamWireDisplay.hidden}

# Get selected components and change the wire display
if on:
    doc = ghenv.Component.OnPingDocument()
    sel_objs = doc.SelectedObjects()
    if not len(sel_objs):
        ghenv.Component.AddRuntimeMessage(GH_RuntimeMessageLevel.Warning, 'Nothing was selected')
    for sel_obj  in sel_objs:
        if hasattr(sel_obj, 'Params'):
            for p in sel_obj.Params.Input:
                if hasattr(p, 'WireDisplay'):
                    p.WireDisplay = wire_display[wire_type]
        else:
            if hasattr(sel_obj, 'WireDisplay'):
                sel_obj.WireDisplay = wire_display[wire_type]
# ---------- end wirecleaner ----------
partition_list_2 = PartitionList(List=split_tree.Positive, Size=robot_dof)
partition_list_3 = PartitionList(List=split_tree_4.Positive, Size=robot_dof)
partition_list_4 = PartitionList(List=split_tree_3.Positive, Size=robot_dof)

# ---- group: tags
integer = Integer(ghpython_script_3.elements)
shift_paths_5 = ShiftPaths(Data=integer, Offset=-1)
text_3 = Text(ghpython_script_3.tags)
list_item_5 = ListItem(List=shift_paths_5, Index=0, Wrap=True)
concatenate_2 = Concatenate(Fragment_A="; element #", Fragment_B=integer, A=", ", B=text_3)
tree_statistics = TreeStatistics(Tree=list_item_5)  # -> Paths, Length, Count

# ---- group: seq_id : beam_id
integer_2 = Integer(list_item_5)

# ---- group: Map seq_id to beam_id
cluster = Cluster(data=shift_paths_3, integer=integer_2)
list_item_6 = ListItem(List=cluster, Index=0, Wrap=True)

# ----
panel_11 = Panel(wirecleaner.out)

# ---- group: transfer
number_2 = Number(partition_list_4)

# ---- group: place retreat
number_3 = Number(partition_list)

# ---- group: transit
number_4 = Number(partition_list_3)

# ---- group: place approach
number_5 = Number(partition_list_2)

# ---- group: bar at origin (indexed by bar id)
geometry = Geometry(orient_2.Geometry)

# ----
plane_4 = Plane(plane)
shift_paths_6 = ShiftPaths(Data=split_tree_5.Positive, Offset=-1)
plane_5 = Plane(shift_paths_6)

# ---- group: grasp indexed by seq id
plane_6 = Plane(list_item_4)

# ----
point_4 = Point(plane_5)
cluster_2 = Cluster(data=plane_5, integer=integer_2)
panel_12 = Panel("open gripper")
panel_13 = Panel("close gripper")

# ---- group: world_from_flange * flange_from_bar
orient_3 = Orient(Geometry=plane_6, Source=PlaneXY(0, 0, 0), Target=shift_paths_6)  # -> Geometry, Transform

# ----
panel_14 = Panel(cluster_2)

# ---- group: Map bar id to seq id
cluster_3 = Cluster_3(data=geometry, integer=integer_2)

# ----
merge = Merge(Data2=number_2, Data3=number_5, Data5=number_3, Data6=number_4)

# ---- group: grasp indexed by bar id
plane_7 = Plane(list_item_6)

# ---- group: tool_from_bar
orient_4 = Orient(Geometry=geometry, Source=PlaneXY(0, 0, 0), Target=plane_7)  # -> Geometry, Transform

# ---- group: tool link
xy_plane_2 = XYPlane(Origin=point_3)

# ---- group: world_from _bar, indexed by seq id
plane_8 = Plane(orient_3.Geometry)

# ---- group: bar sequence
integer_3 = Integer(integer_2)

# ---- group: flange_from_bar (indexed by bar id)
orient_5 = Orient(Geometry=orient_4.Geometry, Source=PlaneXY(0, 0, 0), Target=xy_plane_2)  # -> Geometry, Transform

# ---- group: bar path indexed by seq id
orient_6 = Orient(Geometry=cluster_3, Source=PlaneXY(0, 0, 0), Target=plane_8)  # -> Geometry, Transform

# ----
panel_15 = Panel("D:\code_ws\pb_ws\coop_assembly\src\coop_assembly\data\models")
integer_4 = Integer(robot_dof)

# ----
# Robot
load = Button()
ghpython_script_5 = PythonScript(
    load=load,
    pkg_path=panel_15,
    pkg_name="abb_irb4600_40_255",
    urdf_file="ECL_robot1_with_track.urdf",
    srdf_file="ECL_robot1_with_track.srdf")  # -> out, robot
# ---------- ghpython_script_5: Python ----------
from scriptcontext import sticky as st
import os
import compas

from compas.robots import RobotModel
from compas.robots import GithubPackageMeshLoader
from compas.robots import LocalPackageMeshLoader
from compas_fab.robots import Robot
from compas_fab.robots import RobotSemantics
from compas_ghpython.artists import RobotModelArtist

# Robot meshes are usually in meters
# Set a high percision to prevent parsing errors
# and configure Rhino itself in meters
compas.PRECISION = '12f'

# Store robot in component-based key
robot_key = 'robot_{}'.format(str(ghenv.Component.InstanceGuid))

if robot_key not in st:
    st[robot_key] = None

if load:
    # Also load geometry
    loader = LocalPackageMeshLoader(pkg_path, pkg_name)
    
    # Create robot model from URDF
    model = RobotModel.from_urdf_string(loader.load_urdf(urdf_file).read())
    model.load_geometry(loader)

    artist = RobotModelArtist(model)
    
    robot_semantics = None
    if srdf_file:
        robot_semantics = RobotSemantics.from_srdf_file(loader.build_path('srdf', srdf_file), model)
    
    robot = Robot(model, artist, semantics=robot_semantics)
    
    st[robot_key] = robot

robot = st[robot_key]

#repo    = 'ros-industrial/abb'
#package = 'abb_irb6600_support'
#branch  = 'kinetic-devel'
#
#github = GithubPackageMeshLoader(repo, package, branch)
#
#model = RobotModel.from_urdf_file(github.load_urdf('irb6640.urdf'))
#model.load_geometry(github)
#artist = RobotModelArtist(model)
#robot = Robot(model, artist)
# ---------- end ghpython_script_5 ----------
robot = Data(ghpython_script_5.robot)

# ---- group: Current bar in grasped pose (flange_from_bar) / indexed by bar ids
number_6 = Number(number)
curve = Curve(orient_5.Geometry)

# ----
panel_16 = Panel(ghpython_script_5.out)
panel_17 = Panel(robot)

# ---- group: meter, degree
# Configuration
gantry = Slider(0, range=0..4)
a1 = Slider(0, range=-360..360)
a2 = Slider(0, range=-360..360)
a4 = Slider(0, range=-360..360)
a5 = Slider(0, range=-360..360)
a3 = Slider(0, range=-360..360)
a6 = Slider(0, range=-360..360)
forward_kinematics = PythonScript(robot=robot, x=gantry, a1=a1, a2=a2, a3=a3, a4=a4, a5=a5, a6=a6)  # -> out, configuration
# ---------- forward_kinematics: Python ----------
import math
from compas_fab.robots import Configuration

if robot:
    joint_values = [a1, a2, a3, a4, a5, a6]
    joint_names = robot.get_configurable_joint_names()
    configuration = Configuration.from_prismatic_and_revolute_values([x], 
        [math.radians(a) for a in joint_values])
    print configuration
# ---------- end forward_kinematics ----------

# ---- group: These numbers are just for viz
construct_point = ConstructPoint(XCoordinate=Slider(3.8, range=0..10), YCoordinate=Slider(0, range=0..10), ZCoordinate=Slider(0, range=0..10))

# ----
radians = Radians(Degrees=a2)
panel_18 = Panel(radians)
xy_plane_3 = XYPlane(Origin=construct_point)
panel_19 = Panel(forward_kinematics.out)

# ----
# . . . . . . . . . . . . . . . . . .
# .                                 .
# .   <<><><>   <<><><>   <<        .
# .   <<        <<        <<        .
# .   <<><><>   <<        <<        .
# .   <<        <<        <<        .
# .   <<        <<        <<        .
# .   <<><><>   <<><><>   <<><><>   .
# .                                 .
# .       Princeton SOA 2020        .
# . . . . . . . . . . . . . . . . . .
# 
# Created on 10.12.2016
# Modified 12.19.2020
# 
# @author: kathrind, stefanap, yijiangh, iant
unload_abb_communication_lib = Button()
# Connecting to ABB IRC5
# i. IP settings ipv4 automatically assign (ping test)
# ii. start the program on pendant (pp to main -> play)
# 1. <<Init>> in GH
# 2. <<R on>> in GH
# 3. Send commands
py = PythonScript(unload=unload_abb_communication_lib)
# ---------- py: Python ----------
from abb_communication.useful import unload_rfl_lib

if unload:
    unload_rfl_lib()
# ---------- end py ----------

xy_plane_4 = XYPlane(Origin=Point(0, 0, 0))
plane_9 = Plane(xy_plane_3)

# ---- group: environment collision objects
mesh = Mesh([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])

# ----
r_on = Button()
send_joints_sequence = Button()
init = Button()

# ----
# 3
assembly_seq = Slider(5, range=0..5)
viz_conf_id = Slider(76, range=0..600)

# ---- group: Init Robot
# tools
list = ValueList({"no tool": 10, "ecl gripper": 0}, selected="ecl gripper")

# 1
list_2 = ValueList({"192.168.125.1", "127.0.0.1", "192.168.0.21", "192.168.0.11"}, selected="192.168.125.1")
tool = Tool(int=list)
abb_4600 = ABB_4600(init=init, ip_abb=list_2)
set_tool_and_base = PythonScript(robot=abb_4600, tool=tool)  # -> out, robot, gantry_geo, tool_geo
# ---------- set_tool_and_base: Python ----------
from scriptcontext import sticky as st


robot.set_tool(tool)
#robot.set_gantry(gantry)
#robot.set_robot_origin(base_plane1, 1)
# set_robot_origin_with_measured_base(self, base_plane):

st["rfl_robot"] = robot

if tool:
    tool_geo = tool.geo
#gantry_geo = gantry.geo
# ---------- end set_tool_and_base ----------
mesh_2 = Mesh(set_tool_and_base.tool_geo)

# ---- group: Connect Robot
refresh_text_window = Button()
# 2
r_off = Button()
reset_robot = Button()
if_connection = PythonScript(
    robot=set_tool_and_base.robot,
    connect_robot=r_on,
    close_robot=r_off,
    refresh=refresh_text_window,
    reset_robot=reset_robot)  # -> out; inputs connect_robot: Boolean, close_robot: Boolean, refresh: Boolean
# ---------- if_connection: Python ----------
import Rhino.Geometry as rg
from abb_communication.clients.rfl_robot.communication.messages.clientstates import *

print robot.comm.running

# =========================================================================================    
if connect_robot == True:
    if robot.comm.running == False:
        robot.comm.start()
    else:
        pass

# =========================================================================================    
if close_robot == True:
    if robot.comm.running == True:
        robot.comm.close()
        robot.comm.cmd_counter_to_client = 0
        robot.comm.cmd_exec_counter_from_client = 0
        robot.comm.publish_state(1)
    else:
        pass

if reset_robot:
    robot.comm.close()
    robot.comm.cmd_counter_to_client = 0
    robot.comm.cmd_exec_counter_from_client = 0
    robot.comm.publish_state(1)
    try:
        robot.comm.start()
    except:
        print "CONNECTION TO ABB FAILED"

robot_conncection_state = "online" if robot.comm.running else "offline"
print "ABB CONNECTION STATE:", robot_conncection_state
print "ABB STATE: ", client_states_str_array[robot.comm.state]
print "Sent commands to ABB: ",  robot.comm.get_cmd_counter()
print "Executed commands from ABB: ",  robot.comm.cmd_exec_counter_from_client
# ---------- end if_connection ----------
panel_20 = Panel(if_connection)

# ----
scale = Scale(Geometry=mesh_2, Center=Point(0, 0, 0), Factor="1e-3")  # -> Geometry, Transform
mesh_3 = Mesh(scale.Geometry)
rotate_3d = Rotate3D(Geometry=mesh_3, Angle=degrees("-90"), Center=Point(0, 0, 0), Axis=Vector(0, 0, 1))  # -> Geometry, Transform

# ---- group: gripper mesh (meter)
mesh_4 = Mesh(rotate_3d.Geometry)

# ---- group: move gripper and bar to a better place for viz
orient_7 = Orient(Geometry=flatten(mesh_4), Source=xy_plane_4, Target=plane_9)  # -> Geometry, Transform

# ---- group: jaw geometry
list_item_7 = ListItem(
    List=orient_7.Geometry,
    Index=[Slider(28, range=0..54), Slider(29, range=0..54), Slider(8, range=0..54), Slider(41, range=0..54)],
    Wrap=True)

# ----
list_item_8 = ListItem(List=orient_7.Transform, Index=0, Wrap=True)
bounding_box = BoundingBox(Content=list_item_7, Plane=plane_9, UnionBox=True)  # -> Box, Box_2
deconstruct_brep = DeconstructBrep(Brep=bounding_box.Box)  # -> Faces, Edges, Vertices
deconstruct_box_length = DeconstructBoxLength(box=bounding_box.Box)  # -> x_length_width, y_length_length, z_length_height
list_item_9 = ListItem(List=deconstruct_brep.Edges, Index="7", Wrap=True)
concatenate_3 = Concatenate(FragmentA=deconstruct_box_length.x_length_width, FragmentB=" (meter)")

# ---- group: jaw bounding box
box = Box(bounding_box.Box)

# ----
deconstruct_brep_2 = DeconstructBrep(Brep=box)  # -> Faces, Edges, Vertices
label_font_size = Slider(0.02, range=0.001..0.1)
list_item_10 = ListItem(List=deconstruct_brep_2.Faces, Index=0, Wrap=True)  # -> Item, Item1, Item2
vector = Vector("0,-1,0")
vector_2 = Vector("0,1,0")
unit_y = UnitY(Factor=Slider(0.21, range=0..0.5))
unit_x = UnitX(Factor=Slider(0.37, range=0..0.5))

# ---- group: total # of bars
integer_5 = Integer(tree_statistics.Count)

# ----
point_5 = Point(construct_point)
negative = Negative(Value=unit_x)
negative_2 = Negative(Value=unit_y)
addition = Addition(A=negative_2, B=unit_x)
move = Move(Geometry=point_5, Motion=addition)  # -> Geometry, Transform
mesh_5 = Mesh(orient_7.Geometry)
construct_plane = ConstructPlane(Origin=move.Geometry, XAxis=unit_y, YAxis=negative)
custom_preview = CustomPreview(Geometry=mesh_5, Material=ColourSwatch(SwatchColor=RGBA(59, 127, 255, 125)))
line_dimension = LineDimension(Line=list_item_9, Text=concatenate_3, Size=label_font_size)

# ----
# bar seq id
panel_21 = Panel("*")

viz_conf_id_2 = Slider(264, range=0..1000)
assembly_seq_2 = Slider(23, range=0..23)

integer_6 = Integer(assembly_seq_2)
concatenate_4 = Concatenate(Fragment_A="{", Fragment_B=integer_6, A=";", C=panel_21, B="}")
construct_path = ConstructPath(Indices=graft(integer_6))  # -> flatten(Branch)

# ---- group: chosen assembly seq id
integer_7 = Integer(assembly_seq_2)

# ----
addition_2 = Addition(A=integer_7, B=1)
split_list = SplitList(List=list_item_3, Index=addition_2)  # -> ListA, ListB
ghpython_script_6 = GhPythonScript(nE=list_length, bar_ids=split_list.ListA, fem_element_from_bar_id=ghpython_script_4.fem_element_from_bar_id)  # -> out, flatten(element_activation); inputs nE: Int32, bar_ids: list of Int32, fem_element_from_bar_id: tree of Int32
# ---------- ghpython_script_6: Python ----------
import rhinoscriptsyntax as rs
import Rhino.Geometry.Plane as Plane
import Rhino.Geometry.Point3d as Point3d
import Rhino.Geometry.Vector3d as Vector3d
import Rhino.Geometry.Quaternion as Quat
import Grasshopper.DataTree as DataTree # Add, AddRange(list, GHPath(i, j))
import Grasshopper.Kernel.Data.GH_Path as GHPath
import System

from ghpythonlib.treehelpers import list_to_tree, tree_to_list

fem_elements_from_bar = tree_to_list(fem_element_from_bar_id, lambda x:x)
#print fem_elements_from_bar
element_activation = [False for i in range(nE)]
for b in bar_ids:
    for e in fem_elements_from_bar[b]:
        element_activation[e] = True
# ---------- end ghpython_script_6 ----------
element_activation_karamba3d = ElementActivationKaramba3D(Model=python_karamba_model_converter.Model_out, IsActive=ghpython_script_6.element_activation)
analyze_karamba3d = AnalyzeKaramba3D(Model=element_activation_karamba3d)  # -> CalculatedModel, MaximumDisplacement_cm, ResultingForceOfGravity_kN, ElasticEnergy_kNm
list_item_11 = ListItem(List=panel_8, Index=integer_7, Wrap=True)
eigen_modes_karamba3d = EigenModesKaramba3D(
    Model=analyze_karamba3d.CalculatedModel,
    FromIndex=Slider(1, range=1..50),
    NumberOfModes=1,
    MaximumNumberOfIterations=300,
    Epsilon=1e-07)  # -> ModelWithEigenModesAsLoadCaseResults, Eigenvalues; disabled
multiplication = Multiplication(A=analyze_karamba3d.MaximumDisplacement_cm, B=0.01)
karamba_max_deform = Panel(multiplication)
conmech_max_deform = Panel(list_item_11)
panel_22 = Panel(eigen_modes_karamba3d.Eigenvalues)  # disabled
model_view_karamba3d = ModelViewKaramba3D(Model=element_activation_karamba3d, ResultFactors=1, ResultCase=-1)  # -> Model, DeformedMesh, DeformedAxes, DeformedModel
concatenate_5 = Concatenate(A="{", Fragment_A=assembly_seq_2, Fragment_B=";", B="*", C=";", D="*", E="}")
split_tree_6 = SplitTree(Data=concatenate_2, Masks=flatten(concatenate_5))  # -> Positive, Negative
split_tree_7 = SplitTree(Data=plane_5, Masks=flatten(concatenate_5))  # -> Positive, Negative
panel_23 = Panel(split_tree_6.Positive)

# ----
# Current built bar in goal pose
addition_3 = Addition(A=integer_6, B=1)
split_list_2 = SplitList(List=flatten(integer_3), Index=addition_3)  # -> simplify(graft(ListA)), ListB
construct_path_2 = ConstructPath(Indices=split_list_2.ListA)  # -> flatten(Branch)
brep = Brep(simplify(pipe))
split_tree_8 = SplitTree(Data=brep, Masks=flatten(construct_path_2))  # -> Positive, Negative
brep_2 = Brep(split_tree_8.Positive)
custom_preview_2 = CustomPreview(Geometry=brep_2, Material=ColourSwatch(SwatchColor=RGBA(0, 213, 255, 61)))

cluster_4 = Cluster_2(plane=split_tree_7.Positive)  # -> list_a, result_2, number_3, result
integer_8 = Integer(assembly_seq_2)

# ----
# bar object frames
construct_path_3 = ConstructPath(Indices=integer_8)
split_tree_9 = SplitTree(Data=orient_3.Geometry, Masks=flatten(construct_path_3))  # -> Positive, Negative
tree_branch = TreeBranch(Tree=number, Path=construct_path_3, MaintainPaths=True)
tree_branch_2 = TreeBranch(Tree=orient_6.Geometry, Path=construct_path_3, MaintainPaths=True)
number_7 = Number(tree_branch)
cluster_5 = Cluster_2(plane=split_tree_9.Positive)  # -> list_a, result_2, number_3, result
pipe_2 = Pipe(Curve=tree_branch_2, Radius=number_7, Caps=0)
custom_preview_3 = CustomPreview(Geometry=tree_branch_2, Material=ColourSwatch(SwatchColor=RGBA(33, 2, 255, 0)))
vector_display_ex = VectorDisplayEx(Point=cluster_5.list_a, Vector=cluster_5.result_2, Colour=cluster_5.result, Width=cluster_5.number_3)

vector_display_ex_2 = VectorDisplayEx(Point=cluster_4.list_a, Vector=cluster_4.result_2, Colour=cluster_4.result, Width=cluster_4.number_3)
split_tree_10 = SplitTree(Data=merge, Masks=flatten(concatenate_5))  # -> Positive, Negative
shift_paths_7 = ShiftPaths(Data=split_tree_10.Positive, Offset=-1)
tree_statistics_2 = TreeStatistics(Tree=shift_paths_7)  # -> Paths, Length, Count
division = Division(A=tree_statistics_2.Length, B=integer_4)
list_item_12 = ListItem(List=division, Index=0, Wrap=True)  # -> Item, Item1

# ---- group: take out one configuration for viz
tree_statistics_3 = TreeStatistics(Tree=split_tree_10.Positive)  # -> Paths, Length, Count
integer_9 = Integer(viz_conf_id_2)
list_item_13 = ListItem(List=tree_statistics_3.Paths, Index=integer_9, Wrap=False)
tree_branch_3 = TreeBranch(Tree=split_tree_10.Positive, Path=list_item_13, MaintainPaths=True)

# ----
total_traj_length_for_current_bar = Panel(tree_statistics_3.Count)

addition_4 = Addition(A=list_item_12.Item, B=list_item_12.Item1)

brep_3 = Brep(flatten(pipe_2))
integer_10 = Integer(viz_conf_id_2)
list_item_14 = ListItem(List=brep_3, Index=0, Wrap=False)
custom_preview_4 = CustomPreview(Geometry=list_item_14, Material=ColourSwatch(SwatchColor=RGB(74, 142, 255)))

conf_in_transfer_place_approach = Panel(addition_4)
larger_than = LargerThan(FirstNumber=integer_9, SecondNumber=addition_4)  # -> LargerThan, OrEqualTo

# ---- group: Current bar in grasped pose (flange_from_bar)
# bar sequence
tree_branch_4 = TreeBranch(Tree=integer_3, Path=construct_path, MaintainPaths=True)
construct_path_4 = ConstructPath(Indices=tree_branch_4)
split_tree_11 = SplitTree(Data=curve, Masks=flatten(construct_path_4))  # -> Positive, Negative
split_tree_12 = SplitTree(Data=number_6, Masks=flatten(construct_path))  # -> Positive, Negative
curve_2 = Curve(split_tree_11.Positive)
pipe_3 = Pipe(Curve=curve_2, Radius=split_tree_12.Positive, Caps=0)

# ---- group: meter, radians
# Configuration
list_item_15 = ListItem(List=tree_branch_3, Index=0, Wrap=True)  # -> Item, Item1, Item2, Item3, Item4, Item5, Item6
forward_kinematics_2 = PythonScript(
    robot=robot,
    x=list_item_15.Item,
    a1=list_item_15.Item1,
    a2=list_item_15.Item2,
    a3=list_item_15.Item3,
    a4=list_item_15.Item4,
    a5=list_item_15.Item5,
    a6=list_item_15.Item6)  # -> configuration
# ---------- forward_kinematics_2: Python ----------
import math
from compas_fab.robots import Configuration

if robot and x:
    joint_values = [a1, a2, a3, a4, a5, a6]
    joint_names = robot.get_configurable_joint_names()
    configuration = Configuration.from_prismatic_and_revolute_values([x], 
        [a for a in joint_values])
else:
    configuration = None
# ---------- end forward_kinematics_2 ----------

# ---- group: trajectory for one bar's assembly
number_8 = Number(split_tree_10.Positive)

# ----
null_item = NullItem(Item=forward_kinematics_2)  # -> NullFlags, InvalidFlags, Description
panel_24 = Panel(number_8)
stream_filter = StreamFilter(Gate=null_item.NullFlags, Stream0=forward_kinematics_2, Stream1=forward_kinematics.configuration)
configurations_at_pickup = Data(stream_filter)

# ----
# Visualisation
# floor mount
brep_4 = Brep(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)
show_end_effector_frame = BooleanToggle(False)
show_base_frame = BooleanToggle(False)
show_collision = BooleanToggle(False)
show_frames = BooleanToggle(True)
show_visual = BooleanToggle(True)
visualize = PythonScript(
    robot=robot,
    group="manipulator_gripper",
    configuration=configurations_at_pickup,
    show_visual=show_visual,
    show_collision=show_collision,
    show_frames=show_frames,
    show_base_frame=show_base_frame,
    show_end_effector_frame=show_end_effector_frame)  # -> out, visual, collision, frames, ee_frame, base_frame
# ---------- visualize: Python ----------
"""Visualizes a robot.
    Inputs:
        robot: The robot
        configuration: :class:`compas_fab.robots.Configuration`
            The robot's full configuration to display.
        show_visual: bool
           Whether or not to show the robot's visual meshes.
        show_collision: bool
           Whether or not to show the robot's collision meshes.
        show_frames: bool
           Whether or not to show the robot's joint frames.
        show_base_frame: bool
           Whether or not to show the robot's base frame.
        show_end_effector_frame: bool
            Whether or not to show the robot's end-effector frame.
    Output:
        visual: The robot's visual meshes.
        collision: The robot's collision meshes.
        frames: The robot's joint frames.
        base_frame: The robot's base frame.
        ee_frame: The robot's end-effector frame.
"""
from __future__ import print_function

if robot and configuration:
    group = group or None
    robot.update(configuration, group, visual=show_visual, collision=show_collision)
    print(robot.get_end_effector_link_name(group))
    
    if show_visual:
        visual = robot.artist.draw_visual()

    if show_collision:
        collision = robot.artist.draw_collision()

    if show_frames:
        axes = robot.transformed_axes(configuration, group)
        frames = robot.transformed_frames(configuration, group)

    if show_base_frame:
        frames = robot.transformed_frames(configuration, group)
        base_frame = frames[0]

    if show_end_effector_frame:
        ee_frame = robot.forward_kinematics(configuration, group)
        print("End-effector", ee_frame)
# ---------- end visualize ----------
draw = GhPythonScript(frames=[visualize.frames, visualize.ee_frame, visualize.base_frame], scale=Slider(0.1, range=0..1))  # -> P, V, C, W, flatten(planes); inputs frames: list
# ---------- draw: Python ----------
from System.Drawing import Color
from compas_ghpython import draw_frame

red = Color.FromArgb(255, 0, 0)
green = Color.FromArgb(0, 255, 0)
blue = Color.FromArgb(0, 0, 255)

P = []
V = []
C = []
planes = []

scale = float(scale)

for frame in frames:
    if not frame:
        continue
    plane = draw_frame(frame)
    P += [plane.Origin] * 3
    V.append(plane.XAxis * scale)
    V.append(plane.YAxis * scale)
    V.append(plane.ZAxis * scale)
    C += [red, green, blue]
    planes.append(plane)

W = 3
# ---------- end draw ----------
geometry_2 = Geometry(visualize.collision)
geometry_3 = Geometry(visualize.visual)
vector_display_ex_3 = VectorDisplayEx(Point=draw.P, Vector=draw.V, Colour=draw.C, Width=draw.W)

# ---- group: eef_frame
list_item_16 = ListItem(List=visualize.frames, Index=Slider(14, range=0..43), Wrap=False)
ghpython_script_7 = GhPythonScript(x=list_item_16)  # -> out, a
# ---------- ghpython_script_7: Python ----------
from compas_ghpython import draw_frame

a = draw_frame(x)
# ---------- end ghpython_script_7 ----------

# ---- group: eef_base_frame (flange)
list_item_17 = ListItem(List=visualize.frames, Index=Slider(13, range=0..43), Wrap=False)
ghpython_script_8 = GhPythonScript(x=list_item_17)  # -> out, a; same code as ghpython_script_7

# ----
plane_10 = Plane(ghpython_script_8.a)
brep_5 = Brep(pipe_3)
stream_filter_2 = StreamFilter(Gate=larger_than.OrEqualTo, Stream0=brep_5)
plane_11 = Plane(ghpython_script_7.a)

# ---- group: ABB Communication
send_joints_list = Button()
open_gripper = Button()
close_gripper = Button()
send_joints = Button()
list_3 = ValueList({"Fast": 1, "Mid": 2, "Slow": 3}, selected="Mid")
python = PythonScript(
    joints_sequence=number_8,
    sequence_num=Slider(0, range=0..10),
    move_num=Slider(0, range=-2..10),
    joints_num=Slider(0, range=-2..10),
    send_joints=send_joints,
    send_joints_list=send_joints_list,
    send_joints_sequence=send_joints_sequence,
    open_gripper=open_gripper,
    close_gripper=close_gripper,
    rob_num=Slider(1, range=1..2),
    rob_speed=list_3)  # -> out, joints_abb_send, move_len, joints_sequence_tree, simplify(joints_abb_sequence_tree); inputs joints_sequence: tree, sequence_num: Int32, move_num: Int32, joints_num: Int32
# ---------- python: Python ----------
from abb_communication.clients.rfl_robot.communication.messages.messagetypes import *

import Rhino.Geometry as rg
from ghpythonlib.treehelpers import list_to_tree, tree_to_list

from abb_communication.geometry import Frame
from scriptcontext import sticky as st
import math
import time
from threading import Thread

robot = st["rfl_robot"]
robot_speed = float(rob_speed)

if robot:    
    robot.comm.float_arbitrary = int(rob_num)
    print("robot found")
    
    
    if rob_speed == 1:
        print "robot speed: fast"
        robot_speed = 250
        robot.comm.send_set_speed(robot_speed, 15)
    if rob_speed == 2:
        print "robot speed: mid"
        robot_speed = 150
        robot.comm.send_set_speed(robot_speed, 5)
    if rob_speed == 3:
        print "robot speed: slow"
        robot_speed = 25
        robot.comm.send_set_speed(robot_speed)
    
    
    if robot.comm.running:
        print "ROBOT IS ONLINE"
        
#        joints_print = robot.comm.get_current_pose_joint()
#        print "current joints:", joints_print
#        joints_deg = [math.degrees(j) for j in joints_print]
#        joints_deg = [round(x, 2) for x in joints_deg]
#        print "current pose:", joints_deg
        
    else:
        print "ROBOT IS OFFLINE"
        
        
#==================================================================
    
    
#if send_joints_single:
#    robot.comm.send_stop()
#    if len(joints_abb) < 9:
#        joints_abb.extend([0,0])
#    joints_abb = [float(x) for x in joints_abb]
#    print(joints_abb)
#    robot.comm.send_axes_absolute(joints_abb, int_arr = None)
    
    
#get data tree into list of lists of floats
#joints_abb_list = tree_to_list(joints_abb_list, 0)
#joints_abb_list_2 = []
#for joints_abb in joints_abb_list:
#    joints_abb = [float(item) for item in joints_abb]
#    joints_abb_list_2.append(joints_abb)
    

    
    
    
#==================================================================


##clean sequence tree
#joints_sequence = tree_to_list(joints_sequence, 0)
#joints_abb_sequence = []
#
#for sequence in joints_sequence:
#    move_new = []
#    for move in sequence:
#        joints_new = []
#        for joints in move:
##            print(joints)
#            joints.append(joints.pop(0))
#            joints.extend([0,0])
#            joints = [float(item) for item in joints]
#            joints[:6] = [math.degrees(item) for item in joints[:6]]
#            joints[6] = joints[6] * 1000
##            print(joints)
#            joints_new.append(joints)
#        move_new.append(joints_new)
#    joints_abb_sequence.append(move_new)


#control which sequence (#1-x) >> move (#1-4)>> joints (#1-x)
#joints_abb_list_send = joints_abb_sequence[sequence_num][move_num] #send a move 
#joints_abb_send = joints_abb_sequence[sequence_num][move_num][joints_num] #send a joint
#move_len = len(joints_abb_list_send) #check num joints in move

#print("joints_abb_list_send type:", type(joints_abb_list_send))
#print("joints_abb_list_send length:", len(joints_abb_list_send))
##print("joints_abb_list_send:", joints_abb_list_send)
#print("joints_abb_send:", joints_abb_send)

#==================================================================

#if send_joints:
#    robot.comm.send_stop()
#    robot.comm.send_axes_absolute(joints_abb_send, int_arr = None)


##TEST: send list of joints individually in loop
#if send_joints_list_loop:
#    robot.comm.send_set_speed(300, 2)
#    robot.comm.send_stop()
#    for joints in joints_abb_list_send:
#        robot.comm.send_axes_absolute(joints, int_arr = None)
#        
#    robot.comm.send_open_gripper()
#    robot.comm.send_close_gripper()


#if send_joints_list:
#    robot.comm.send_stop()
#    robot.comm.send_close_gripper() #opens gripper jaws
#    robot.comm.send_stop()
#    robot.comm.send_open_gripper() #closes gripper jaws
#    robot.comm.send_stop()
#    
#    robot.comm.send_axes_absolute_list(joints_abb_sequence[sequence_num][0], int_arr = None)
#    time.sleep(1)
#    robot.comm.send_axes_absolute_list(joints_abb_sequence[sequence_num][1], int_arr = None)
#    time.sleep(1)
#    
#    robot.comm.send_stop()
#    robot.comm.send_close_gripper() #opens gripper jaws
#    robot.comm.send_stop()
#    
#    robot.comm.send_axes_absolute_list(joints_abb_sequence[sequence_num][2], int_arr = None)
#    time.sleep(1)
#    robot.comm.send_axes_absolute_list(joints_abb_sequence[sequence_num][3], int_arr = None)
#    time.sleep(1)
#    robot.comm.send_open_gripper() #closes gripper jaws

#==================================================================

#201219_conversion to abb format/units from yijiang, applied per single sequence
PROCESS_NAME_FROM_ID = {
    0 : 'transit', 1 : 'place_approach', 2 : 'place_retreat', 3 : 'transfer',
}

def convert_to_ECL_conf(joints):
    joints.append(joints.pop(0))
    joints.extend([0,0])
    # convert joint to degrees
    joints[:6] = [math.degrees(item) for item in joints[:6]]
    # conver to meters
    joints[6] = joints[6] * 1000
    return joints

transfer = []
place_approach = []
place_retreat = []
transit = []
for ghpath in joints_sequence.Paths:
    seq_id, process_id, conf_id = list(ghpath.Indices)
    # I convert the configuration to your format here!
    conf = convert_to_ECL_conf(list(joints_sequence.Branch(ghpath)))
#    print conf
    if process_id == 0:
        transfer.append(conf)
    elif process_id == 1:
        place_approach.append(conf)
    elif process_id == 2:
        place_retreat.append(conf)
    elif process_id == 3:
        transit.append(conf)
place_approach_reverse = place_approach[::-1]

if send_joints_sequence:
#    robot.comm.set_speed_mid()
#    robot.comm.send_set_speed(robot_speed)
    robot.comm.send_stop()
    robot.comm.send_close_gripper() #opens gripper jaws
    robot.comm.send_stop()
    robot.comm.send_open_gripper() #closes gripper jaws
    robot.comm.send_stop()
    
    robot.comm.send_axes_absolute_list(transfer, int_arr = None)
    time.sleep(1)
    robot.comm.send_axes_absolute_list(place_approach, int_arr = None)
    robot.comm.send_stop()
    
    robot.comm.send_axes_absolute_list(place_approach_reverse, int_arr = None)
    robot.comm.send_stop()
    robot.comm.send_axes_absolute_list(place_approach, int_arr = None)
    robot.comm.send_stop()

    robot.comm.send_close_gripper() #opens gripper jaws
    robot.comm.send_stop()
    
    robot.comm.send_axes_absolute_list(place_retreat, int_arr = None)
    time.sleep(1)
    robot.comm.send_axes_absolute_list(transit, int_arr = None)
    time.sleep(1)
    robot.comm.send_open_gripper() #closes gripper jaws
        
        
if open_gripper:
    robot.comm.send_close_gripper()
    
if close_gripper:
    robot.comm.send_open_gripper()
    
#==================================================================
# ---------- end python ----------

# ----
orient_8 = Orient(Geometry=stream_filter_2, Source=PlaneXY(0, 0, 0), Target=ghpython_script_8.a)  # -> Geometry, Transform
cluster_6 = Cluster_2(plane=plane_11)  # -> list_a, result_2, number_3, result
curve_3 = Curve(curve_2)
transform = Transform(Geometry=pipe_3, Transform=list_item_8)
transform_2 = Transform(Geometry=curve_3, Transform=list_item_8)
vector_display_ex_4 = VectorDisplayEx(Point=cluster_6.list_a, Vector=cluster_6.result_2, Colour=cluster_6.result, Width=cluster_6.number_3)
custom_preview_5 = CustomPreview(Geometry=orient_8.Geometry, Material=ColourSwatch(SwatchColor=RGBA(243, 119, 255, 80)))
end_points = EndPoints(Curve=transform_2)  # -> Start, End
merge_2 = Merge(Data1=end_points.Start, Data2=end_points.End)
deconstruct = Deconstruct(Point=merge_2)  # -> XComponent, YComponent, ZComponent
point_6 = Point(merge_2)
sort_list = SortList(Keys=deconstruct.YComponent, ValuesValuesA=point_6)  # -> Keys, ValuesValuesA
list_item_18 = ListItem(List=sort_list.ValuesValuesA, Index=0, Wrap=True)  # -> Item, Item1
brep_closest_point = BrepClosestPoint(Point=list_item_18.Item, Brep=list_item_10.Item)  # -> Point, unitize(Normal), Distance
brep_closest_point_2 = BrepClosestPoint(Point=list_item_18.Item1, Brep=list_item_10.Item2)  # -> Point, unitize(Normal), Distance
multiplication_2 = Multiplication(A=brep_closest_point.Normal, B=vector)
multiplication_3 = Multiplication(A=brep_closest_point_2.Normal, B=vector_2)
line_2 = Line(StartPoint=list_item_18.Item, EndPoint=brep_closest_point.Point)
line_3 = Line(StartPoint=list_item_18.Item1, EndPoint=brep_closest_point_2.Point)
multiplication_4 = Multiplication(A=brep_closest_point_2.Normal, B=multiplication_3)
multiplication_5 = Multiplication(A=brep_closest_point.Distance, B=multiplication_2)
integer_11 = Integer(assembly_seq_2)
deconstruct_vector = DeconstructVector(Vector=multiplication_4)  # -> XComponent, YComponent, ZComponent
brep_6 = Brep(transform)
format = Format(Format="{0:0.0000}", Culture=127, Data0=multiplication_5)
format_2 = Format(Format="{0:0.0000}", Culture=127, Data0=deconstruct_vector.YComponent)
concatenate_6 = Concatenate(
    E="Seq #",
    F=integer_11,
    G="/ total ",
    H=integer_5,
    Fragment_A="Left jaw length (m):  ",
    Fragment_B=format,
    B="Right jaw length (m):  ",
    C=format_2)
custom_preview_6 = CustomPreview(Geometry=brep_6, Material=ColourSwatch(SwatchColor=RGBA(255, 59, 255, 40)))
line_dimension_2 = LineDimension(Line=line_2, Text=format, Size=label_font_size)
line_dimension_3 = LineDimension(Line=line_3, Text=format_2, Size=label_font_size)
text_tag_3d = TextTag3D(
    Location=construct_plane,
    Text=concatenate_6,
    Size=Slider(0.1, range=0..0.1),
    Colour=ColourSwatch(SwatchColor=RGB(0, 0, 0)),
    Justification=7)

# ==== cluster Tool
brep = Brep([<brep referenced from the Rhino model> x7])
mesh = Mesh([<mesh referenced from the Rhino model> x9])
mesh_brep = MeshBrep(
    Brep=brep,
    Settings={GridMaxCount=0, GridMinCount=16, JaggedSeams=False, MaxEdgeLength=0, MinEdgeLength=0.0001, MinTolerance=0, Refine=True, RefineAngle=0, RelativeTolerance=0.65, SimplePlanes=True, Tolerance=0})
merge = Merge(Data1=mesh_brep, Data2=mesh)
mesh_2 = Mesh(merge)
scale = Scale(Geometry=mesh_2, Center=Point(0, 0, 0), Factor="1e3")  # -> Geometry, Transform
init = ClusterInput()
pln = Plane(Plane(origin=(0.0867109651, 1.472961418, 319.9745917), x=(-0.99999089, -0.004254372967, 0.0003466928643), y=(0.004257543076, -0.9999436638, 0.009723299055)))
plane = Plane(PlaneXY(0, 0, 0))
int = ClusterInput()
int_2 = Integer(int)

set_tool = PythonScript(init=init, tool_geo=scale.Geometry, tool_plane=plane)  # -> out, tool, tool_plane, tool_geo, tool_axes, tool_axes_colors; inputs tool_geo: list of Mesh, tool_plane: Plane
# ---------- set_tool: Python ----------
import Rhino.Geometry as rg
import ghpythonlib.components as ghcomp
import math as m


from abb_communication.clients.rfl_robot import MeshMouldTool
from abb_communication.clients.rfl_robot.tool import LwsGripperTool
#from abb_communication.clients.rfl_robot import Tool
from abb_communication.geometry import Frame


tool = LwsGripperTool(tool_geo, tool_plane)

tool_plane = tool.get_plane()
tool_axes, tool_axes_colors = tool.get_frame_axes_as_lines()
# ---------- end set_tool ----------
pln_2 = Plane(set_tool.tool_plane)
preview = CustomPreview(Geometry=set_tool.tool_axes, Shader=set_tool.tool_axes_colors)
geo = Geometry(set_tool.tool_geo)
preview_2 = CustomPreview(Geometry=geo, Shader=ColourSwatch(SwatchColor=RGBA(100, 168, 178, 162)))

select_tool = StreamFilter(Gate=int_2, Stream0=set_tool.tool)
tool = Data(select_tool)
tool_2 = ClusterOutput(tool)

# ==== cluster DeconstructBoxLength
box = ClusterInput()
deconstruct_box = DeconstructBox(Box=box)  # -> Plane, X, Y, Z
deconstruct_domain = DeconstructDomain(Domain=deconstruct_box.X)  # -> Start, End
deconstruct_domain_2 = DeconstructDomain(Domain=deconstruct_box.Y)  # -> Start, End
deconstruct_domain_3 = DeconstructDomain(Domain=deconstruct_box.Z)  # -> Start, End
subtraction = Subtraction(A=deconstruct_domain_2.End, B=deconstruct_domain_2.Start)
subtraction_2 = Subtraction(A=deconstruct_domain.End, B=deconstruct_domain.Start)
subtraction_3 = Subtraction(A=deconstruct_domain_3.End, B=deconstruct_domain_3.Start)
y_length_length = ClusterOutput(subtraction)  # Y length (length)
x_length_width = ClusterOutput(subtraction_2)  # X length (width)
z_length_height = ClusterOutput(subtraction_3)  # Z length (height)

# ==== cluster Cluster
data = ClusterInput()
integer = ClusterInput()

# ---- group: Map seq_id to beam_id / bar sequence
integer_2 = Integer(flatten(integer))

# ---- group: Map seq_id to beam_id
tree_statistics = TreeStatistics(Tree=data)  # -> Paths, Length, Count
replace_paths = ReplacePaths(Data=data, Search=tree_statistics.Paths, Replace=integer_2)

# ----
data_2 = ClusterOutput(replace_paths)

# ==== cluster Cluster_2
plane = ClusterInput()
plane_2 = Plane(simplify(graft(plane)))
deconstruct_plane = DeconstructPlane(Plane=plane_2)  # -> Origin, XAxis, YAxis, ZAxis
merge = Merge(
    Data1=ColourSwatch(SwatchColor=RGB(255, 0, 0)),
    Data2=ColourSwatch(SwatchColor=RGB(0, 255, 0)),
    Data3=ColourSwatch(SwatchColor=RGB(0, 0, 255)))
number = Number(Slider(1, range=0..1))
number_2 = Number(Slider(0.1, range=0.1..1))
multiplication = Multiplication(A=[deconstruct_plane.XAxis, deconstruct_plane.YAxis, deconstruct_plane.ZAxis], B=number_2)
result = ClusterOutput(merge)
number_3 = ClusterOutput(number)
longest_list = LongestList(ListListA=deconstruct_plane.Origin, ListListB=multiplication, PaddingMode=2)  # -> ListListA, ListListB
result_2 = ClusterOutput(multiplication)
list_a = ClusterOutput(longest_list.ListListA)

# ==== cluster ABB_4600
base = Mesh([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])
l1 = Mesh(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)
l3 = Mesh(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)
l4 = Mesh(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)
l5 = Mesh(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)
l6 = Mesh(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)
l2 = Mesh(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)
mesh = Mesh([l1, l2, l3, l4, l5, l6])
ip_abb = ClusterInput()
init = ClusterInput()
plane = Plane([PlaneXY(-1.185867404e-09, 0, 0), Plane(origin=(175, 0, 495), x=(0, 0, 1), y=(1, 0, 0)), Plane(origin=(175, 0, 1590), x=(0, 0, 1), y=(1, 0, 0)), Plane(origin=(175, 0, 1765), x=(0, 0, -1), y=(0, 1, 0)), Plane(origin=(1446, 0, 1765), x=(0, 0, 1), y=(1, 0, 0)), Plane(origin=(1581, 0, 1765), x=(-1.94917184e-05, 1.016258774e-11, -0.9999999998), y=(-2.075117433e-05, 0.9999999998, 4.146386344e-10))])
if = PythonScript(init=init, ip_abb=ip_abb, joint_planes=plane, base_geo=base, link_geo=mesh)  # -> robot; inputs joint_planes: list of Plane, base_geo: list of Mesh, link_geo: list of Mesh
# ---------- if: Python ----------
from abb_communication.clients import Robot

robot = Robot(link_geo, base_geo, joint_planes, ip_abb = ip_abb)
# ---------- end if ----------
robot = ClusterOutput(if)

# ==== cluster Cluster_3
integer = ClusterInput()
data = ClusterInput()

# ---- group: Map bar id to seq id / bar sequence
integer_2 = Integer(flatten(integer))

# ---- group: Map bar id to seq id
data_2 = Data(data)
tree_statistics = TreeStatistics(Tree=data_2)  # -> Paths, Length, Count
deconstruct_path = DeconstructPath(Branch=graft(tree_statistics.Paths))  # -> flatten(Indices)
ghpython_script = GhPythonScript(x=deconstruct_path, y=integer_2)  # -> out, a; inputs x: list of Int32, y: list of Int32
# ---------- ghpython_script: Python ----------
a = [y.index(t) for t in x]
# ---------- end ghpython_script ----------
replace_paths = ReplacePaths(Data=data_2, Search=tree_statistics.Paths, Replace=ghpython_script.a)

# ----
data_3 = ClusterOutput(replace_paths)
