# Grasshopper definition plan_to_abb_track_YJ_V7.ghx (Grasshopper 1.0.7)
# plug-ins: karambaGH

panel = Panel("IA_Arch_subset_4_tets_regression-z_solution_20-12-19_20-19-02.json")
panel_2 = Panel("IT_Arch_regression-z_solution_20-12-20_20-31-13.json")
panel_3 = Panel("IA_Arch_subset_4_tets_regression-z_solution_20-12-21_13-34-18.json")
panel_4 = Panel("1_exp_tets_regression-z_solution_20-12-21_18-16-58.json")

# ---- group: built!
panel_5 = Panel("SP_arch_regression-z_solution_20-12-22_12-15-34_replan_rPlace1_rTrans1.json")

# ----
panel_6 = Panel("1_exp_tets_regression-plan-stiffness_solution_20-12-26_20-36-36.json")
panel_7 = Panel("IT_Arch_regression-z_solution_20-12-21_12-33-57.json")
panel_8 = Panel("SP_arch_less_supp_regression-plan-stiffness_solution_20-12-26_20-22-58.json")
panel_9 = Panel("1_exp_tets_regression-z_solution_20-12-21_12-54-17.json")
panel_10 = Panel("SP_arch_regression-plan-stiffness_solution_20-12-26_20-46-25.json")
panel_11 = Panel("SP_arch_regression-z_solution_20-12-22_12-15-34.json")

panel_12 = Panel("1_exp_tets_regression-z__solution_20-12-19_11-29-23.json")
rhino_doc_dir = RhinoDocDir()  # -> rhino_doc_dir
# ---------- rhino_doc_dir: Python ----------
import scriptcontext as sc
from os import path

rhino_doc_dir = path.abspath(path.dirname(sc.doc.Path))
# ---------- end rhino_doc_dir ----------
text = Text(rhino_doc_dir)
concatenate = Concatenate(FragmentA="d:\code_ws\pb_ws\coop_assembly\tests\results\", FragmentB=panel_5)
ghpython_script = GhPythonScript(x=text, y=panel_5)  # -> out, a
# ---------- ghpython_script: Python ----------
import os

a = os.path.abspath(os.path.join(x, '..', '..', 'tests', 'results', y))
# ---------- end ghpython_script ----------

# ---- group: end effector definition from flange
robot_dof = Panel("7")
point = Point("0,0,0.3705")

# ----
panel_13 = Panel(ghpython_script.a)
panel_15 = Panel("eef_base_link")

# ---- group: transit, place approach
panel_16 = Panel("{*;0}")
panel_17 = Panel("{*;1}")

# ----
panel_18 = Panel("""{*;2}
{*;3}""")
ghpython_script_2 = GhPythonScript(result_file_path=ghpython_script.a, ee_link_name="eef_tcp_frame", scale="1")  # -> out, paths, ee_paths, elements, tags, grasps, axispts_from_index, radius, goal_poses
# ---------- ghpython_script_2: Python ----------
import rhinoscriptsyntax as rs
import Rhino.Geometry.Plane as Plane
import Rhino.Geometry.Point3d as Point3d
import Rhino.Geometry.Vector3d as Vector3d
import Rhino.Geometry.Quaternion as Quat
import Rhino.Geometry.Line as Line
import Rhino.Geometry.Transform as Transform
import Grasshopper.DataTree as DataTree # Add, AddRange(list, GHPath(i, j))
import Grasshopper.Kernel.Data.GH_Path as GHPath
import System

from ghpythonlib.treehelpers import list_to_tree, tree_to_list

import json
from compas.geometry import Frame
from compas.geometry import scale_points
from compas_ghpython import draw_pipes, draw_frame
from itertools import islice

######################################

def pose_from_frame(frame, scale=1.0):
    """Returns a PyBullet pose from a frame.
    Parameters
    ----------
    frame : :class:`compas.geometry.Frame`
    Returns
    -------
    point, quaternion : tuple
    """
    return ([v*scale for v in frame.point], frame.quaternion.xyzw)


def frame_from_pose(pose, scale=1.0):
    """Returns a frame from a PyBullet pose.
    Parameters
    ----------
    point, quaternion : tuple
    Returns
    -------
    :class:`compas.geometry.Frame`
    """
    point, (x, y, z, w) = pose
    return Frame.from_quaternion([w, x, y, z], point=[v*scale for v in point])

#########################################

with open(result_file_path) as json_file:
    data = json.load(json_file)

print('file_name: {}'.format(data['problem']))
try:
    print('write_time: {}'.format(data['write_time']))
    print('parameters: {}'.format(data['parameters']))
except:
    pass

sp_id_from_process_tag = {
    'transfer' : 0,
    'place_approach' : 1,
    'place_retreat' : 2,
    'transit' : 3,
}

# parse trajectories and EE paths (indexed by sequence index)
paths = DataTree[System.Double]()
ee_paths = DataTree[Plane]()
elements = DataTree[System.Int32]()
tags = DataTree[System.String]()
grasps = DataTree[Plane]()
for seq_id, e_trajs in enumerate(data['plan']):
    if seq_id == 0 and 'transit' == e_trajs[0]['tag']:
        del e_trajs[0]
    for traj in e_trajs:
        sp_id = sp_id_from_process_tag[traj['tag']]
        path = traj['path']
        epath = traj['link_path'][ee_link_name]
        for t_id, (conf, epose) in enumerate(zip(path, epath)):
            conf = [float(v) for v in conf]
            paths.AddRange(conf, GHPath(seq_id, sp_id, t_id))
            ee_paths.Add(draw_frame(frame_from_pose(epose, scale)), GHPath(seq_id, sp_id, t_id))
            
        if traj['element'] is not None: 
            elements.Add(traj['element'], GHPath(seq_id, sp_id))
        else:
            elements.Add(-1000, GHPath(seq_id, sp_id))
        tags.Add(traj['tag'], GHPath(seq_id, sp_id))
        
        for attach_data in traj['attachments']:
            g_frame = frame_from_pose(attach_data['grasp_pose'], scale=scale)
            grasps.Add(draw_frame(g_frame), GHPath(seq_id, sp_id))

# reconstruct shape (indexed by bar index)
axispts_from_index = DataTree[Point3d]()
radius = DataTree[System.Double]()
goal_poses = DataTree[Plane]()
for e_id, edata in data['element_from_index'].items():
    radius.Add(edata['radius']*scale, GHPath(int(e_id)))
    
    goal_frame = frame_from_pose(edata['goal_pose']['value'], scale=scale)
    goal_poses.Add(draw_frame(goal_frame), GHPath(int(e_id)))
    
    scaled_pts = scale_points(edata['axis_endpoints'], scale)
    for i in range(2):
        axispts_from_index.Add(Point3d(*scaled_pts[i]), GHPath(int(e_id)))
# ---------- end ghpython_script_2 ----------

# ---- group: ee_path, indexed by seq_id
plane = Plane(ghpython_script_2.ee_paths)

# ----
shift_paths = ShiftPaths(Data=plane, Offset=-1)
rhino_doc_dir_2 = RhinoDocDir()  # -> rhino_doc_dir; same code as rhino_doc_dir
tree_statistics = TreeStatistics(Tree=ghpython_script_2.paths)  # -> Paths, Length, Count
split_tree = SplitTree(Data=shift_paths, Masks=flatten(panel_16))  # -> Positive, Negative
split_tree_2 = SplitTree(Data=shift_paths, Masks=flatten(panel_17))  # -> Positive, Negative
split_tree_3 = SplitTree(Data=shift_paths, Masks=flatten(panel_18))  # -> Positive, Negative
text_2 = Text(ghpython_script.a)
ghpython_script_3 = GhPythonScript(x=rhino_doc_dir_2)  # -> out, a
# ---------- ghpython_script_3: Python ----------
import os

a = os.path.abspath(os.path.join(x,"..","..","external","conmech"))
# ---------- end ghpython_script_3 ----------
panel_19 = Panel(ghpython_script_3.a)
panel_20 = Panel(tree_statistics.Paths)
panel_21 = Panel(ghpython_script_2.out)

# ---- group: bar radius
number = Number(ghpython_script_2.radius)

# ---- group: axis end pts (indexed by bar id)
point_2 = Point(ghpython_script_2.axispts_from_index)

# ---- group: bar goal poses
plane_2 = Plane(ghpython_script_2.goal_poses)

# ---- group: grasp, indexed in seq_id
plane_3 = Plane(ghpython_script_2.grasps)

# ---- group: tool link
point_3 = Point(point)

# ----
panel_22 = Panel("""{*;0}
{*;1}
{*;2}
{*;3}""")
ghpython_script_4 = GhPythonScript(conmech_dir=ghpython_script_3.a, result_file_path=text_2, limit_distance="1e-12")  # -> out, Model_out, fem_element_from_bar_id, deform_history, progression_deform_history, element_sequence, progression_sequence
# ---------- ghpython_script_4: Python ----------
import rhinoscriptsyntax as rs
import Rhino.Geometry.Plane as Plane
import Rhino.Geometry.Point3d as Point3d
import Rhino.Geometry.Vector3d as Vector3d
import Rhino.Geometry.Quaternion as Quat
import Grasshopper.DataTree as DataTree # Add, AddRange(list, GHPath(i, j))
import Grasshopper.Kernel.Data.GH_Path as GHPath
import System
from System.Collections.Generic import List

from ghpythonlib.treehelpers import list_to_tree, tree_to_list
import os
import json
##############################

import clr
# https://ironpython.net/documentation/dotnet/dotnet.html

try:
    clr.AddReferenceToFileAndPath("C:\Program Files\Rhino 6\Plug-ins\Karamba\Karamba.gha")
    clr.AddReferenceToFileAndPath("C:\Program Files\Rhino 6\Plug-ins\Karamba\KarambaCommon.dll")
except:
    clr.AddReferenceToFileAndPath("C:\Program Files\Rhino 6\Plug-ins\Karamba.gha")
    clr.AddReferenceToFileAndPath("C:\Program Files\Rhino 6\Plug-ins\KarambaCommon.dll")

import feb # Karamba's C++ library (undocumented in the API)
import Karamba.Models.Model as Model
import Karamba.GHopper.Models.GH_Model as GH_Model
#
import Karamba
import Karamba.Elements.ModelTruss as Truss
from Karamba.Geometry import Point3, Line3, Vector3
from Karamba.CrossSections import CroSec
from Karamba.Supports import Support
from Karamba.Loads import Load
#
from Karamba.Utilities import MessageLogger, UnitsConversionFactories
import KarambaCommon
#
import System
from System import GC
from System.Collections.Generic import List

#####################################
# add path to conmech script folder
import os, sys 
sys.path.append(os.path.join(conmech_dir, "src", "pyconmech", "frame_analysis"))
#from io_base import Model
import io_base
import karamba_io
reload(io_base)
reload(karamba_io)
from karamba_io import KarambaModel
from io_base import LoadCase, GravityLoad

#####################################

with open(os.path.join(result_file_path), 'r') as f:
    data = json.load(f)
    conmech_data = data['conmech_model']

print('{} | {}'.format(conmech_data["model_name"], conmech_data['generate_time']))
km = KarambaModel.from_data(conmech_data)
#lc = LoadCase.from_data(data['loadcases']['0'])

model = km.to_karamba(LoadCase(gravity_load=GravityLoad([0,0,-1])), limit_dist=limit_distance)

## calculate Th.I response
#logger = MessageLogger();
#k3d = KarambaCommon.Toolkit();
#max_disp = clr.Reference[List[float]]()
#out_g = clr.Reference[List[float]]()
#out_comp = clr.Reference[List[float]]()
#message = clr.Reference[str]()
#model = k3d.Algorithms.AnalyzeThI(model, max_disp, out_g, out_comp, message);
#
#ucf = UnitsConversionFactories.Conv();
#cm = ucf.cm();
#print "max disp: {} {}".format(cm.toUnit(max_disp.Value[0]), cm.unitB)
#
Model_out = Karamba.GHopper.Models.GH_Model(model);
#
#from Karamba.GHopper.CrossSections import GH_CrossSection
#a = List[GH_CrossSection]([GH_CrossSection(cs.to_karamba()) for cs in km.crosssecs])

fem_data = conmech_data['fem_element_from_bar_id']
fem_element_from_bar_id = DataTree[int]()
for i, es in fem_data.items():
    if int(i) >= 0:
        fem_element_from_bar_id.AddRange(es, GHPath(int(i)))

deform_history = [trans[1] for trans in data['stiffness_history']]

if 'progression_stiffness_history' in data:
    progression_deform_history = [trans[1] for trans in data['progression_stiffness_history']]

if 'progression_sequence' in data:
    progression_sequence = [id for id in data['progression_sequence']]

element_sequence = DataTree[System.Int32]()
for seq_id, e_trajs in enumerate(data['plan']):
    if seq_id == 0:
        del e_trajs[0]
    for sp_id, traj in enumerate(e_trajs):
        if traj['element'] is not None: 
            element_sequence.Add(traj['element'], GHPath(seq_id, sp_id))
        else:
            element_sequence.Add(-1000, GHPath(seq_id, sp_id))
# ---------- end ghpython_script_4 ----------
shift_paths_2 = ShiftPaths(Data=ghpython_script_4.element_sequence, Offset=-1)
list_item = ListItem(List=shift_paths_2, Index=0, Wrap=True)  # -> flatten(Item)
ghpython_script_5 = GhPythonScript(x=list_item)  # -> out, a; inputs x: list
# ---------- ghpython_script_5: Python ----------
print x
# ---------- end ghpython_script_5 ----------
panel_23 = Panel(ghpython_script_5.out)
panel_24 = Panel(list_item)
panel_25 = Panel(ghpython_script_4.progression_sequence)
panel_26 = Panel(ghpython_script_4.out)
shift_paths_3 = ShiftPaths(Data=ghpython_script_2.paths, Offset=-1)
list_item_2 = ListItem(List=point_2, Index=0, Wrap=True)  # -> Item, Item1
quick_graph = QuickGraph(ghpython_script_4.deform_history, SortOrder=0)
shift_paths_4 = ShiftPaths(Data=plane_3, Offset=-1)
list_item_3 = ListItem(List=panel_22, Index=0, Wrap=True)  # -> Item, Item1, Item2, Item3
transfer_sample_rate = Slider(3, range=1..10)
integer = Integer(transfer_sample_rate)
partition_list = PartitionList(List=split_tree.Positive, Size=integer)
list_item_4 = ListItem(List=partition_list, Index=0, Wrap=True)
shift_paths_5 = ShiftPaths(Data=list_item_4, Offset=-1)
line = Line(StartPoint=list_item_2.Item, EndPoint=list_item_2.Item1)
python_karamba_model_converter = PythonKarambaModelConverter(
    Model_in=ghpython_script_4.Model_out,
    Reference=["C:\Program Files\Rhino 6\Plug-ins\Karamba\karambaCommon.dll", "C:\Program Files\Rhino 6\Plug-ins\Karamba\karamba.gha"])  # -> out, flatten(Model_out); disabled
# ---------- python_karamba_model_converter: Python usings ----------
using Karamba.Models;
using Karamba.GHopper.Models;
# ---------- python_karamba_model_converter: Python ----------
    var model = Model_in as Model;
    if (model == null) {
      throw new ArgumentException("The input in 'Model_in' is not of type karamba.Models.Model!");
    }

    Model_out = new GH_Model(model);

    Print("Everything OK");
# ---------- end python_karamba_model_converter ----------
disassemble_model_karamba3d = DisassembleModelKaramba3D(Model=python_karamba_model_converter.Model_out)  # -> Model, Point, Beam, Shell, Support, Load, Line, Mesh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
list_length = ListLength(List=disassemble_model_karamba3d.Beam)
transit_sample_rate = Slider(3, range=1..10)
integer_2 = Integer(transit_sample_rate)
partition_list_2 = PartitionList(List=split_tree_3.Positive, Size=integer_2)
list_item_5 = ListItem(List=partition_list_2, Index=0, Wrap=True)
shift_paths_6 = ShiftPaths(Data=list_item_5, Offset=-1)
sort_list = SortList(Keys=ghpython_script_4.progression_deform_history)  # -> Keys, ValuesValuesA
sort_list_2 = SortList(Keys=ghpython_script_4.deform_history)  # -> Keys, ValuesValuesA
quick_graph_2 = QuickGraph(ghpython_script_4.progression_deform_history, SortOrder=0)
integer_3 = Integer(robot_dof)
mass_addition = MassAddition(Input=ghpython_script_4.deform_history)  # -> Result, PartialResults
mass_addition_2 = MassAddition(Input=ghpython_script_4.progression_deform_history)  # -> Result, PartialResults
shift_paths_7 = ShiftPaths(Data=ghpython_script_4.element_sequence, Offset=-1)
xy_plane = XYPlane(Origin=Point(0, 0, 0))
merge = Merge(Data1=shift_paths_5, Data2=split_tree_2.Positive)
list_item_6 = ListItem(List=sort_list.Keys, Index=0, Wrap=True)  # -> Item1, Item
list_item_7 = ListItem(List=sort_list_2.Keys, Index=0, Wrap=True)  # -> Item1, Item
pipe = Pipe(Curve=line, Radius=number, Caps=0)
wire_type = Slider(1, range=0..2)
split_tree_4 = SplitTree(Data=shift_paths_3, Masks=flatten(list_item_3.Item1))  # -> Positive, Negative
split_tree_5 = SplitTree(Data=shift_paths_3, Masks=flatten(list_item_3.Item2))  # -> Positive, Negative
split_tree_6 = SplitTree(Data=shift_paths_3, Masks=flatten(list_item_3.Item))  # -> Positive, Negative
split_tree_7 = SplitTree(Data=shift_paths_3, Masks=flatten(list_item_3.Item3))  # -> Positive, Negative
multiplication = Multiplication(A=integer_3, B=transfer_sample_rate)
clean = Button()
panel_27 = Panel([mass_addition_2.Result, list_item_6.Item1])
panel_28 = Panel([mass_addition.Result, list_item_7.Item1])
list_item_8 = ListItem(List=shift_paths_7, Index=0, Wrap=True)  # -> flatten(Item)
orient = Orient(Geometry=pipe, Source=plane_2, Target=xy_plane)  # -> Geometry, Transform
orient_2 = Orient(Geometry=line, Source=plane_2, Target=xy_plane)  # -> Geometry, Transform
multiplication_2 = Multiplication(A=integer_3, B=transit_sample_rate)
partition_list_3 = PartitionList(List=split_tree_5.Positive, Size=robot_dof)
partition_list_4 = PartitionList(List=split_tree_6.Positive, Size=multiplication)
partition_list_5 = PartitionList(List=split_tree_4.Positive, Size=robot_dof)

# ---- group: indexed by seq_id
list_item_9 = ListItem(List=shift_paths_4, Index=0, Wrap=True)

# ----
wirecleaner = WireCleaner(on=clean, wire_type=wire_type)  # -> out, a
# ---------- wirecleaner: Python ----------
from Grasshopper.Kernel import GH_ParamWireDisplay
from Grasshopper.Kernel import GH_RuntimeMessageLevel 

# A dictionary of wire types 
wire_display = {'0':GH_ParamWireDisplay.default, 
                '1':GH_ParamWireDisplay.faint,
                '2':GH_ParamWireDisplay.hidden}

# Get selected components and change the wire display
if on:
    doc = ghenv.Component.OnPingDocument()
    sel_objs = doc.SelectedObjects()
    if not len(sel_objs):
        ghenv.Component.AddRuntimeMessage(GH_RuntimeMessageLevel.Warning, 'Nothing was selected')
    for sel_obj  in sel_objs:
        if hasattr(sel_obj, 'Params'):
            for p in sel_obj.Params.Input:
                if hasattr(p, 'WireDisplay'):
                    p.WireDisplay = wire_display[wire_type]
        else:
            if hasattr(sel_obj, 'WireDisplay'):
                sel_obj.WireDisplay = wire_display[wire_type]
# ---------- end wirecleaner ----------
partition_list_6 = PartitionList(List=split_tree_7.Positive, Size=multiplication_2)
panel_29 = Panel(ghpython_script_4.progression_deform_history)
split_list = SplitList(List=partition_list_4, Index=integer_3)  # -> ListA, ListB
shift_paths_8 = ShiftPaths(Data=merge, Offset=-1)
split_list_2 = SplitList(List=partition_list_6, Index=integer_3)  # -> ListA, ListB
use_progression_sequence = BooleanToggle(False)
panel_30 = Panel(wirecleaner.out)

# ---- group: place retreat
number_2 = Number(partition_list_3)

# ----
panel_31 = Panel(ghpython_script_4.deform_history)

# ---- group: place approach
number_3 = Number(partition_list_5)

# ----
shift_paths_9 = ShiftPaths(Data=split_list.ListA, Offset=-1)
shift_paths_10 = ShiftPaths(Data=split_list_2.ListA, Offset=-1)

# ---- group: bar at origin (indexed by bar id)
geometry = Geometry(orient_2.Geometry)

# ----
plane_4 = Plane(plane_2)
plane_5 = Plane(shift_paths_8)
integer_4 = Integer(simplify(graft(ghpython_script_4.progression_sequence)))

# ---- group: grasp indexed by seq id
plane_6 = Plane(list_item_9)

# ---- group: transfer
number_4 = Number(shift_paths_9)

# ---- group: transit
number_5 = Number(shift_paths_10)

# ----
point_4 = Point(plane_5)

# ---- group: world_from_flange * flange_from_bar
orient_3 = Orient(Geometry=plane_6, Source=PlaneXY(0, 0, 0), Target=shift_paths_8)  # -> Geometry, Transform

# ----
panel_32 = Panel("open gripper")
panel_33 = Panel("close gripper")

# ---- group: tool link
xy_plane_2 = XYPlane(Origin=point_3)

# ---- group: world_from _bar, indexed by seq id
plane_7 = Plane(orient_3.Geometry)

# ----
merge_2 = Merge(Data2=number_4, Data3=number_3, Data5=number_2, Data6=number_5)
panel_34 = Panel("E:\Desktop\git_repositories\yijiang_coop_assembly\src\coop_assembly\data\models")
panel_35 = Panel("D:\code_ws\pb_ws\coop_assembly\src\coop_assembly\data\models")
integer_5 = Integer(robot_dof)

# ----
# Robot
load = Button()
ghpython_script_6 = PythonScript(
    load=load,
    pkg_path=panel_35,
    pkg_name="abb_irb4600_40_255",
    urdf_file="ECL_robot1_with_track.urdf",
    srdf_file="ECL_robot1_with_track.srdf")  # -> out, robot
# ---------- ghpython_script_6: Python ----------
from scriptcontext import sticky as st
import os
import compas

from compas.robots import RobotModel
from compas.robots import GithubPackageMeshLoader
from compas.robots import LocalPackageMeshLoader
from compas_fab.robots import Robot
from compas_fab.robots import RobotSemantics
from compas_ghpython.artists import RobotModelArtist

# Robot meshes are usually in meters
# Set a high percision to prevent parsing errors
# and configure Rhino itself in meters
compas.PRECISION = '12f'

# Store robot in component-based key
robot_key = 'robot_{}'.format(str(ghenv.Component.InstanceGuid))

if robot_key not in st:
    st[robot_key] = None

if load:
    # Also load geometry
    loader = LocalPackageMeshLoader(pkg_path, pkg_name)
    
    # Create robot model from URDF
    model = RobotModel.from_urdf_string(loader.load_urdf(urdf_file).read())
    model.load_geometry(loader)

    artist = RobotModelArtist(model)
    
    robot_semantics = None
    if srdf_file:
        robot_semantics = RobotSemantics.from_srdf_file(loader.build_path('srdf', srdf_file), model)
    
    robot = Robot(model, artist, semantics=robot_semantics)
    
    st[robot_key] = robot

robot = st[robot_key]

#repo    = 'ros-industrial/abb'
#package = 'abb_irb6600_support'
#branch  = 'kinetic-devel'
#
#github = GithubPackageMeshLoader(repo, package, branch)
#
#model = RobotModel.from_urdf_file(github.load_urdf('irb6640.urdf'))
#model.load_geometry(github)
#artist = RobotModelArtist(model)
#robot = Robot(model, artist)
# ---------- end ghpython_script_6 ----------
robot = Data(ghpython_script_6.robot)

panel_36 = Panel(ghpython_script_6.out)

# ---- group: These numbers are just for viz
construct_point = ConstructPoint(XCoordinate=Slider(3.8, range=0..10), YCoordinate=Slider(0, range=0..10), ZCoordinate=Slider(0, range=0..10))

# ----
panel_37 = Panel(robot)

# ---- group: meter, degree
# Configuration
a2 = Slider(0, range=-360..360)
a4 = Slider(0, range=-360..360)
a1 = Slider(0, range=-360..360)
a3 = Slider(0, range=-360..360)
a6 = Slider(0, range=-360..360)
a5 = Slider(0, range=-360..360)
gantry = Slider(0, range=0..4)
forward_kinematics = PythonScript(robot=robot, x=gantry, a1=a1, a2=a2, a3=a3, a4=a4, a5=a5, a6=a6)  # -> out, configuration
# ---------- forward_kinematics: Python ----------
import math
from compas_fab.robots import Configuration

if robot:
    joint_values = [a1, a2, a3, a4, a5, a6]
    joint_names = robot.get_configurable_joint_names()
    configuration = Configuration.from_prismatic_and_revolute_values([x], 
        [math.radians(a) for a in joint_values])
    print configuration
# ---------- end forward_kinematics ----------

# ----
radians = Radians(Degrees=a2)
xy_plane_3 = XYPlane(Origin=construct_point)
snap_ee_to_pose = BooleanToggle(False)
panel_38 = Panel(radians)

# ----
# . . . . . . . . . . . . . . . . . .
# .                                 .
# .   <<><><>   <<><><>   <<        .
# .   <<        <<        <<        .
# .   <<><><>   <<        <<        .
# .   <<        <<        <<        .
# .   <<        <<        <<        .
# .   <<><><>   <<><><>   <<><><>   .
# .                                 .
# .       Princeton SOA 2020        .
# . . . . . . . . . . . . . . . . . .
# 
# Created on 10.12.2016
# Modified 12.19.2020
# 
# @author: kathrind, stefanap, yijiangh, iant
unload_abb_communication_lib = Button()
# Connecting to ABB IRC5
# i. IP settings ipv4 automatically assign (ping test)
# ii. start the program on pendant (pp to main -> play)
# 1. <<Init>> in GH
# 2. <<R on>> in GH
# 3. Send commands
py = PythonScript(unload=unload_abb_communication_lib)
# ---------- py: Python ----------
from abb_communication.useful import unload_rfl_lib

if unload:
    unload_rfl_lib()
# ---------- end py ----------

xy_plane_4 = XYPlane(Origin=Point(0, 0, 0))
panel_39 = Panel(forward_kinematics.out)

# ---- group: environment collision objects
mesh = Mesh([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])

# ----
r_on = Button()
send_joints_sequence = Button()
init = Button()

list = ValueList({"no tool": 10, "ecl gripper": 0, "ecl gripper meters": 1}, selected="ecl gripper meters")

# ---- group: Init Robot
# tools
list_2 = ValueList({"no tool": 10, "ecl gripper": 0}, selected="ecl gripper")

# ----
tool = Tool_2(int=list)

# ---- group: Init Robot
# 1
list_3 = ValueList({"192.168.125.1", "127.0.0.1", "192.168.0.21", "192.168.0.11"}, selected="192.168.125.1")
tool_2 = Tool(int=list_2)
abb_4600 = ABB_4600(init=init, ip_abb=list_3)
set_tool_and_base = PythonScript(robot=abb_4600, tool=tool)  # -> out, robot, gantry_geo, tool_geo
# ---------- set_tool_and_base: Python ----------
from scriptcontext import sticky as st


robot.set_tool(tool)
#robot.set_gantry(gantry)
#robot.set_robot_origin(base_plane1, 1)
# set_robot_origin_with_measured_base(self, base_plane):

st["rfl_robot"] = robot

if tool:
    tool_geo = tool.geo
#gantry_geo = gantry.geo
# ---------- end set_tool_and_base ----------
mesh_2 = Mesh(set_tool_and_base.tool_geo)

# ---- group: Connect Robot
# 3
refresh_text_window = Button()
# 2
r_off = Button()
reset_robot = Button()
if_connection = PythonScript(
    robot=set_tool_and_base.robot,
    connect_robot=r_on,
    close_robot=r_off,
    refresh=refresh_text_window,
    reset_robot=reset_robot)  # -> out; inputs connect_robot: Boolean, close_robot: Boolean, refresh: Boolean
# ---------- if_connection: Python ----------
import Rhino.Geometry as rg
from abb_communication.clients.rfl_robot.communication.messages.clientstates import *

print robot.comm.running

# =========================================================================================    
if connect_robot == True:
    if robot.comm.running == False:
        robot.comm.start()
    else:
        pass

# =========================================================================================    
if close_robot == True:
    if robot.comm.running == True:
        robot.comm.close()
        robot.comm.cmd_counter_to_client = 0
        robot.comm.cmd_exec_counter_from_client = 0
        robot.comm.publish_state(1)
    else:
        pass

if reset_robot:
    robot.comm.close()
    robot.comm.cmd_counter_to_client = 0
    robot.comm.cmd_exec_counter_from_client = 0
    robot.comm.publish_state(1)
    try:
        robot.comm.start()
    except:
        print "CONNECTION TO ABB FAILED"

robot_conncection_state = "online" if robot.comm.running else "offline"
print "ABB CONNECTION STATE:", robot_conncection_state
print "ABB STATE: ", client_states_str_array[robot.comm.state]
print "Sent commands to ABB: ",  robot.comm.get_cmd_counter()
print "Executed commands from ABB: ",  robot.comm.cmd_exec_counter_from_client
# ---------- end if_connection ----------
panel_40 = Panel(if_connection)

# ----
list_4 = ValueList({"no tool": 10, "ecl gripper": 0, "ecl gripper meters": 1}, selected="ecl gripper meters")
panel_41 = Panel("1e-3")
scale = Scale(Geometry=mesh_2, Center=Point(0, 0, 0), Factor="1")  # -> Geometry, Transform
mesh_3 = Mesh(scale.Geometry)
rotate_3d = Rotate3D(Geometry=mesh_3, Angle=degrees("-90"), Center=Point(0, 0, 0), Axis=Vector(0, 0, 1))  # -> Geometry, Transform

# ---- group: gripper mesh (meter)
mesh_4 = Mesh(rotate_3d.Geometry)

# ----
panel_42 = Panel("2")  # disabled
number_slider = Slider(6, range=0..14)  # disabled
panel_43 = Panel("-3")  # disabled
unit_y = UnitY(Factor=Slider(0.21, range=0..0.5))
unit_x = UnitX(Factor=Slider(0.37, range=0..0.5))
point_5 = Point(construct_point)
negative = Negative(Value=unit_x)
negative_2 = Negative(Value=unit_y)
addition = Addition(A=negative_2, B=unit_x)
number_slider_2 = Slider(5, range=0..6)  # disabled
move = Move(Geometry=point_5, Motion=addition)  # -> Geometry, Transform
label_font_size = Slider(0.012, range=0.001..0.1)
construct_plane = ConstructPlane(Origin=move.Geometry, XAxis=unit_y, YAxis=negative)

# ---- group: gripper mesh
mesh_5 = Mesh(rotate_3d.Geometry)

# ----
point_6 = Point(Point(2, 1, 2))  # disabled
point_7 = Point(Point(1, 2, 1))  # disabled
deconstruct = Deconstruct(Point=point_6)  # -> XComponent, YComponent, ZComponent; disabled
deconstruct_2 = Deconstruct(Point=point_7)  # -> XComponent, YComponent, ZComponent; disabled
panel_44 = Panel("""0,0,1
0,1,0
0,1,0
1,0,0
0,1,0
1,0,0""")  # disabled

# ---- group: xyzdetla
panel_45 = Panel("0.01")  # disabled

# ----
minimum = Minimum(
    A=[deconstruct_2.XComponent, deconstruct_2.YComponent, deconstruct_2.ZComponent],
    B=[deconstruct.XComponent, deconstruct.YComponent, deconstruct.ZComponent])  # disabled

# ---- group: 1,1,1
point_8 = Point(Point(1, 1, 1))  # disabled

# ----
# bar seq id
panel_46 = Panel("*")

# ---- group: tags
integer_6 = Integer(ghpython_script_2.elements)
shift_paths_11 = ShiftPaths(Data=integer_6, Offset=-1)
text_3 = Text(ghpython_script_2.tags)
list_item_10 = ListItem(List=shift_paths_11, Index=0, Wrap=True)
concatenate_2 = Concatenate(Fragment_A="; element #", Fragment_B=integer_6, A=", ", B=text_3)

# ----
stream_filter = StreamFilter(Gate=use_progression_sequence, Stream0=list_item_10, Stream1=integer_4)

# ---- group: seq_id : beam_id
integer_7 = Integer(stream_filter)

# ---- group: Map seq_id to beam_id
cluster = Cluster(data=shift_paths_4, integer=integer_7)
list_item_11 = ListItem(List=cluster, Index=0, Wrap=True)

# ----
cluster_2 = Cluster(data=plane_5, integer=integer_7)

# ---- group: tags (continued)
tree_statistics_2 = TreeStatistics(Tree=stream_filter)  # -> Paths, Length, Count

# ----
panel_47 = Panel(cluster_2)

# ---- group: Map bar id to seq id
cluster_3 = Cluster_3(data=geometry, integer=integer_7)

# ----
panel_48 = Panel(stream_filter)

# ---- group: grasp indexed by bar id
plane_8 = Plane(list_item_11)

# ----
concatenate_3 = Concatenate(FragmentA="total #bars:", FragmentB=tree_statistics_2.Count)

# ---- group: tool_from_bar
orient_4 = Orient(Geometry=geometry, Source=PlaneXY(0, 0, 0), Target=plane_8)  # -> Geometry, Transform

# ---- group: bar sequence
integer_8 = Integer(integer_7)

# ----
total_bars = Panel(concatenate_3)

# ---- group: flange_from_bar (indexed by bar id)
orient_5 = Orient(Geometry=orient_4.Geometry, Source=PlaneXY(0, 0, 0), Target=xy_plane_2)  # -> Geometry, Transform

# ---- group: bar path indexed by seq id
orient_6 = Orient(Geometry=cluster_3, Source=PlaneXY(0, 0, 0), Target=plane_7)  # -> Geometry, Transform

# ---- group: Current bar in grasped pose (flange_from_bar) / indexed by bar ids
number_6 = Number(number)
curve = Curve(orient_5.Geometry)

# ---- group: total # of bars
integer_9 = Integer(tree_statistics_2.Count)

# ---- group: flange from bar, indexed by bar id
curve_2 = Curve(orient_5.Geometry)

# ---- group: seq_id : bar id
integer_10 = Integer(flatten(integer_7))

# ----
# Current built bar in goal pose
brep = Brep(simplify(pipe))

# ----
# bar object frames
colour_swatch = ColourSwatch(SwatchColor=RGBA(33, 2, 255, 0))

point_9 = Point(shift_paths_6)
shift_paths_12 = ShiftPaths(Data=point_9, Offset=-1)

assembly_seq = Slider(20, range=0..38)
viz_conf_id = Slider(114, range=0..400)

integer_11 = Integer(assembly_seq)
concatenate_4 = Concatenate(Fragment_A="{", Fragment_B=integer_11, A=";", C=panel_46, B="}")
construct_path = ConstructPath(Indices=graft(integer_11))  # -> flatten(Branch)

# ---- group: chosen assembly seq id
integer_12 = Integer(assembly_seq)

# ----
addition_2 = Addition(A=integer_12, B=1)
split_list_3 = SplitList(List=list_item_8, Index=addition_2)  # -> ListA, ListB
ghpython_script_7 = GhPythonScript(nE=list_length, bar_ids=split_list_3.ListA, fem_element_from_bar_id=ghpython_script_4.fem_element_from_bar_id)  # -> out, flatten(element_activation); inputs nE: Int32, bar_ids: list of Int32, fem_element_from_bar_id: tree of Int32
# ---------- ghpython_script_7: Python ----------
import rhinoscriptsyntax as rs
import Rhino.Geometry.Plane as Plane
import Rhino.Geometry.Point3d as Point3d
import Rhino.Geometry.Vector3d as Vector3d
import Rhino.Geometry.Quaternion as Quat
import Grasshopper.DataTree as DataTree # Add, AddRange(list, GHPath(i, j))
import Grasshopper.Kernel.Data.GH_Path as GHPath
import System

from ghpythonlib.treehelpers import list_to_tree, tree_to_list

fem_elements_from_bar = tree_to_list(fem_element_from_bar_id, lambda x:x)
#print fem_elements_from_bar
element_activation = [False for i in range(nE)]
for b in bar_ids:
    for e in fem_elements_from_bar[b]:
        element_activation[e] = True
# ---------- end ghpython_script_7 ----------
element_activation_karamba3d = ElementActivationKaramba3D(Model=python_karamba_model_converter.Model_out, IsActive=ghpython_script_7.element_activation)
analyze_karamba3d = AnalyzeKaramba3D(Model=element_activation_karamba3d)  # -> CalculatedModel, MaximumDisplacement_cm, ResultingForceOfGravity_kN, ElasticEnergy_kNm
list_item_12 = ListItem(List=panel_31, Index=integer_12, Wrap=True)
eigen_modes_karamba3d = EigenModesKaramba3D(
    Model=analyze_karamba3d.CalculatedModel,
    FromIndex=Slider(1, range=1..50),
    NumberOfModes=1,
    MaximumNumberOfIterations=300,
    Epsilon=1e-07)  # -> ModelWithEigenModesAsLoadCaseResults, Eigenvalues; disabled
multiplication_3 = Multiplication(A=analyze_karamba3d.MaximumDisplacement_cm, B=0.01)
karamba_max_deform = Panel(multiplication_3)
conmech_max_deform = Panel(list_item_12)
concatenate_5 = Concatenate(A="{", Fragment_A=assembly_seq, Fragment_B=";", B="*", C=";", D="*", E="}")
split_tree_8 = SplitTree(Data=concatenate_2, Masks=flatten(concatenate_5))  # -> Positive, Negative
panel_49 = Panel(split_tree_8.Positive)
split_tree_9 = SplitTree(Data=plane_5, Masks=flatten(concatenate_5))  # -> Positive, Negative
panel_50 = Panel(eigen_modes_karamba3d.Eigenvalues)  # disabled
integer_13 = Integer(integer_11)
cluster_4 = Cluster_2(plane=split_tree_9.Positive)  # -> list_a, result_2, number_3, result
integer_14 = Integer(assembly_seq)
model_view_karamba3d = ModelViewKaramba3D(Model=element_activation_karamba3d, ResultFactors=1, ResultCase=-1)  # -> Model, DeformedMesh, DeformedAxes, DeformedModel
list_item_13 = ListItem(List=flatten(integer_8), Index=integer_13, Wrap=True)
vector_display_ex = VectorDisplayEx(Point=cluster_4.list_a, Vector=cluster_4.result_2, Colour=cluster_4.result, Width=cluster_4.number_3)

construct_path_2 = ConstructPath(Indices=integer_14)
split_tree_10 = SplitTree(Data=orient_3.Geometry, Masks=flatten(construct_path_2))  # -> Positive, Negative
tree_branch = TreeBranch(Tree=number, Path=construct_path_2, MaintainPaths=True)
tree_branch_2 = TreeBranch(Tree=orient_6.Geometry, Path=construct_path_2, MaintainPaths=True)
number_7 = Number(tree_branch)
cluster_5 = Cluster_2(plane=split_tree_10.Positive)  # -> list_a, result_2, number_3, result
pipe_2 = Pipe(Curve=tree_branch_2, Radius=number_7, Caps=0)
custom_preview = CustomPreview(Geometry=tree_branch_2, Material=colour_swatch)
vector_display_ex_2 = VectorDisplayEx(Point=cluster_5.list_a, Vector=cluster_5.result_2, Colour=cluster_5.result, Width=cluster_5.number_3)

construct_path_3 = ConstructPath(Indices=list_item_13)  # -> flatten(Branch)
split_tree_11 = SplitTree(Data=merge_2, Masks=flatten(concatenate_5))  # -> Positive, Negative
shift_paths_13 = ShiftPaths(Data=split_tree_11.Positive, Offset=-1)
tree_branch_3 = TreeBranch(Tree=brep, Path=construct_path_3, MaintainPaths=True)

split_list_4 = SplitList(List=flatten(integer_8), Index=integer_13)  # -> simplify(graft(ListA)), ListB
construct_path_4 = ConstructPath(Indices=split_list_4.ListA)  # -> flatten(Branch)
split_tree_12 = SplitTree(Data=brep, Masks=flatten(construct_path_4))  # -> Positive, Negative
brep_2 = Brep(flatten(split_tree_12.Positive))
custom_preview_2 = CustomPreview(Geometry=brep_2, Material=ColourSwatch(SwatchColor=RGBA(0, 213, 255, 61)))
custom_preview_3 = CustomPreview(Geometry=tree_branch_3, Material=ColourSwatch(SwatchColor=RGBA(238, 0, 255, 32)))

tree_branch_4 = TreeBranch(Tree=brep, Path=construct_path_3, MaintainPaths=True)
tree_statistics_3 = TreeStatistics(Tree=shift_paths_13)  # -> Paths, Length, Count
division = Division(A=tree_statistics_3.Length, B=integer_5)
list_item_14 = ListItem(List=division, Index=0, Wrap=True)  # -> Item, Item1

# ---- group: take out one configuration for viz
tree_statistics_4 = TreeStatistics(Tree=split_tree_11.Positive)  # -> Paths, Length, Count
integer_15 = Integer(viz_conf_id)
list_item_15 = ListItem(List=tree_statistics_4.Paths, Index=integer_15, Wrap=False)
tree_branch_5 = TreeBranch(Tree=split_tree_11.Positive, Path=list_item_15, MaintainPaths=True)

# ----
concatenate_6 = Concatenate(FragmentA="total traj len:", FragmentB=tree_statistics_4.Count)

total_traj_length_for_current_bar = Panel(concatenate_6)

addition_3 = Addition(A=list_item_14.Item, B=list_item_14.Item1)

# ---- group: Current bar in grasped pose (flange_from_bar)
# bar sequence
tree_branch_6 = TreeBranch(Tree=integer_8, Path=construct_path, MaintainPaths=True)
construct_path_5 = ConstructPath(Indices=tree_branch_6)
split_tree_13 = SplitTree(Data=curve, Masks=flatten(construct_path_5))  # -> Positive, Negative
split_tree_14 = SplitTree(Data=number_6, Masks=flatten(construct_path))  # -> Positive, Negative
curve_3 = Curve(split_tree_13.Positive)
pipe_3 = Pipe(Curve=curve_3, Radius=split_tree_14.Positive, Caps=0)

# ----
conf_in_transfer_place_approach = Panel(addition_3)
larger_than = LargerThan(FirstNumber=integer_15, SecondNumber=addition_3)  # -> LargerThan, OrEqualTo
tree_branch_7 = TreeBranch(Tree=shift_paths_12, Path=construct_path_2, MaintainPaths=True)

brep_3 = Brep(flatten(pipe_2))
list_item_16 = ListItem(List=brep_3, Index=0, Wrap=False)
dot_display = DotDisplay(Point=tree_branch_7, Colour=ColourSwatch(SwatchColor=RGB(87, 151, 255)), Size=Slider(0.007, range=0.001..0.01))
custom_preview_4 = CustomPreview(Geometry=list_item_16, Material=ColourSwatch(SwatchColor=RGB(74, 142, 255)))

# ---- group: meter, radians
# Configuration
list_item_17 = ListItem(List=tree_branch_5, Index=0, Wrap=True)  # -> Item, Item1, Item2, Item3, Item4, Item5, Item6
forward_kinematics_2 = PythonScript(
    robot=robot,
    x=list_item_17.Item,
    a1=list_item_17.Item1,
    a2=list_item_17.Item2,
    a3=list_item_17.Item3,
    a4=list_item_17.Item4,
    a5=list_item_17.Item5,
    a6=list_item_17.Item6)  # -> configuration
# ---------- forward_kinematics_2: Python ----------
import math
from compas_fab.robots import Configuration

if robot and x:
    joint_values = [a1, a2, a3, a4, a5, a6]
    joint_names = robot.get_configurable_joint_names()
    configuration = Configuration.from_prismatic_and_revolute_values([x], 
        [a for a in joint_values])
else:
    configuration = None
# ---------- end forward_kinematics_2 ----------

# ---- group: trajectory for one bar's assembly
number_8 = Number(split_tree_11.Positive)

# ----
panel_51 = Panel(number_8)
null_item = NullItem(Item=forward_kinematics_2)  # -> NullFlags, InvalidFlags, Description
stream_filter_2 = StreamFilter(Gate=null_item.NullFlags, Stream0=forward_kinematics_2, Stream1=forward_kinematics.configuration)
data = Data(stream_filter_2)
configurations_at_pickup = Data(data)

# ----
# Visualisation
# floor mount
brep_4 = Brep(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)
show_end_effector_frame = BooleanToggle(False)
show_base_frame = BooleanToggle(False)
show_visual = BooleanToggle(False)
show_collision = BooleanToggle(True)
show_frames = BooleanToggle(True)
visualize = PythonScript(
    robot=robot,
    group="manipulator_gripper",
    configuration=configurations_at_pickup,
    show_visual=show_visual,
    show_collision=show_collision,
    show_frames=show_frames,
    show_base_frame=show_base_frame,
    show_end_effector_frame=show_end_effector_frame)  # -> out, visual, collision, frames, ee_frame, base_frame
# ---------- visualize: Python ----------
"""Visualizes a robot.
    Inputs:
        robot: The robot
        configuration: :class:`compas_fab.robots.Configuration`
            The robot's full configuration to display.
        show_visual: bool
           Whether or not to show the robot's visual meshes.
        show_collision: bool
           Whether or not to show the robot's collision meshes.
        show_frames: bool
           Whether or not to show the robot's joint frames.
        show_base_frame: bool
           Whether or not to show the robot's base frame.
        show_end_effector_frame: bool
            Whether or not to show the robot's end-effector frame.
    Output:
        visual: The robot's visual meshes.
        collision: The robot's collision meshes.
        frames: The robot's joint frames.
        base_frame: The robot's base frame.
        ee_frame: The robot's end-effector frame.
"""
from __future__ import print_function

if robot and configuration:
    group = group or None
    robot.update(configuration, group, visual=show_visual, collision=show_collision)
    print(robot.get_end_effector_link_name(group))
    
    if show_visual:
        visual = robot.artist.draw_visual()

    if show_collision:
        collision = robot.artist.draw_collision()

    if show_frames:
        axes = robot.transformed_axes(configuration, group)
        frames = robot.transformed_frames(configuration, group)

    if show_base_frame:
        frames = robot.transformed_frames(configuration, group)
        base_frame = frames[0]

    if show_end_effector_frame:
        ee_frame = robot.forward_kinematics(configuration, group)
        print("End-effector", ee_frame)
# ---------- end visualize ----------
draw = GhPythonScript(frames=[visualize.frames, visualize.ee_frame, visualize.base_frame], scale=Slider(0.06, range=0..1))  # -> P, V, C, W, flatten(planes); inputs frames: list
# ---------- draw: Python ----------
from System.Drawing import Color
from compas_ghpython import draw_frame

red = Color.FromArgb(255, 0, 0)
green = Color.FromArgb(0, 255, 0)
blue = Color.FromArgb(0, 0, 255)

P = []
V = []
C = []
planes = []

scale = float(scale)

for frame in frames:
    if not frame:
        continue
    plane = draw_frame(frame)
    P += [plane.Origin] * 3
    V.append(plane.XAxis * scale)
    V.append(plane.YAxis * scale)
    V.append(plane.ZAxis * scale)
    C += [red, green, blue]
    planes.append(plane)

W = 3
# ---------- end draw ----------
geometry_2 = Geometry(visualize.visual)
geometry_3 = Geometry(visualize.collision)
vector_display_ex_3 = VectorDisplayEx(Point=draw.P, Vector=draw.V, Colour=draw.C, Width=draw.W)

custom_preview_5 = CustomPreview(Geometry=[brep_4, mesh], Material=ColourSwatch(SwatchColor=RGBA(0, 0, 0, 44)))

# ---- group: eef_frame
list_item_18 = ListItem(List=visualize.frames, Index=Slider(14, range=0..43), Wrap=False)
ghpython_script_8 = GhPythonScript(x=list_item_18)  # -> out, a
# ---------- ghpython_script_8: Python ----------
from compas_ghpython import draw_frame

a = draw_frame(x)
# ---------- end ghpython_script_8 ----------

# ---- group: eef_base_frame (flange)
list_item_19 = ListItem(List=visualize.frames, Index=Slider(13, range=0..43), Wrap=False)
ghpython_script_9 = GhPythonScript(x=list_item_19)  # -> out, a; same code as ghpython_script_8

# ----
plane_9 = Plane(ghpython_script_9.a)
stream_filter_3 = StreamFilter(Gate=snap_ee_to_pose, Stream0=xy_plane_3, Stream1=plane_9)
plane_10 = Plane(stream_filter_3)

# ---- group: move gripper and bar to a better place for viz
orient_7 = Orient(Geometry=flatten(mesh_4), Source=xy_plane_4, Target=plane_10)  # -> Geometry, Transform

# ---- group: jaw geometry
integer_16 = Integer([Slider(28, range=0..54), Slider(29, range=0..54), Slider(47, range=0..54), Slider(16, range=0..54)])
list_item_20 = ListItem(List=orient_7.Geometry, Index=integer_16, Wrap=True)

# ----
brep_5 = Brep(pipe_3)
stream_filter_4 = StreamFilter(Gate=larger_than.OrEqualTo, Stream0=brep_5)
list_item_21 = ListItem(List=orient_7.Transform, Index=0, Wrap=True)
plane_11 = Plane(ghpython_script_8.a)

# ---- group: ABB Communication
send_joints_list = Button()
open_gripper = Button()
close_gripper = Button()
send_joints = Button()
list_5 = ValueList({"Fast": 1, "Mid": 2, "Slow": 3}, selected="Mid")
python = PythonScript(
    joints_sequence=number_8,
    sequence_num=Slider(0, range=0..10),
    move_num=Slider(0, range=-2..10),
    joints_num=Slider(0, range=-2..10),
    send_joints=send_joints,
    send_joints_list=send_joints_list,
    send_joints_sequence=send_joints_sequence,
    open_gripper=open_gripper,
    close_gripper=close_gripper,
    rob_num=Slider(1, range=1..2),
    rob_speed=list_5)  # -> out, joints_abb_send, move_len, joints_sequence_tree, simplify(joints_abb_sequence_tree); inputs joints_sequence: tree, sequence_num: Int32, move_num: Int32, joints_num: Int32
# ---------- python: Python ----------
from abb_communication.clients.rfl_robot.communication.messages.messagetypes import *

import Rhino.Geometry as rg
from ghpythonlib.treehelpers import list_to_tree, tree_to_list

from abb_communication.geometry import Frame
from scriptcontext import sticky as st
import math
import time
from threading import Thread

robot = st["rfl_robot"]
robot_speed = float(rob_speed)

if robot:    
    robot.comm.float_arbitrary = int(rob_num)
    print("robot found")
    
    
    if rob_speed == 1:
        print "robot speed: fast"
        robot_speed = 250
        robot.comm.send_set_speed(robot_speed, 15)
    if rob_speed == 2:
        print "robot speed: mid"
        robot_speed = 150
        robot.comm.send_set_speed(robot_speed, 5)
    if rob_speed == 3:
        print "robot speed: slow"
        robot_speed = 25
        robot.comm.send_set_speed(robot_speed)
    
    
    if robot.comm.running:
        print "ROBOT IS ONLINE"
        
#        joints_print = robot.comm.get_current_pose_joint()
#        print "current joints:", joints_print
#        joints_deg = [math.degrees(j) for j in joints_print]
#        joints_deg = [round(x, 2) for x in joints_deg]
#        print "current pose:", joints_deg
        
    else:
        print "ROBOT IS OFFLINE"
        
        
#==================================================================
    
    
#if send_joints_single:
#    robot.comm.send_stop()
#    if len(joints_abb) < 9:
#        joints_abb.extend([0,0])
#    joints_abb = [float(x) for x in joints_abb]
#    print(joints_abb)
#    robot.comm.send_axes_absolute(joints_abb, int_arr = None)
    
    
#get data tree into list of lists of floats
#joints_abb_list = tree_to_list(joints_abb_list, 0)
#joints_abb_list_2 = []
#for joints_abb in joints_abb_list:
#    joints_abb = [float(item) for item in joints_abb]
#    joints_abb_list_2.append(joints_abb)
    

    
    
    
#==================================================================


##clean sequence tree
#joints_sequence = tree_to_list(joints_sequence, 0)
#joints_abb_sequence = []
#
#for sequence in joints_sequence:
#    move_new = []
#    for move in sequence:
#        joints_new = []
#        for joints in move:
##            print(joints)
#            joints.append(joints.pop(0))
#            joints.extend([0,0])
#            joints = [float(item) for item in joints]
#            joints[:6] = [math.degrees(item) for item in joints[:6]]
#            joints[6] = joints[6] * 1000
##            print(joints)
#            joints_new.append(joints)
#        move_new.append(joints_new)
#    joints_abb_sequence.append(move_new)


#control which sequence (#1-x) >> move (#1-4)>> joints (#1-x)
#joints_abb_list_send = joints_abb_sequence[sequence_num][move_num] #send a move 
#joints_abb_send = joints_abb_sequence[sequence_num][move_num][joints_num] #send a joint
#move_len = len(joints_abb_list_send) #check num joints in move

#print("joints_abb_list_send type:", type(joints_abb_list_send))
#print("joints_abb_list_send length:", len(joints_abb_list_send))
##print("joints_abb_list_send:", joints_abb_list_send)
#print("joints_abb_send:", joints_abb_send)

#==================================================================

#if send_joints:
#    robot.comm.send_stop()
#    robot.comm.send_axes_absolute(joints_abb_send, int_arr = None)


##TEST: send list of joints individually in loop
#if send_joints_list_loop:
#    robot.comm.send_set_speed(300, 2)
#    robot.comm.send_stop()
#    for joints in joints_abb_list_send:
#        robot.comm.send_axes_absolute(joints, int_arr = None)
#        
#    robot.comm.send_open_gripper()
#    robot.comm.send_close_gripper()


#if send_joints_list:
#    robot.comm.send_stop()
#    robot.comm.send_close_gripper() #opens gripper jaws
#    robot.comm.send_stop()
#    robot.comm.send_open_gripper() #closes gripper jaws
#    robot.comm.send_stop()
#    
#    robot.comm.send_axes_absolute_list(joints_abb_sequence[sequence_num][0], int_arr = None)
#    time.sleep(1)
#    robot.comm.send_axes_absolute_list(joints_abb_sequence[sequence_num][1], int_arr = None)
#    time.sleep(1)
#    
#    robot.comm.send_stop()
#    robot.comm.send_close_gripper() #opens gripper jaws
#    robot.comm.send_stop()
#    
#    robot.comm.send_axes_absolute_list(joints_abb_sequence[sequence_num][2], int_arr = None)
#    time.sleep(1)
#    robot.comm.send_axes_absolute_list(joints_abb_sequence[sequence_num][3], int_arr = None)
#    time.sleep(1)
#    robot.comm.send_open_gripper() #closes gripper jaws

#==================================================================

#201219_conversion to abb format/units from yijiang, applied per single sequence
PROCESS_NAME_FROM_ID = {
    0 : 'transit', 1 : 'place_approach', 2 : 'place_retreat', 3 : 'transfer',
}

def convert_to_ECL_conf(joints):
    joints.append(joints.pop(0))
    joints.extend([0,0])
    # convert joint to degrees
    joints[:6] = [math.degrees(item) for item in joints[:6]]
    # conver to meters
    joints[6] = joints[6] * 1000
    return joints

transfer = []
place_approach = []
place_retreat = []
transit = []
for ghpath in joints_sequence.Paths:
    seq_id, process_id, conf_id = list(ghpath.Indices)
    # I convert the configuration to your format here!
    conf = convert_to_ECL_conf(list(joints_sequence.Branch(ghpath)))
#    print conf
    if process_id == 0:
        transfer.append(conf)
    elif process_id == 1:
        place_approach.append(conf)
    elif process_id == 2:
        place_retreat.append(conf)
    elif process_id == 3:
        transit.append(conf)
place_approach_reverse = place_approach[::-1]

if send_joints_sequence:
#    robot.comm.set_speed_mid()
#    robot.comm.send_set_speed(robot_speed)
    robot.comm.send_stop()
    robot.comm.send_close_gripper() #opens gripper jaws
    robot.comm.send_stop()
    robot.comm.send_open_gripper() #closes gripper jaws
    robot.comm.send_stop()
    
    robot.comm.send_axes_absolute_list(transfer, int_arr = None)
    time.sleep(1)
    robot.comm.send_axes_absolute_list(place_approach, int_arr = None)
    robot.comm.send_stop()
    
    robot.comm.send_axes_absolute_list(place_approach_reverse, int_arr = None)
    robot.comm.send_stop()
    robot.comm.send_axes_absolute_list(place_approach, int_arr = None)
    robot.comm.send_stop()

    robot.comm.send_close_gripper() #opens gripper jaws
    robot.comm.send_stop()
    
    robot.comm.send_axes_absolute_list(place_retreat, int_arr = None)
    time.sleep(1)
    robot.comm.send_axes_absolute_list(transit, int_arr = None)
    time.sleep(1)
    robot.comm.send_open_gripper() #closes gripper jaws
        
        
if open_gripper:
    robot.comm.send_close_gripper()
    
if close_gripper:
    robot.comm.send_open_gripper()
    
#==================================================================
# ---------- end python ----------

# ----
orient_8 = Orient(Geometry=stream_filter_4, Source=PlaneXY(0, 0, 0), Target=ghpython_script_9.a)  # -> Geometry, Transform
cluster_6 = Cluster_2(plane=plane_11)  # -> list_a, result_2, number_3, result
curve_4 = Curve(curve_3)
bounding_box = BoundingBox(Content=list_item_20, Plane=plane_10, UnionBox=True)  # -> Box, Box_2
transform = Transform(Geometry=pipe_3, Transform=list_item_21)
transform_2 = Transform(Geometry=curve_4, Transform=list_item_21)
vector_display_ex_4 = VectorDisplayEx(Point=cluster_6.list_a, Vector=cluster_6.result_2, Colour=cluster_6.result, Width=cluster_6.number_3)
custom_preview_6 = CustomPreview(Geometry=orient_8.Geometry, Material=ColourSwatch(SwatchColor=RGBA(243, 119, 255, 80)))
deconstruct_brep = DeconstructBrep(Brep=bounding_box.Box)  # -> Faces, Edges, Vertices
deconstruct_box_length = DeconstructBoxLength(box=bounding_box.Box)  # -> x_length_width, y_length_length, z_length_height
cluster_7 = Cluster_4(box=bounding_box.Box, curve=transform_2)  # -> line_4, result_2, line_3, result
list_item_22 = ListItem(List=deconstruct_brep.Edges, Index="7", Wrap=True)
concatenate_7 = Concatenate(FragmentA=deconstruct_box_length.y_length_length, FragmentB=" (meter)")
length = Length(Curve=curve_4)
ghpython_script_10 = GhPythonScript(x=visualize.frames)  # -> out, a; disabled; same code as ghpython_script_8
split_list_5 = SplitList(List=geometry_3, Index=panel_42)  # -> ListA, ListB; disabled
list_item_23 = ListItem(List=split_list_5.ListB, Index=0, Wrap=True)  # -> Item, Item1, Item2, Item3, Item4, Item5, Item6, Item7; disabled
format = Format(Format="{0:0.0000}", Culture=127, Data0=length)
plane_12 = Plane(ghpython_script_10.a)  # disabled
list_item_24 = ListItem(List=split_list_5.ListB, Index=0, Wrap=True)  # -> Item2, Item1, Item; disabled
merge_3 = Merge(
    Data1=list_item_23.Item1,
    Data2=list_item_23.Item2,
    Data3=list_item_23.Item3,
    Data4=list_item_23.Item4,
    Data5=list_item_23.Item5)  # disabled
split_list_6 = SplitList(List=plane_12, Index=number_slider)  # -> ListA, ListB; disabled
shift_list = ShiftList(List=split_list_6.ListB, Shift=panel_43, Wrap=False)  # disabled
merge_4 = Merge(Data1=list_item_24.Item2, Data2=list_item_24.Item1)  # disabled
integer_17 = Integer(assembly_seq)
plane_13 = Plane(simplify(graft(shift_list)))  # disabled
group = Group(Objects=merge_4)  # disabled
merge_5 = Merge(Data1=merge_3, Data2=group)  # disabled
geometry_4 = Geometry(simplify(graft(merge_5)))  # disabled
bounding_box_2 = BoundingBox(Content=geometry_4, Plane=plane_13)  # -> flatten(Box), flatten(Box_2); disabled
format_2 = Format(Format="{0:0.0000}", Culture=127, Data0=cluster_7.result)
format_3 = Format(Format="{0:0.0000}", Culture=127, Data0=cluster_7.result_2)
addition_4 = Addition(A=deconstruct_box_length.y_length_length, B=format_3, C=format_2)
subtraction = Subtraction(A=addition_4, B=format)
concatenate_8 = Concatenate(
    E="Seq #",
    F=integer_17,
    G="/ total ",
    H=integer_9,
    J="bar length (m): ",
    K=format,
    Fragment_A="Left jaw length (m):  ",
    Fragment_B=format_3,
    B="Right jaw length (m):  ",
    C=format_2,
    M="sanity check error: ",
    N=subtraction)
list_item_25 = ListItem(List=flatten(plane_13), Index=number_slider_2, Wrap=True)  # disabled
list_item_26 = ListItem(List=flatten(geometry_4), Index=number_slider_2, Wrap=True)  # disabled
list_item_27 = ListItem(List=bounding_box_2.Box, Index=number_slider_2, Wrap=True)  # disabled
brep_6 = Brep(transform)
mesh_6 = Mesh(orient_7.Geometry)
deconstruct_box = DeconstructBox(Box=bounding_box_2.Box)  # -> Plane, X, Y, Z; disabled
deconstruct_box_2 = DeconstructBox(Box=bounding_box_2.Box_2)  # -> Plane, X, Y, Z; disabled
text_tag_3d = TextTag3D(
    Location=construct_plane,
    Text=concatenate_8,
    Size=Slider(0.1, range=0..0.1),
    Colour=ColourSwatch(SwatchColor=RGB(0, 0, 0)),
    Justification=7)
custom_preview_7 = CustomPreview(Geometry=mesh_6, Material=ColourSwatch(SwatchColor=RGBA(59, 127, 255, 125)))
line_dimension = LineDimension(Line=list_item_22, Text=concatenate_7, Size=label_font_size)
custom_preview_8 = CustomPreview(Geometry=brep_6, Material=ColourSwatch(SwatchColor=RGBA(255, 59, 255, 40)))
line_dimension_2 = LineDimension(Line=cluster_7.line_4, Text=format_3, Size=label_font_size)
line_dimension_3 = LineDimension(Line=cluster_7.line_3, Text=format_2, Size=label_font_size)
deconstruct_domain = DeconstructDomain(Domain=deconstruct_box_2.Y)  # -> Start, End; disabled
deconstruct_domain_2 = DeconstructDomain(Domain=deconstruct_box_2.Z)  # -> Start, End; disabled
deconstruct_domain_3 = DeconstructDomain(Domain=deconstruct_box_2.X)  # -> Start, End; disabled

# ---- group: jaw geometry
list_item_28 = ListItem(List=mesh_5, Index=integer_16, Wrap=True)

# ----
plane_14 = Plane(deconstruct_box.Plane)  # disabled
subtraction_2 = Subtraction(A=deconstruct_domain.End, B=deconstruct_domain.Start)  # disabled
subtraction_3 = Subtraction(A=deconstruct_domain_3.End, B=deconstruct_domain_3.Start)  # disabled
subtraction_4 = Subtraction(A=deconstruct_domain_2.End, B=deconstruct_domain_2.Start)  # disabled
vector_xyz = VectorXYZ(XComponent=subtraction_3, YComponent=subtraction_2, ZComponent=subtraction_4)  # -> Vector, Length; disabled
point_10 = Point(plane_14)  # disabled
division_2 = Division(A=panel_45, B=vector_xyz.Length)  # disabled
plane_normal = PlaneNormal(Origin=point_10, ZAxis=panel_44)  # disabled
merge_6 = Merge(Data1=panel_45, Data2=division_2)  # disabled
division_3 = Division(A=vector_xyz.Length, B=2)  # disabled
panel_52 = Panel(merge_6)  # disabled

# ---- group: viz cricle
circle = Circle(Plane=plane_normal, Radius=division_3)  # disabled

# ----
list_item_29 = ListItem(List=circle, Index=number_slider_2, Wrap=True)  # disabled
multiplication_4 = Multiplication(A=point_8, B=vector_xyz.Length)  # disabled
point_11 = Point(plane_normal)  # disabled
addition_5 = Addition(A=point_11, B=multiplication_4)  # disabled
subtraction_5 = Subtraction(A=point_11, B=multiplication_4)  # disabled

# ---- group: min pos
point_12 = Point(subtraction_5)  # disabled

# ---- group: max pos
point_13 = Point(addition_5)  # disabled

# ----
# Overall bar cut / grasp statistics
length_2 = Length(Curve=curve_2)
curve_5 = Curve(curve_2)
bounding_box_3 = BoundingBox(Content=list_item_28, Plane=plane_10, UnionBox=True)  # -> Box, Box_2
cluster_8 = Cluster_4(box=bounding_box_3.Box, curve=curve_5)  # -> line_4, result_2, line_3, result

# ---- group: bar length (indexed by bar id)
number_9 = Number(flatten(length_2))

# ---- group: distance between left end of the bar and the haw and the left jaw's edge
number_10 = Number(flatten(cluster_8.result_2))

# ---- group: distance between RIGHT end of the bar and the haw and the RIGHT jaw's edge
number_11 = Number(flatten(cluster_8.result))

# ----
list_item_30 = ListItem(List=number_9, Index=integer_10, Wrap=True)
list_item_31 = ListItem(List=number_11, Index=integer_10, Wrap=True)
list_item_32 = ListItem(List=number_10, Index=integer_10, Wrap=True)
format_4 = Format(Format="{0:0.0000}", Culture=127, Data0=list_item_31)
format_5 = Format(Format="{0:0.0000}", Culture=127, Data0=list_item_32)
format_6 = Format(Format="{0:0.0000}", Culture=127, Data0=list_item_30)
addition_6 = Addition(A=format_5, B=format_4, C="0.1065")
subtraction_6 = Subtraction(A=addition_6, B=format_6)
sanity_check_bar_lenghth_left_jaw_len_ri = Panel(subtraction_6)  # "Sanity check: bar lenghth = left + jaw len + right"

seq_id_bar_length_in_meter = Panel(format_6)
seq_id_jaw_left_length_meter = Panel(format_5)
seq_id_jaw_right_length_meter = Panel(format_4)
seq_id_element_id = Panel(integer_10)

# ==== cluster Tool
brep = Brep([<brep referenced from the Rhino model> x7])
mesh = Mesh([<mesh referenced from the Rhino model> x9])
mesh_brep = MeshBrep(
    Brep=brep,
    Settings={GridMaxCount=0, GridMinCount=16, JaggedSeams=False, MaxEdgeLength=0, MinEdgeLength=0.0001, MinTolerance=0, Refine=True, RefineAngle=0, RelativeTolerance=0.65, SimplePlanes=True, Tolerance=0})
merge = Merge(Data1=mesh_brep, Data2=mesh)
mesh_2 = Mesh(merge)
scale = Scale(Geometry=mesh_2, Center=Point(0, 0, 0), Factor="1e3")  # -> Geometry, Transform
init = ClusterInput()
pln = Plane(Plane(origin=(0.0867109651, 1.472961418, 319.9745917), x=(-0.99999089, -0.004254372967, 0.0003466928643), y=(0.004257543076, -0.9999436638, 0.009723299055)))
plane = Plane(PlaneXY(0, 0, 0))
int = ClusterInput()
int_2 = Integer(int)

set_tool = PythonScript(init=init, tool_geo=scale.Geometry, tool_plane=plane)  # -> out, tool, tool_plane, tool_geo, tool_axes, tool_axes_colors; inputs tool_geo: list of Mesh, tool_plane: Plane
# ---------- set_tool: Python ----------
import Rhino.Geometry as rg
import ghpythonlib.components as ghcomp
import math as m


from abb_communication.clients.rfl_robot import MeshMouldTool
from abb_communication.clients.rfl_robot.tool import LwsGripperTool
#from abb_communication.clients.rfl_robot import Tool
from abb_communication.geometry import Frame


tool = LwsGripperTool(tool_geo, tool_plane)

tool_plane = tool.get_plane()
tool_axes, tool_axes_colors = tool.get_frame_axes_as_lines()
# ---------- end set_tool ----------
pln_2 = Plane(set_tool.tool_plane)
preview = CustomPreview(Geometry=set_tool.tool_axes, Shader=set_tool.tool_axes_colors)
geo = Geometry(set_tool.tool_geo)
preview_2 = CustomPreview(Geometry=geo, Shader=ColourSwatch(SwatchColor=RGBA(100, 168, 178, 162)))

select_tool = StreamFilter(Gate=int_2, Stream0=set_tool.tool)
tool = Data(select_tool)
tool_2 = ClusterOutput(tool)

# ==== cluster DeconstructBoxLength
box = ClusterInput()
deconstruct_box = DeconstructBox(Box=box)  # -> Plane, X, Y, Z
deconstruct_domain = DeconstructDomain(Domain=deconstruct_box.X)  # -> Start, End
deconstruct_domain_2 = DeconstructDomain(Domain=deconstruct_box.Y)  # -> Start, End
deconstruct_domain_3 = DeconstructDomain(Domain=deconstruct_box.Z)  # -> Start, End
subtraction = Subtraction(A=deconstruct_domain_2.End, B=deconstruct_domain_2.Start)
subtraction_2 = Subtraction(A=deconstruct_domain.End, B=deconstruct_domain.Start)
subtraction_3 = Subtraction(A=deconstruct_domain_3.End, B=deconstruct_domain_3.Start)
y_length_length = ClusterOutput(subtraction)  # Y length (length)
x_length_width = ClusterOutput(subtraction_2)  # X length (width)
z_length_height = ClusterOutput(subtraction_3)  # Z length (height)

# ==== cluster Cluster
data = ClusterInput()
integer = ClusterInput()

# ---- group: Map seq_id to beam_id / bar sequence
integer_2 = Integer(flatten(integer))

# ---- group: Map seq_id to beam_id
tree_statistics = TreeStatistics(Tree=data)  # -> Paths, Length, Count
replace_paths = ReplacePaths(Data=data, Search=tree_statistics.Paths, Replace=integer_2)

# ----
data_2 = ClusterOutput(replace_paths)

# ==== cluster Cluster_2
plane = ClusterInput()
plane_2 = Plane(simplify(graft(plane)))
deconstruct_plane = DeconstructPlane(Plane=plane_2)  # -> Origin, XAxis, YAxis, ZAxis
merge = Merge(
    Data1=ColourSwatch(SwatchColor=RGB(255, 0, 0)),
    Data2=ColourSwatch(SwatchColor=RGB(0, 255, 0)),
    Data3=ColourSwatch(SwatchColor=RGB(0, 0, 255)))
number = Number(Slider(1, range=0..1))
number_2 = Number(Slider(0.1, range=0.1..1))
multiplication = Multiplication(A=[deconstruct_plane.XAxis, deconstruct_plane.YAxis, deconstruct_plane.ZAxis], B=number_2)
result = ClusterOutput(merge)
number_3 = ClusterOutput(number)
longest_list = LongestList(ListListA=deconstruct_plane.Origin, ListListB=multiplication, PaddingMode=2)  # -> ListListA, ListListB
result_2 = ClusterOutput(multiplication)
list_a = ClusterOutput(longest_list.ListListA)

# ==== cluster ABB_4600
base = Mesh([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])
l1 = Mesh(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)
l3 = Mesh(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)
l4 = Mesh(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)
l5 = Mesh(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)
l6 = Mesh(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)
l2 = Mesh(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)
mesh = Mesh([l1, l2, l3, l4, l5, l6])
ip_abb = ClusterInput()
init = ClusterInput()
plane = Plane([PlaneXY(-1.185867404e-09, 0, 0), Plane(origin=(175, 0, 495), x=(0, 0, 1), y=(1, 0, 0)), Plane(origin=(175, 0, 1590), x=(0, 0, 1), y=(1, 0, 0)), Plane(origin=(175, 0, 1765), x=(0, 0, -1), y=(0, 1, 0)), Plane(origin=(1446, 0, 1765), x=(0, 0, 1), y=(1, 0, 0)), Plane(origin=(1581, 0, 1765), x=(-1.94917184e-05, 1.016258774e-11, -0.9999999998), y=(-2.075117433e-05, 0.9999999998, 4.146386344e-10))])
if = PythonScript(init=init, ip_abb=ip_abb, joint_planes=plane, base_geo=base, link_geo=mesh)  # -> robot; inputs joint_planes: list of Plane, base_geo: list of Mesh, link_geo: list of Mesh
# ---------- if: Python ----------
from abb_communication.clients import Robot

robot = Robot(link_geo, base_geo, joint_planes, ip_abb = ip_abb)
# ---------- end if ----------
robot = ClusterOutput(if)

# ==== cluster Cluster_3
data = ClusterInput()
integer = ClusterInput()

# ---- group: Map bar id to seq id / bar sequence
integer_2 = Integer(flatten(integer))

# ---- group: Map bar id to seq id
data_2 = Data(data)
tree_statistics = TreeStatistics(Tree=data_2)  # -> Paths, Length, Count
deconstruct_path = DeconstructPath(Branch=graft(tree_statistics.Paths))  # -> flatten(Indices)
ghpython_script = GhPythonScript(x=deconstruct_path, y=integer_2)  # -> out, a; inputs x: list of Int32, y: list of Int32
# ---------- ghpython_script: Python ----------
a = [y.index(t) for t in x]
# ---------- end ghpython_script ----------
replace_paths = ReplacePaths(Data=data_2, Search=tree_statistics.Paths, Replace=ghpython_script.a)

# ----
data_3 = ClusterOutput(replace_paths)

# ==== cluster Tool_2
init = ClusterInput()
mesh = Mesh([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])
pln = Plane(Plane(origin=(0.0867109651, 1.472961418, 319.9745917), x=(-0.99999089, -0.004254372967, 0.0003466928643), y=(0.004257543076, -0.9999436638, 0.009723299055)))
plane = Plane(PlaneXY(0, 0, 0))
mesh_2 = Mesh([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])
plane_2 = Plane(PlaneXY(0, 0, 0))
int = ClusterInput()
int_2 = Integer(int)
set_tool = PythonScript(init=init, tool_geo=mesh_2, tool_plane=plane_2)  # -> out, tool, tool_plane, tool_geo, tool_axes, tool_axes_colors; inputs tool_geo: list of Mesh, tool_plane: Plane; same code as set_tool

set_tool_2 = PythonScript(init=init, tool_geo=mesh, tool_plane=plane)  # -> out, tool, tool_plane, tool_geo, tool_axes, tool_axes_colors; inputs tool_geo: list of Mesh, tool_plane: Plane; same code as set_tool
pln_2 = Plane(set_tool_2.tool_plane)
preview = CustomPreview(Geometry=set_tool_2.tool_axes, Shader=set_tool_2.tool_axes_colors)
geo = Geometry(set_tool_2.tool_geo)
preview_2 = CustomPreview(Geometry=geo, Shader=ColourSwatch(SwatchColor=RGBA(100, 168, 178, 162)))

pln_3 = Plane(set_tool.tool_plane)
preview_3 = CustomPreview(Geometry=set_tool.tool_axes, Shader=set_tool.tool_axes_colors)
geo_2 = Geometry(set_tool.tool_geo)
preview_4 = CustomPreview(Geometry=geo_2, Shader=ColourSwatch(SwatchColor=RGBA(100, 168, 178, 162)))
select_tool = StreamFilter(Gate=int_2, Stream0=set_tool_2.tool, Stream1=set_tool.tool)
tool = Data(select_tool)
tool_2 = ClusterOutput(tool)

# ==== cluster Cluster_4
curve = ClusterInput()
end_points = EndPoints(Curve=curve)  # -> Start, End
merge = Merge(Data1=end_points.Start, Data2=end_points.End)
box = ClusterInput()
deconstruct = Deconstruct(Point=merge)  # -> XComponent, YComponent, ZComponent
point = Point(merge)

# ---- group: jaw bounding box
box_2 = Box(box)

# ----
sort_list = SortList(Keys=deconstruct.YComponent, ValuesValuesA=point)  # -> Keys, ValuesValuesA
deconstruct_brep = DeconstructBrep(Brep=box_2)  # -> Faces, Edges, Vertices
list_item = ListItem(List=sort_list.ValuesValuesA, Index=0, Wrap=True)  # -> Item, Item1
list_item_2 = ListItem(List=deconstruct_brep.Faces, Index=0, Wrap=True)  # -> Item, Item1, Item2
point_2 = Point(list_item.Item1)
point_3 = Point(list_item.Item)
brep_closest_point = BrepClosestPoint(Point=point_3, Brep=list_item_2.Item)  # -> Point, unitize(Normal), Distance
brep_closest_point_2 = BrepClosestPoint(Point=point_2, Brep=list_item_2.Item2)  # -> Point, unitize(Normal), Distance
vector = Vector("0,1,0")
point_4 = Point(brep_closest_point.Point)
vector_2pt = Vector2Pt(PointA=point_4, PointB=point_3, Unitize=False)  # -> unitize(Vector), Length
vector_2 = Vector("0,-1,0")
point_5 = Point(brep_closest_point_2.Point)
vector_2pt_2 = Vector2Pt(PointA=point_5, PointB=point_2, Unitize=False)  # -> unitize(Vector), Length
multiplication = Multiplication(A=vector_2pt_2.Vector, B=vector)
multiplication_2 = Multiplication(A=vector_2pt.Vector, B=vector_2)
multiplication_3 = Multiplication(A=brep_closest_point_2.Distance, B=multiplication)
line = Line(StartPoint=point_2, EndPoint=brep_closest_point_2.Point)
line_2 = Line(StartPoint=point_3, EndPoint=brep_closest_point.Point)
multiplication_4 = Multiplication(A=brep_closest_point.Distance, B=multiplication_2)
result = ClusterOutput(multiplication_3)
line_3 = ClusterOutput(line)
line_4 = ClusterOutput(line_2)
result_2 = ClusterOutput(multiplication_4)
