# Grasshopper definition plan_to_kuka_src.gh (Grasshopper 1.0.7)
# plug-ins: KUKA|prc - parametric robot control, karambaGH

# ---- group: bar diameter
number = Number("3.17")

# ----
# 1/4 inch OD rod, 3.175 mm radius
# rack start pt
# rack direction pt
# caliberated TCP value
# original TCP
# EE visual mesh
# EE visual mesh
# Y moving distance
# connect escape distance after printing
number_slider = Slider(52.512, range=0..100)
sine = Sine(Value=degrees(number_slider))
division = Division(A=number, B="2")
division_2 = Division(A=division, B=sine)
panel = Panel(division_2)
point = Point(Point(431.62, 408.76, 125.148736))
addition = Addition(A=division_2, B="1")
subtraction = Subtraction(A="52.33", B=Slider(10, range=0..10))
unit_z = UnitZ(Factor=addition)
unit_x = UnitX(Factor=subtraction)
addition_2 = Addition(A=unit_z, B=unit_x)
move = Move(Geometry=point, Motion=addition_2)  # -> Geometry, Transform
point_2 = Point(move.Geometry)
unit_x_2 = UnitX(Factor=1)
point_3 = Point(point_2)
move_2 = Move(Geometry=point_3, Motion=unit_x_2)  # -> Geometry, Transform
point_4 = Point(move_2.Geometry)

# ----
# table model in the origin
brep = Brep(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)

rhino_doc_dir = RhinoDocDir()  # -> rhino_doc_dir
# ---------- rhino_doc_dir: Python ----------
import scriptcontext as sc
from os import path

rhino_doc_dir = path.abspath(path.dirname(sc.doc.Path))
# ---------- end rhino_doc_dir ----------
point_5 = Point("600, 0, -14.23")

# ----
# bar rack
brep_2 = Brep(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)
point_6 = Point("431.62, 421.26, 131.61")

ghpython_script = GhPythonScript(x=rhino_doc_dir)  # -> out, a
# ---------- ghpython_script: Python ----------
import os

a = os.path.join(x, '..', '..', 
    'src\coop_assembly\data\models\kuka_kr6_r900\meshes\mit_arch_grasp_end_effector')
# ---------- end ghpython_script ----------
move_3 = Move(Geometry=brep, Motion=point_5)  # -> Geometry, Transform
ghpython_script_2 = GhPythonScript(
    file_dir=ghpython_script.a,
    collision_file_name="mit_arch_grasp_end_effector_collision.stl",
    virtual_file_name="mit_arch_grasp_end_effector_visual.stl")  # -> out, collision_mesh, virutal_mesh
# ---------- ghpython_script_2: Python ----------
import rhinoscriptsyntax as rs
import Rhino.Geometry.Plane as Plane
import Rhino.Geometry.Point3d as Point3d
import Rhino.Geometry.Vector3d as Vector3d
import Rhino.Geometry.Quaternion as Quat
import Grasshopper.DataTree as DataTree # Add, AddRange(list, GHPath(i, j))
import Grasshopper.Kernel.Data.GH_Path as GHPath
import System

from ghpythonlib.treehelpers import list_to_tree, tree_to_list

#import json
#from compas.geometry import Frame
#from compas_ghpython import draw_pipes, draw_frame

import compas
from compas.datastructures import Mesh
from compas_ghpython.artists import MeshArtist
import os

collision_fp = os.path.join(file_dir, 'collision', collision_file_name)
#virtual_fp = os.path.join(file_dir, 'visual', virtual_file_name)

collision_cp_mesh = Mesh.from_stl(collision_fp)
#virtual_cp_mesh = Mesh.from_stl(virtual_fp)

collision_mesh = MeshArtist(collision_cp_mesh).draw_mesh()
#virtual_mesh = MeshArtist(virtual_cp_mesh).draw_vertices()
# ---------- end ghpython_script_2 ----------
rhino_doc_dir_2 = RhinoDocDir()  # -> rhino_doc_dir; same code as rhino_doc_dir
panel_2 = Panel("reciprocal_sphere_quarter_regression-z__solution_20-12-07_11-25-49.json")

# ---- group: MIT grasp end effector
# visual model
mesh = Mesh([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])

# ----
mesh_2 = Mesh(ghpython_script_2.collision_mesh)
ghpython_script_3 = GhPythonScript(x=rhino_doc_dir_2)  # -> out, a
# ---------- ghpython_script_3: Python ----------
import os

a = os.path.abspath(os.path.join(x,"..","..","..","conmech"))
# ---------- end ghpython_script_3 ----------
mesh_3 = Mesh(mesh)
mesh_4 = Mesh(mesh_2)
panel_3 = Panel(ghpython_script_3.a)

# ----
# TCP Calibration Point
point_7 = Point(Point(-2.851003028, 1.035000463, 188.1551834))
point_8 = Point("0,0, 185.795")

ghpython_script_4 = GhPythonScript(
    conmech_dir=ghpython_script_3.a,
    save_dir="d:\code_ws\pb_ws\coop_assembly\tests",
    conmech_file_name="reciprocal_sphere_quarter_conmech_model.json",
    result_name=panel_2,
    limit_distance="1e-12")  # -> out, Model_out, fem_element_from_bar_id, sequence
# ---------- ghpython_script_4: Python ----------
import rhinoscriptsyntax as rs
import Rhino.Geometry.Plane as Plane
import Rhino.Geometry.Point3d as Point3d
import Rhino.Geometry.Vector3d as Vector3d
import Rhino.Geometry.Quaternion as Quat
import Grasshopper.DataTree as DataTree # Add, AddRange(list, GHPath(i, j))
import Grasshopper.Kernel.Data.GH_Path as GHPath
import System
from System.Collections.Generic import List

from ghpythonlib.treehelpers import list_to_tree, tree_to_list
import os
import json
##############################

import clr
# https://ironpython.net/documentation/dotnet/dotnet.html

clr.AddReferenceToFileAndPath("C:\Program Files\Rhino 6\Plug-ins\Karamba.gha")
clr.AddReferenceToFileAndPath("C:\Program Files\Rhino 6\Plug-ins\KarambaCommon.dll")

import feb # Karamba's C++ library (undocumented in the API)
import Karamba.Models.Model as Model
import Karamba.GHopper.Models.GH_Model as GH_Model
#
import Karamba
import Karamba.Elements.ModelTruss as Truss
from Karamba.Geometry import Point3, Line3, Vector3
from Karamba.CrossSections import CroSec
from Karamba.Supports import Support
from Karamba.Loads import Load
#
from Karamba.Utilities import MessageLogger, UnitsConversionFactories
import KarambaCommon
#
import System
from System import GC
from System.Collections.Generic import List

#####################################
# add path to conmech script folder
import os, sys 
sys.path.append(os.path.join(conmech_dir, "src", "pyconmech", "frame_analysis"))
#from io_base import Model
import io_base
import karamba_io
reload(io_base)
reload(karamba_io)
from karamba_io import KarambaModel
from io_base import LoadCase, GravityLoad

#####################################

with open(os.path.join(save_dir, 'test_data', conmech_file_name), 'r') as f:
    data = json.load(f)

print('{} | {}'.format(data["model_name"], data['generate_time']))
km = KarambaModel.from_data(data)
#lc = LoadCase.from_data(data['loadcases']['0'])

model = km.to_karamba(LoadCase(gravity_load=GravityLoad([0,0,-1])), limit_dist=limit_distance)

## calculate Th.I response
#logger = MessageLogger();
#k3d = KarambaCommon.Toolkit();
#max_disp = clr.Reference[List[float]]()
#out_g = clr.Reference[List[float]]()
#out_comp = clr.Reference[List[float]]()
#message = clr.Reference[str]()
#model = k3d.Algorithms.AnalyzeThI(model, max_disp, out_g, out_comp, message);
#
#ucf = UnitsConversionFactories.Conv();
#cm = ucf.cm();
#print "max disp: {} {}".format(cm.toUnit(max_disp.Value[0]), cm.unitB)
#
Model_out = Karamba.GHopper.Models.GH_Model(model);
#
#from Karamba.GHopper.CrossSections import GH_CrossSection
#a = List[GH_CrossSection]([GH_CrossSection(cs.to_karamba()) for cs in km.crosssecs])

fem_data = data['fem_element_from_bar_id']
fem_element_from_bar_id = DataTree[int]()
for i, es in fem_data.items():
    if int(i) >= 0:
        fem_element_from_bar_id.AddRange(es, GHPath(int(i)))

with open(os.path.join(save_dir, 'results', result_name), 'r') as f:
    rdata = json.load(f)

print('{}\n{}\n{}'.format(rdata["problem"], rdata['config'], rdata['write_time']))
sequence = [trans[1] for trans in rdata['stiffness_history']]
# ---------- end ghpython_script_4 ----------

# ---- group: caliberated TCP pt
point_9 = Point(point_7)

# ---- group: original visual TCP pt
point_10 = Point(point_7)

# ----
panel_4 = Panel(point_9)
panel_5 = Panel(point_10)
python_karamba_model_converter = PythonKarambaModelConverter(
    Model_in=ghpython_script_4.Model_out,
    Reference=["C:\Program Files\Rhino 6\Plug-ins\karambaCommon.dll", "C:\Program Files\Rhino 6\Plug-ins\karamba.gha"])  # -> out, flatten(Model_out)
# ---------- python_karamba_model_converter: Python usings ----------
using Karamba.Models;
using Karamba.GHopper.Models;
# ---------- python_karamba_model_converter: Python ----------
    var model = Model_in as Model;
    if (model == null) {
      throw new ArgumentException("The input in 'Model_in' is not of type karamba.Models.Model!");
    }

    Model_out = new GH_Model(model);

    Print("Everything OK");
# ---------- end python_karamba_model_converter ----------
disassemble_model_karamba3d = DisassembleModelKaramba3D(Model=python_karamba_model_converter.Model_out)  # -> Model, Point, Beam, Shell, Support, Load, Line, Mesh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
list_length = ListLength(List=disassemble_model_karamba3d.Beam)
panel_6 = Panel(ghpython_script_4.fem_element_from_bar_id)

# ----
# original tool tip
# caliberated TCP tip
# the eef frame in the URDF needs to be shifted accordingly!
point_11 = Point(point_9)
point_12 = Point(point_10)
vector_2pt = Vector2Pt(PointA=point_12, PointB=point_11, Unitize=False)  # -> Vector, Length
division_3 = Division(A=vector_2pt.Vector, B="1000")
division_4 = Division(A=point_11, B="1000")
panel_7 = Panel(division_3)
panel_8 = Panel(division_4)

number_slider_2 = Slider(19, range=0..19)
panel_9 = Panel(ghpython_script_4.sequence)
subtraction_2 = Subtraction(A=number_slider_2, B=1)
list_item = ListItem(List=panel_9, Index=subtraction_2, Wrap=False)
panel_10 = Panel(list_item)
panel_11 = Panel("cube.json_regression_solution.json")
text = Text(rhino_doc_dir)
ghpython_script_5 = GhPythonScript(x=text, y="reciprocal_sphere_quarter.json_regression_solution.json")  # -> out, a
# ---------- ghpython_script_5: Python ----------
import os

a = os.path.join(x, '..', '..', 
    'tests', 'results', y)
# ---------- end ghpython_script_5 ----------
ghpython_script_6 = GhPythonScript(result_file_path=ghpython_script_5.a, scale="1e3")  # -> out, elements
# ---------- ghpython_script_6: Python ----------
import rhinoscriptsyntax as rs
import Rhino.Geometry.Plane as Plane
import Rhino.Geometry.Point3d as Point3d
import Rhino.Geometry.Vector3d as Vector3d
import Rhino.Geometry.Quaternion as Quat
import Rhino.Geometry.Line as Line
import Rhino.Geometry.Transform as Transform
import Grasshopper.DataTree as DataTree # Add, AddRange(list, GHPath(i, j))
import Grasshopper.Kernel.Data.GH_Path as GHPath
import System

from ghpythonlib.treehelpers import list_to_tree, tree_to_list

import json
from compas.geometry import Frame
from compas.geometry import scale_points
from compas_ghpython import draw_pipes, draw_frame
from itertools import islice

######################################

def pose_from_frame(frame, scale=1.0):
    """Returns a PyBullet pose from a frame.
    Parameters
    ----------
    frame : :class:`compas.geometry.Frame`
    Returns
    -------
    point, quaternion : tuple
    """
    return ([v*scale for v in frame.point], frame.quaternion.xyzw)


def frame_from_pose(pose, scale=1.0):
    """Returns a frame from a PyBullet pose.
    Parameters
    ----------
    point, quaternion : tuple
    Returns
    -------
    :class:`compas.geometry.Frame`
    """
    point, (x, y, z, w) = pose
    return Frame.from_quaternion([w, x, y, z], point=[v*scale for v in point])

#########################################

with open(result_file_path) as json_file:
    data = json.load(json_file)

print('file_name: {}'.format(data['problem']))
try:
    print('write_time: {}'.format(data['write_time']))
except:
    pass

paths = DataTree[System.Double]()
ee_paths = DataTree[Plane]()
elements = DataTree[System.Int32]()
tags = DataTree[System.String]()
grasps = DataTree[Plane]()
for seq_id, e_trajs in enumerate(data['plan']):
    if seq_id == 0:
        del e_trajs[0]
    for sp_id, traj in enumerate(e_trajs):
        if traj['element'] is not None: 
            elements.Add(traj['element'], GHPath(seq_id, sp_id))
        else:
            elements.Add(-1000, GHPath(seq_id, sp_id))
# ---------- end ghpython_script_6 ----------
shift_paths = ShiftPaths(Data=ghpython_script_6.elements, Offset=-1)
list_item_2 = ListItem(List=shift_paths, Index=0, Wrap=True)  # -> flatten(Item)
split_list = SplitList(List=list_item_2, Index=number_slider_2)  # -> ListA, ListB
ghpython_script_7 = GhPythonScript(nE=list_length, bar_ids=split_list.ListA, fem_element_from_bar_id=ghpython_script_4.fem_element_from_bar_id)  # -> out, flatten(element_activation); inputs nE: Int32, bar_ids: list of Int32, fem_element_from_bar_id: tree of Int32
# ---------- ghpython_script_7: Python ----------
import rhinoscriptsyntax as rs
import Rhino.Geometry.Plane as Plane
import Rhino.Geometry.Point3d as Point3d
import Rhino.Geometry.Vector3d as Vector3d
import Rhino.Geometry.Quaternion as Quat
import Grasshopper.DataTree as DataTree # Add, AddRange(list, GHPath(i, j))
import Grasshopper.Kernel.Data.GH_Path as GHPath
import System

from ghpythonlib.treehelpers import list_to_tree, tree_to_list

fem_elements_from_bar = tree_to_list(fem_element_from_bar_id, lambda x:x)
#print fem_elements_from_bar
element_activation = [False for i in range(nE)]
for b in bar_ids:
    for e in fem_elements_from_bar[b]:
        element_activation[e] = True
# ---------- end ghpython_script_7 ----------
panel_12 = Panel(split_list.ListA)
element_activation_karamba3d = ElementActivationKaramba3D(Model=python_karamba_model_converter.Model_out, IsActive=ghpython_script_7.element_activation)
panel_13 = Panel(ghpython_script_7.element_activation)
analyze_karamba3d = AnalyzeKaramba3D(Model=element_activation_karamba3d)  # -> CalculatedModel, MaximumDisplacement_cm, ResultingForceOfGravity_kN, ElasticEnergy_kNm
eigen_modes_karamba3d = EigenModesKaramba3D(
    Model=analyze_karamba3d.CalculatedModel,
    FromIndex=Slider(1, range=1..50),
    NumberOfModes=1,
    MaximumNumberOfIterations=300,
    Epsilon=1e-07)  # -> ModelWithEigenModesAsLoadCaseResults, Eigenvalues
multiplication = Multiplication(A=analyze_karamba3d.MaximumDisplacement_cm, B=0.01)
panel_14 = Panel(eigen_modes_karamba3d.Eigenvalues)
panel_15 = Panel(multiplication)
model_view_karamba3d = ModelViewKaramba3D(Model=analyze_karamba3d.CalculatedModel, ResultFactors=1, ResultCase=-1)  # -> Model, DeformedMesh, DeformedAxes, DeformedModel
beam_view_karamba3d = BeamViewKaramba3D(Model=model_view_karamba3d.Model)  # -> Model, MeshesOfRenderedBeams, DeformedBeamAxes, LegendColors, LegendTags
panel_16 = Panel(ghpython_script_5.a)

# ----
# Open gripper IO command
panel_17 = Panel("""; open gripper
HALT
$OUT[2] = TRUE
$OUT[5] = FALSE
HALT""")  # disabled

# ----
# Close gripper IO command
panel_18 = Panel("""; close gripper
HALT
$OUT[2] = FALSE
$OUT[5] = TRUE
HALT""")  # disabled

kuka_prc_custom_krl = KUKAPrcCustomKRL(TextAsKRL=panel_18)  # disabled
kuka_prc_custom_krl_2 = KUKAPrcCustomKRL(TextAsKRL=panel_17)  # disabled
panel_19 = Panel("eef_tcp_frame")  # disabled
ghpython_script_8 = GhPythonScript(result_file_path=ghpython_script_5.a, ee_link_name=panel_19, scale="1e3")  # -> out, paths, ee_paths, elements, tags, grasps, axispts_from_index, radius, goal_poses; disabled
# ---------- ghpython_script_8: Python ----------
import rhinoscriptsyntax as rs
import Rhino.Geometry.Plane as Plane
import Rhino.Geometry.Point3d as Point3d
import Rhino.Geometry.Vector3d as Vector3d
import Rhino.Geometry.Quaternion as Quat
import Rhino.Geometry.Line as Line
import Rhino.Geometry.Transform as Transform
import Grasshopper.DataTree as DataTree # Add, AddRange(list, GHPath(i, j))
import Grasshopper.Kernel.Data.GH_Path as GHPath
import System

from ghpythonlib.treehelpers import list_to_tree, tree_to_list

import json
from compas.geometry import Frame
from compas.geometry import scale_points
from compas_ghpython import draw_pipes, draw_frame
from itertools import islice

######################################

def pose_from_frame(frame, scale=1.0):
    """Returns a PyBullet pose from a frame.
    Parameters
    ----------
    frame : :class:`compas.geometry.Frame`
    Returns
    -------
    point, quaternion : tuple
    """
    return ([v*scale for v in frame.point], frame.quaternion.xyzw)


def frame_from_pose(pose, scale=1.0):
    """Returns a frame from a PyBullet pose.
    Parameters
    ----------
    point, quaternion : tuple
    Returns
    -------
    :class:`compas.geometry.Frame`
    """
    point, (x, y, z, w) = pose
    return Frame.from_quaternion([w, x, y, z], point=[v*scale for v in point])

#########################################

with open(result_file_path) as json_file:
    data = json.load(json_file)

print('file_name: {}'.format(data['problem']))
try:
    print('write_time: {}'.format(data['write_time']))
except:
    pass

paths = DataTree[System.Double]()
ee_paths = DataTree[Plane]()
elements = DataTree[System.Int32]()
tags = DataTree[System.String]()
grasps = DataTree[Plane]()
for seq_id, e_trajs in enumerate(data['plan']):
    if seq_id == 0:
        del e_trajs[0]
    for sp_id, traj in enumerate(e_trajs):
        path = traj['path']
        epath = traj['link_path'][ee_link_name]
        for t_id, (conf, epose) in enumerate(zip(path, epath)):
            conf = [float(v) for v in conf]
            paths.AddRange(conf, GHPath(seq_id, sp_id, t_id))
            ee_paths.Add(draw_frame(frame_from_pose(epose, scale)), GHPath(seq_id, sp_id, t_id))
            
        if traj['element'] is not None: 
            elements.Add(traj['element'], GHPath(seq_id, sp_id))
        else:
            elements.Add(-1000, GHPath(seq_id, sp_id))
        tags.Add(traj['tag'], GHPath(seq_id, sp_id))
        
        for attach_data in traj['attachments']:
            g_frame = frame_from_pose(attach_data['grasp_pose'], scale=scale)
            grasps.Add(draw_frame(g_frame), GHPath(seq_id, sp_id))
            
            
axispts_from_index = DataTree[Point3d]()
radius = DataTree[System.Double]()
goal_poses = DataTree[Plane]()
for e_id, edata in data['element_from_index'].items():
    radius.Add(edata['radius']*scale, GHPath(int(e_id)))
    
    goal_frame = frame_from_pose(edata['goal_pose']['value'], scale=scale)
    goal_poses.Add(draw_frame(goal_frame), GHPath(int(e_id)))
    
    scaled_pts = scale_points(edata['axis_endpoints'], scale)
    for i in range(2):
        axispts_from_index.Add(Point3d(*scaled_pts[i]), GHPath(int(e_id)))
# ---------- end ghpython_script_8 ----------
panel_20 = Panel(ghpython_script_8.out)  # disabled
panel_21 = Panel("""{*;0}
{*;1}
{*;2}
{*;3}""")  # disabled
plane = Plane(ghpython_script_8.goal_poses)  # disabled
number_2 = Number(ghpython_script_8.radius)  # disabled
point_13 = Point(ghpython_script_8.axispts_from_index)  # disabled
panel_22 = Panel(ghpython_script_8.tags)  # disabled
list_item_3 = ListItem(List=panel_21, Index=0, Wrap=True)  # -> Item, Item1, Item2, Item3; disabled
list_item_4 = ListItem(List=point_13, Index=0, Wrap=True)  # -> Item, Item1; disabled
shift_paths_2 = ShiftPaths(Data=ghpython_script_8.paths, Offset=-1)  # disabled

# ---- group: ee_path
plane_2 = Plane(ghpython_script_8.ee_paths)  # disabled

# ---- group: grasp, indexed in seq_id
plane_3 = Plane(ghpython_script_8.grasps)  # disabled

# ----
line = Line(StartPoint=list_item_4.Item, EndPoint=list_item_4.Item1)  # disabled
panel_23 = Panel(shift_paths_2)  # disabled
split_tree = SplitTree(Data=shift_paths_2, Masks=flatten(list_item_3.Item2))  # -> Positive, Negative; disabled
split_tree_2 = SplitTree(Data=shift_paths_2, Masks=flatten(list_item_3.Item1))  # -> Positive, Negative; disabled
shift_paths_3 = ShiftPaths(Data=plane_3, Offset=-1)  # disabled
xy_plane = XYPlane(Origin=Point(0, 0, 0))  # disabled
shift_paths_4 = ShiftPaths(Data=plane_2, Offset=-1)  # disabled
panel_24 = Panel("""{*;0}
{*;1}""")  # disabled
split_tree_3 = SplitTree(Data=shift_paths_2, Masks=flatten(list_item_3.Item))  # -> Positive, Negative; disabled
split_tree_4 = SplitTree(Data=shift_paths_2, Masks=flatten(list_item_3.Item3))  # -> Positive, Negative; disabled
length = Length(Curve=line)  # disabled
pipe = Pipe(Curve=line, Radius=number_2, Caps=0)  # disabled
transition_joint_speed = Slider(100, range=0..100)  # disabled
tree_statistics = TreeStatistics(Tree=shift_paths_3)  # -> Paths, Length, Count; disabled
panel_25 = Panel("6")  # disabled
split_tree_5 = SplitTree(Data=shift_paths_4, Masks=flatten(panel_24))  # -> Positive, Negative; disabled
orient = Orient(Geometry=line, Source=plane, Target=xy_plane)  # -> Geometry, Transform; disabled
partition_list = PartitionList(List=split_tree.Positive, Size=panel_25)  # disabled
partition_list_2 = PartitionList(List=split_tree_4.Positive, Size=panel_25)  # disabled
partition_list_3 = PartitionList(List=split_tree_2.Positive, Size=panel_25)  # disabled
partition_list_4 = PartitionList(List=split_tree_3.Positive, Size=panel_25)  # disabled
number_3 = Number()  # disabled
number_4 = Number()  # disabled
number_5 = Number(partition_list_3)  # disabled
number_6 = Number(partition_list)  # disabled
shift_paths_5 = ShiftPaths(Data=split_tree_5.Positive, Offset=-1)  # disabled
number_7 = Number(partition_list_4)  # disabled
number_8 = Number(partition_list_2)  # disabled
panel_26 = Panel("; element #")  # disabled
cluster = Cluster(radians=number_7, speed=transition_joint_speed)  # disabled
cluster_2 = Cluster(radians=number_4, speed=transition_joint_speed)  # disabled
cluster_3 = Cluster(radians=number_8, speed=transition_joint_speed)  # disabled
cluster_4 = Cluster(radians=number_6, speed=transition_joint_speed)  # disabled
integer = Integer(ghpython_script_8.elements)  # disabled
shift_paths_6 = ShiftPaths(Data=integer, Offset=-1)  # disabled
list_item_5 = ListItem(List=shift_paths_6, Index=0, Wrap=True)  # disabled
cluster_5 = Cluster(radians=number_3, speed=transition_joint_speed)  # disabled
text_2 = Text(ghpython_script_8.tags)  # disabled
cluster_6 = Cluster(radians=number_5, speed=transition_joint_speed)  # disabled
unit_x_3 = UnitX(Factor=1)  # disabled
unit_y = UnitY(Factor=1)  # disabled

# ---- group: bar at origin
geometry = Geometry(orient.Geometry)  # disabled

# ----
concatenate = Concatenate(Fragment_A=panel_26, Fragment_B=integer, A=", ", B=text_2)  # disabled

# ---- group: bar base
xy_plane_2 = XYPlane(Origin=Point(0, 0, 0))  # disabled

# ----
negative = Negative(Value=unit_x_3)  # disabled
negative_2 = Negative(Value=unit_y)  # disabled

# ---- group: transfer
kuka_prc_command = KUKAPrcCommand(cluster)  # disabled

# ---- group: pick approach
kuka_prc_command_2 = KUKAPrcCommand(cluster_2)  # disabled

# ---- group: close gripper IO
kuka_prc_command_3 = KUKAPrcCommand(kuka_prc_custom_krl)  # disabled

# ---- group: open gripper IO
kuka_prc_command_4 = KUKAPrcCommand(kuka_prc_custom_krl_2)  # disabled

# ---- group: pick retreat
kuka_prc_command_5 = KUKAPrcCommand(cluster_5)  # disabled

# ---- group: place approach
kuka_prc_command_6 = KUKAPrcCommand(cluster_6)  # disabled

# ---- group: place retreat
kuka_prc_command_7 = KUKAPrcCommand(cluster_4)  # disabled

# ---- group: transit
kuka_prc_command_8 = KUKAPrcCommand(cluster_3)  # disabled

# ----
kuka_prc_custom_krl_3 = KUKAPrcCustomKRL(TextAsKRL=concatenate)  # disabled
panel_27 = Panel(kuka_prc_command)  # disabled
cluster_7 = Cluster_2(list=cluster_6, list_b=kuka_prc_command_4)  # disabled
cluster_8 = Cluster_2(list=kuka_prc_command, list_b=kuka_prc_command_3)  # disabled
merge = Merge(
    Data1=cluster_8,
    Data2=kuka_prc_command,
    Data6=kuka_prc_command_6,
    Data7=cluster_7,
    Data8=kuka_prc_command_7,
    Data9=kuka_prc_command_8)  # disabled
number_slider_3 = Slider(0.7411, range=0..1)  # disabled
kuka_prc_command_9 = KUKAPrcCommand(merge)  # disabled
panel_28 = Panel("2")  # disabled
jaw = Panel("40")  # disabled
division_5 = Division(A=jaw, B=panel_28)  # disabled
merge_2 = Merge(Data1=kuka_prc_custom_krl_3, Data2=kuka_prc_command_9)  # disabled
tree_statistics_2 = TreeStatistics(Tree=merge_2)  # -> Paths, Length, Count; disabled
brep_3 = Brep(simplify(pipe))  # disabled
panel_29 = Panel(tree_statistics_2.Paths)  # disabled
shift_paths_7 = ShiftPaths(Data=merge_2, Offset=-1)  # disabled
tree_statistics_3 = TreeStatistics(Tree=shift_paths_7)  # -> Paths, Length, Count; disabled
kuka_prc_command_10 = KUKAPrcCommand(flatten(shift_paths_7))  # disabled
kuka_prc_command_11 = KUKAPrcCommand(kuka_prc_custom_krl_2)  # disabled
merge_3 = Merge(Data1=kuka_prc_command_11, Data2=kuka_prc_command_10)  # disabled
number_9 = Number(division_5)  # disabled

# ---- group: seq_id : beam_id
integer_2 = Integer(list_item_5)  # disabled

# ---- group: bar sequence
integer_3 = Integer(flatten(integer_2))  # disabled

# ----
replace_paths = ReplacePaths(Data=shift_paths_3, Search=tree_statistics.Paths, Replace=integer_3)  # disabled
list_item_6 = ListItem(List=replace_paths, Index=0, Wrap=True)  # disabled
orient_2 = Orient(Geometry=list_item_6, Source=xy_plane_2, Target=shift_paths_5)  # -> Geometry, Transform; disabled
orient_3 = Orient(Geometry=geometry, Source=xy_plane_2, Target=orient_2.Geometry)  # -> Geometry, Transform; disabled

# ---- group: tool_from_bar
orient_4 = Orient(Geometry=geometry, Source=xy_plane_2, Target=list_item_6)  # -> Geometry, Transform; disabled

# ---- group: bar sequence
integer_4 = Integer(integer_2)  # disabled

# ----
number_10 = Number(flatten(length))  # disabled
integer_5 = Integer(flatten(integer_2))  # disabled
number_slider_4 = Slider(8, range=0..9)  # disabled
list_item_7 = ListItem(List=number_10, Index=integer_5, Wrap=True)  # disabled
sort_list = SortList(Keys=integer_5)  # -> Keys, ValuesValuesA; disabled
beam_id_bar_length_in_mil = Panel(number_10)  # disabled
element_id = Panel(sort_list.Keys)  # disabled

# ----
# Robot Model
# End effector setup
kuka_agilus_kr6_kr10_r900 = KUKAAgilusKR6KR10R900(highresactive=False, infiniterot=False)
point_14 = Point("-0.002851003, 0.001035, 0.188155183")

multiplication_2 = Multiplication(A=point_14, B=1000)

# ---- group: tool link
point_15 = Point(multiplication_2)  # disabled

# ----
construct_plane = ConstructPlane(Origin=point_15, XAxis=negative, YAxis=negative_2)  # disabled
xy_plane_3 = XYPlane(Origin=point_15)  # disabled
orient_5 = Orient(Geometry=orient_4.Geometry, Source=xy_plane_2, Target=xy_plane_3)  # -> Geometry, Transform; disabled
end_points = EndPoints(Curve=orient_5.Geometry)  # -> Start, End; disabled

# ---- group: indexed by bar ids
number_11 = Number(number_2)  # disabled
curve = Curve(orient_5.Geometry)  # disabled

# ---- group: left point
merge_4 = Merge(Data1=end_points.Start, Data2=end_points.End)  # disabled
deconstruct = Deconstruct(Point=merge_4)  # -> XComponent, YComponent, ZComponent; disabled
point_16 = Point(merge_4)  # disabled
sort_list_2 = SortList(Keys=deconstruct.YComponent, ValuesValuesA=point_16)  # -> Keys, ValuesValuesA; disabled
list_item_8 = ListItem(List=sort_list_2.ValuesValuesA, Index=0, Wrap=True)  # -> Item, Item1; disabled

# ----
point_17 = Point(list_item_8.Item)  # disabled
point_18 = Point(point_15)  # disabled
distance = Distance(PointA=list_item_8.Item, PointB=point_18)  # disabled
distance_2 = Distance(PointA=list_item_8.Item1, PointB=point_18)  # disabled
subtraction_3 = Subtraction(A=distance_2, B=number_9)  # disabled
subtraction_4 = Subtraction(A=distance, B=number_9)  # disabled
number_12 = Number(flatten(subtraction_4))  # disabled
jaw_right_length = Panel(subtraction_3)  # disabled
list_item_9 = ListItem(List=number_12, Index=integer_5, Wrap=True)  # disabled

# ----
# Handcutting instruction!
seq_id_bar_length_in_mil = Panel(list_item_7)  # disabled
seq_id_jaw_left_length = Panel(list_item_9)  # disabled
seq_id_element_id = Panel(integer_5)  # disabled

beam_id_beam_left_length = Panel(number_12)  # disabled

number_slider_5 = Slider(3, range=0..3)  # disabled
bar_seq_id = Slider(1, range=0..20)  # disabled
panel_30 = Panel("*")  # disabled
concatenate_2 = Concatenate(Fragment_A="{", Fragment_B=bar_seq_id, A=";", C=panel_30, B="}")  # disabled
construct_path = ConstructPath(Indices=graft(bar_seq_id))  # -> flatten(Branch); disabled
split_tree_6 = SplitTree(Data=shift_paths_7, Masks=flatten(construct_path))  # -> Positive, Negative; disabled

addition_3 = Addition(A=bar_seq_id, B=1)  # disabled
split_list_2 = SplitList(List=flatten(tree_statistics_3.Paths), Index=addition_3)  # -> simplify(graft(ListA)), ListB; disabled
split_list_3 = SplitList(List=flatten(integer_4), Index=addition_3)  # -> simplify(graft(ListA)), ListB; disabled
construct_path_2 = ConstructPath(Indices=split_list_3.ListA)  # -> flatten(Branch); disabled
tree_branch = TreeBranch(Tree=integer_4, Path=construct_path, MaintainPaths=True)  # disabled

data_path = DataPath(split_list_2.ListB)  # disabled

split_tree_7 = SplitTree(Data=brep_3, Masks=flatten(construct_path_2))  # -> Positive, Negative; disabled
construct_path_3 = ConstructPath(Indices=tree_branch)  # disabled
split_tree_8 = SplitTree(Data=number_11, Masks=flatten(construct_path))  # -> Positive, Negative; disabled
brep_4 = Brep(split_tree_7.Positive)  # disabled
split_tree_9 = SplitTree(Data=curve, Masks=flatten(construct_path_3))  # -> Positive, Negative; disabled
pipe_2 = Pipe(Curve=split_tree_9.Positive, Radius=split_tree_8.Positive, Caps=0)  # disabled
geometry_2 = Geometry(pipe_2)
mesh_brep = MeshBrep(
    Brep=geometry_2,
    Settings={GridMaxCount=0, GridMinCount=16, JaggedSeams=False, MaxEdgeLength=0, MinEdgeLength=0.0001, MinTolerance=0, Refine=True, RefineAngle=0, RelativeTolerance=0.65, SimplePlanes=True, Tolerance=0})

use_collision_ee_model = BooleanToggle(False)  # disabled

stream_filter = StreamFilter(Gate=use_collision_ee_model, Stream0=mesh_3, Stream1=mesh_4)

merge_5 = Merge(Data1=stream_filter, Data2=mesh_brep)  # -> flatten(Result)

mesh_join = MeshJoin(Meshes=merge_5)
move_4 = Move(Geometry=mesh_join, Motion=vector_2pt.Vector)  # -> Geometry, Transform
custom_tool_for_kuka_prc = CustomToolForKUKAPrc(
    CustomToolGeometry=move_4.Geometry,
    toolid=6,
    toolvala=0,
    toolvalb=0,
    toolvalc=0,
    toolvalx=-2.85,
    toolvaly=1.035,
    toolvalz=188.155,
    valuesset=True)

# ---- group: gripper mesh at the origin
mesh_5 = Mesh(mesh_join)  # disabled

# ----
kuka_prc_core = KUKAPrcCORE(
    SimulationSlider=number_slider_3,
    KUKAPrcCommands=merge_3,
    KUKAPrcTool=custom_tool_for_kuka_prc,
    KUKAPrcRobot=kuka_agilus_kr6_kr10_r900,
    LINstartspeed=0.1,
    PRC_SaveNameExpose=False,
    PTPstartspeed=5,
    acc_cp=nan,
    acc_ptp=-1,
    basea=0,
    baseb=0,
    basec=0,
    baseindex=0,
    basex=0,
    basey=0,
    basez=0,
    camrobformatting="""&ACCESS RVP
&REL 1
&PARAM TEMPLATE = C:\KRC\Roboter\Template\vorgabe
&PARAM EDITMASK = *
[PROJECTNAME]

[SPLITDEFS]

;FOLD INI
;FOLD BASISTECH INI
GLOBAL INTERRUPT DECL 3 WHEN $STOPMESS==TRUE DO IR_STOPM ( )
INTERRUPT ON 3
BAS (#INITMOV,0 )
;ENDFOLD (BASISTECH INI)
;ENDFOLD (INI)

[STARTAXPOS]

[SETPARAMETERS]

[COMMANDS]

END""",
    camrobon=False,
    checkallcolls=False,
    enda01=5,
    enda02=-90,
    enda03=100,
    enda04=5,
    enda05=10,
    enda06=-5,
    ende01=0,
    ende02=0,
    ende03=0,
    ende04=0,
    endindex=0,
    haltatend=True,
    hash=11854,
    initialstatus="110",
    int_advance=-1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)  # -> simplify(RobotGeometry), AnalysisOutput; disabled

list_item_10 = ListItem(List=kuka_prc_core.RobotGeometry, Index=number_slider_4, Wrap=True)  # disabled

# ==== cluster Cluster
radians = ClusterInput()
degrees = Degrees(Radians=radians)
list_item = ListItem(List=degrees, Index=0, Wrap=True)  # -> Item, Item1, Item2, Item3, Item4, Item5
speed = ClusterInput()
kuka_prc_axis_movement = KUKAPrcAXISMovement(
    Axis1=list_item.Item,
    Axis2=list_item.Item1,
    Axis3=list_item.Item2,
    Axis4=list_item.Item3,
    Axis5=list_item.Item4,
    Axis6=list_item.Item5,
    Speed=speed,
    extaxenabled=False,
    impedancemode=False,
    interpolation="C_PTP")
shift_paths = ShiftPaths(Data=kuka_prc_axis_movement, Offset=-1)
data = ClusterOutput(shift_paths)

# ==== cluster Cluster_2
list = ClusterInput()
list_item = ListItem(List=list, Index=0, Wrap=True)
list_b = ClusterInput()
longest_list = LongestList(ListListA=list_item, ListListB=list_b, PaddingMode=2)  # -> ListListA, ListListB
list_b_2 = ClusterOutput(longest_list.ListListB)
