# Grasshopper definition LineAt_to_LineAt.gh (Grasshopper 1.0.7)
# plug-ins: Kangaroo2 Components

line = Line(Line((-16.00890965, 0.3587430735, 0), (-3.094159009, -3.946173808, 0)))
line_2 = Line(Line((-14.21519429, -4.843031492, 0), (-8.654676647, 7.443918774, 0)))
length_line = LengthLine(Line=[line_2, line], Strength=10)
lineline = CSharpScript(
    L1=line_2,
    L2=line,
    T1=Slider(0.5, range=0..1),
    T2=Slider(0.1, range=0..1),
    Strength=1,
    Reference="C:\Program Files\Rhino 6\Plug-ins\Grasshopper\Components\KangarooSolver.dll")  # -> out, A; inputs L1: Line, L2: Line, T1: Double, T2: Double, Strength: Double
# ---------- lineline: C# usings ----------
using System.IO;
using System.Linq;
using System.Data;
using System.Drawing;
using System.Reflection;
using System.Windows.Forms;
using System.Xml;
using System.Xml.Linq;
using System.Runtime.InteropServices;

using Rhino.DocObjects;
using Rhino.Collections;
using GH_IO;
using GH_IO.Serialization;
using KangarooSolver;
using KangarooSolver.Goals;
# ---------- lineline: C# ----------
    A = new LineAt_LineAt(L1, L2, T1, T2, Strength);
# ---------- lineline: C# additional code ----------
  public class LineAt_LineAt : GoalObject
  {
    public double Strength;
    public double t1,t2;

    public LineAt_LineAt(Line L1, Line L2, double t1, double t2, double k)
    {
      Strength = k;

      PPos = new Point3d[4]{L1.From, L1.To, L2.From, L2.To};
      Move = new Vector3d[4];
      Weighting = new double[4]{k,k,k,k};

      this.t1 = t1;
      this.t2 = t2;
    }

    public override void Calculate(List < KangarooSolver.Particle > p)
    {
      var L1 = new Line(p[PIndex[0]].Position, p[PIndex[1]].Position);
      var L2 = new Line(p[PIndex[2]].Position, p[PIndex[3]].Position);

      Vector3d pull = L2.PointAt(t2) - L1.PointAt(t1);
      Move[0] = (1 - t1) * pull;
      Move[1] = (t1) *pull;

      Move[2] = (1 - t2) * -pull;
      Move[3] = (t2) *-pull;
    }
  }
# ---------- end lineline ----------
grab = Grab(On=True, Strength=1, Range=3)
solver = Solver(GoalObjects=[lineline.A, length_line, grab], Reset=Button(), Threshold=1e-15, Tolerance=0.01, On=True)  # -> I, V, O
crv = Curve(solver.O)
dot = DotDisplay(Point=solver.V)
