# Grasshopper definition ReciprocalK2.gh (Grasshopper 1.0.7)
# plug-ins: Kangaroo Components, Weaverbird, Kangaroo2 Components

weaverbird_s_mesh_mesh_icosahedron = WeaverbirdsMeshMeshIcosahedron(Plane=PlaneXY(0, 0, 0), Radius=12)
weaverbird_s_loop_subdivision = WeaverbirdsLoopSubdivision(MeshCurves=weaverbird_s_mesh_mesh_icosahedron, Level=1, SmoothNakedEdges=1)
mesh_edges = MeshEdges(Mesh=weaverbird_s_loop_subdivision)  # -> NakedEdges, InteriorEdges, NonManifoldEdges
reciprocal = Reciprocal(Mesh=weaverbird_s_loop_subdivision, Angle=Slider(0.141, range=0..2), Scale=Slider(1.186, range=1..2))  # -> Lines, A, B
number_slider = Slider(0.186, range=0..1)
length_line = LengthLine(Line=reciprocal.Lines, Strength=10)
end_points = EndPoints(Curve=reciprocal.Lines)  # -> Start, End
list_item = ListItem(List=reciprocal.Lines, Index=reciprocal.A, Wrap=True)
list_item_2 = ListItem(List=reciprocal.Lines, Index=reciprocal.B, Wrap=True)
lineline = CSharpScript(
    L1=list_item,
    L2=list_item_2,
    R1=number_slider,
    R2=number_slider,
    Strength=1,
    Reference="C:\Program Files\Rhino 6\Plug-ins\Grasshopper\Components\KangarooSolver.dll")  # -> out, A; inputs L1: Line, L2: Line, R1: Double, R2: Double, Strength: Double
# ---------- lineline: C# usings ----------
using System.IO;
using System.Linq;
using System.Data;
using System.Drawing;
using System.Reflection;
using System.Windows.Forms;
using System.Xml;
using System.Xml.Linq;
using System.Runtime.InteropServices;

using Rhino.DocObjects;
using Rhino.Collections;
using GH_IO;
using GH_IO.Serialization;
using KPlankton;
using KangarooSolver;
using KangarooSolver.Goals;
# ---------- lineline: C# ----------
    A = new LineLine(L1, L2, R1, R2, Strength);
# ---------- lineline: C# additional code ----------
  public class LineLine : GoalObject
  {
    public double Strength;
    public double R1,R2;

    public LineLine(Line L1, Line L2, double r1, double r2, double k)
    {
      Strength = k;

      PPos = new Point3d[4]{L1.From, L1.To, L2.From, L2.To};
      Move = new Vector3d[4];
      Weighting = new double[4]{k,k,k,k};

      R1 = r1;
      R2 = r2;
    }

    public override void Calculate(List < KangarooSolver.Particle > p)
    {
      var L1 = new Line(p[PIndex[0]].Position, p[PIndex[1]].Position);
      var L2 = new Line(p[PIndex[2]].Position, p[PIndex[3]].Position);

      Vector3d u = L1.To - L1.From;
      Vector3d v = L2.To - L2.From;
      Vector3d w = L1.From - L2.From;
      double a = u * u;
      double b = u * v;
      double c = v * v;
      double d = u * w;
      double e = v * w;
      double D = a * c - b * b;
      double sc, sN, sD = D;
      double tc, tN, tD = D;

      // compute the line parameters of the two closest points
      if (D < 1e-8) {     // the lines are almost parallel
        sN = 0.0;         // force using point P0 on segment S1
        sD = 1.0;         // to prevent possible division by 0.0 later
        tN = e;
        tD = c;
      }
      else
      {
        sN = b * e - c * d;
        tN = a * e - b * d;

        if (sN < 0.0) {        // sc < 0 => the s=0 edge is visible
          sN = 0.0;
          tN = e;
          tD = c;
        }
        else if (sN > sD) {  // sc > 1  => the s=1 edge is visible
          sN = sD;
          tN = e + b;
          tD = c;
        }
      }

      if (tN < 0.0)
      {            // tc < 0 => the t=0 edge is visible
        tN = 0.0;
        // recompute sc for this edge
        if (-d < 0.0)
          sN = 0.0;
        else if (-d > a)
          sN = sD;
        else {
          sN = -d;
          sD = a;
        }
      }
      else if (tN > tD)
      {      // tc > 1  => the t=1 edge is visible
        tN = tD;
        // recompute sc for this edge
        if ((-d + b) < 0.0)
          sN = 0;
        else if ((-d + b) > a)
          sN = sD;
        else {
          sN = (-d + b);
          sD = a;
        }
      }

      // finally do the division to get sc and tc
      sc = (Math.Abs(sN) < 1e-8 ? 0.0 : sN / sD);
      tc = (Math.Abs(tN) < 1e-8 ? 0.0 : tN / tD);

      // get the difference of the two closest points
      Vector3d dP = w + (sc * u) - (tc * v);  // =  S1(sc) - S2(tc)

      {
        var Separation = -dP;
        var Overlap = R1 + R2 - Separation.Length;
        if(Overlap > 0)
        {
          Separation.Unitize();
          var Push = Separation * Overlap;

          Move[0] = (1 - sc) * -Push;
          Move[1] = (sc) *-Push;

          Move[2] = (1 - tc) * Push;
          Move[3] = (tc) *Push;

          Weighting[0] = Weighting[1] = Weighting[2] = Weighting[3] = Strength;
        }
        else
        {
          Move[0] = Move[1] = Move[2] = Move[3] = Vector3d.Zero;
          Weighting[0] = Weighting[1] = Weighting[2] = Weighting[3] = 0;
        }
      }
    }
  }
# ---------- end lineline ----------
anchor = Anchor(Point=[end_points.Start, end_points.End], Strength=0.01)
solver = Solver(GoalObjects=[lineline.A, length_line, anchor], Reset=Button(), Threshold=1e-15, Tolerance=0.01, On=Toggle(True))  # -> I, V, O
pipe = Pipe(Curve=solver.O, Radius=number_slider, Caps=0)  # -> flatten(Pipe)
colourful = Colourful(geo=pipe)

# ==== cluster Colourful: Display objects in bright colours
geo = ClusterInput()
geo_2 = Geometry(geo)
clean = CleanTree(RemoveNulls=True, RemoveInvalid=True, RemoveEmpty=False, Tree=flatten(geo_2))
S = Shader([{diffuse=RGB(11, 125, 222), emission=RGB(3, 38, 67), shine=0.5, specular=RGB(255, 255, 255), transparency=0}, {diffuse=RGB(222, 37, 11), emission=RGB(67, 11, 3), shine=0.5, specular=RGB(255, 255, 255), transparency=0}, {diffuse=RGB(71, 222, 11), emission=RGB(21, 67, 3), shine=0.5, specular=RGB(255, 255, 255), transparency=0}, {diffuse=RGB(222, 194, 11), emission=RGB(67, 58, 3), shine=0.5, specular=RGB(255, 255, 255), transparency=0}])
lng = ListLength(List=clean)
repeat = RepeatData(Data=S, Length=lng)
preview = CustomPreview(Geometry=clean, Shader=repeat)
