# Grasshopper definition ReciprocalK2_DEV.gh (Grasshopper 1.0.7)
# plug-ins: Kangaroo Components, Weaverbird, Kangaroo2 Components

weaverbird_s_mesh_mesh_icosahedron = WeaverbirdsMeshMeshIcosahedron(Plane=PlaneXY(0, 0, 0), Radius=Slider(200, range=0..1000))
xy_plane = XYPlane(Origin=Point(0, 0, 0))
weaverbird_s_loop_subdivision = WeaverbirdsLoopSubdivision(MeshCurves=weaverbird_s_mesh_mesh_icosahedron, Level=1, SmoothNakedEdges=1)
mesh_split_plane = MeshSplitPlane(Mesh=weaverbird_s_loop_subdivision, Plane=xy_plane)  # -> Above, Below
mesh = Mesh(mesh_split_plane.Above)
reciprocal = Reciprocal(Mesh=mesh, Angle=Slider(0.338, range=0..2), Scale=Slider(1.166, range=1..2))  # -> Lines, A, B
length = Length(Curve=reciprocal.Lines)
number_slider = Slider(3.1, range=0..10)
number_slider_2 = Slider(1, range=0..1)
length_line = LengthLine(Line=reciprocal.Lines, Strength=10)
end_points = EndPoints(Curve=reciprocal.Lines)  # -> Start, End
list_item = ListItem(List=reciprocal.Lines, Index=reciprocal.A, Wrap=True)
list_item_2 = ListItem(List=reciprocal.Lines, Index=reciprocal.B, Wrap=True)
panel = Panel(length)
lineline = CSharpScript(
    L1=list_item,
    L2=list_item_2,
    R1=number_slider,
    R2=number_slider,
    Strength=1,
    Reference="C:\Program Files\Rhino 6\Plug-ins\Grasshopper\Components\KangarooSolver.dll")  # -> out, A; inputs L1: Line, L2: Line, R1: Double, R2: Double, Strength: Double
# ---------- lineline: C# ----------
    A = new LineLine(L1, L2, R1, R2, Strength);
# ---------- lineline: C# additional code ----------
  public class LineLine : GoalObject
  {
    public double Strength;
    public double R1,R2;

    public LineLine(Line L1, Line L2, double r1, double r2, double k)
    {
      Strength = k;

      PPos = new Point3d[4]{L1.From, L1.To, L2.From, L2.To};
      Move = new Vector3d[4];
      Weighting = new double[4]{k,k,k,k};

      R1 = r1;
      R2 = r2;
    }

    public override void Calculate(List < KangarooSolver.Particle > p)
    {
      var L1 = new Line(p[PIndex[0]].Position, p[PIndex[1]].Position);
      var L2 = new Line(p[PIndex[2]].Position, p[PIndex[3]].Position);

      Vector3d u = L1.To - L1.From;
      Vector3d v = L2.To - L2.From;
      Vector3d w = L1.From - L2.From;
      double a = u * u;
      double b = u * v;
      double c = v * v;
      double d = u * w;
      double e = v * w;
      double D = a * c - b * b;
      double sc, sN, sD = D;
      double tc, tN, tD = D;

      // compute the line parameters of the two closest points
      if (D < 1e-8) {     // the lines are almost parallel
        sN = 0.0;         // force using point P0 on segment S1
        sD = 1.0;         // to prevent possible division by 0.0 later
        tN = e;
        tD = c;
      }
      else
      {
        sN = b * e - c * d;
        tN = a * e - b * d;

        if (sN < 0.0) {        // sc < 0 => the s=0 edge is visible
          sN = 0.0;
          tN = e;
          tD = c;
        }
        else if (sN > sD) {  // sc > 1  => the s=1 edge is visible
          sN = sD;
          tN = e + b;
          tD = c;
        }
      }

      if (tN < 0.0)
      {            // tc < 0 => the t=0 edge is visible
        tN = 0.0;
        // recompute sc for this edge
        if (-d < 0.0)
          sN = 0.0;
        else if (-d > a)
          sN = sD;
        else {
          sN = -d;
          sD = a;
        }
      }
      else if (tN > tD)
      {      // tc > 1  => the t=1 edge is visible
        tN = tD;
        // recompute sc for this edge
        if ((-d + b) < 0.0)
          sN = 0;
        else if ((-d + b) > a)
          sN = sD;
        else {
          sN = (-d + b);
          sD = a;
        }
      }

      // finally do the division to get sc and tc
      sc = (Math.Abs(sN) < 1e-8 ? 0.0 : sN / sD);
      tc = (Math.Abs(tN) < 1e-8 ? 0.0 : tN / tD);

      // get the difference of the two closest points
      Vector3d dP = w + (sc * u) - (tc * v);  // =  S1(sc) - S2(tc)

      {
        var Separation = -dP;
        var Overlap = R1 + R2 - Separation.Length;
        //if(Overlap > 0)
        {
          Separation.Unitize();
          var Push = Separation * Overlap;

          Move[0] = (1 - sc) * -Push;
          Move[1] = (sc) * -Push;

          Move[2] = (1 - tc) * Push;
          Move[3] = (tc) * Push;

          Weighting[0] = Weighting[1] = Weighting[2] = Weighting[3] = Strength;
        }
        //else
        //{
        //  Move[0] = Move[1] = Move[2] = Move[3] = Vector3d.Zero;
        //  Weighting[0] = Weighting[1] = Weighting[2] = Weighting[3] = 0;
        //}
      }
    }
  }
# ---------- end lineline ----------
anchor = Anchor(Point=[end_points.Start, end_points.End], Strength=0.01)
number_slider_3 = Slider(28, range=0..65)
solver = Solver(GoalObjects=[lineline.A, length_line, anchor], Reset=Button(), Threshold=1e-15, Tolerance=0.01, On=Toggle(True))  # -> I, V, O
addition = Addition(A=number_slider, B=Slider(0.2, range=0..1))
clean_tree = CleanTree(RemoveNulls=True, RemoveInvalid=True, RemoveEmpty=False, Tree=solver.O)
rhino_doc_dir = RhinoDocDir()  # -> rhino_doc_dir
# ---------- rhino_doc_dir: Python ----------
import scriptcontext as sc
from os import path

rhino_doc_dir = path.abspath(path.dirname(sc.doc.Path))
# ---------- end rhino_doc_dir ----------
pipe = Pipe(Curve=clean_tree, Radius=addition, Caps=0)  # -> flatten(Pipe)
data_dam = DataDam(DataA=pipe, BufferDelay=10000000, BufferMode=0)
brep = Brep(simplify(graft(data_dam)))
cross_reference = CrossReference(ListA=brep, ListB=flatten(brep), CrossMode=1)  # -> graft(ListA), graft(ListB)
shift_paths = ShiftPaths(Data=cross_reference.ListB, Offset=-1)
brep_2 = Brep(brep)
collision_one_many = CollisionOneMany(Collider=cross_reference.ListA, Obstacles=cross_reference.ListB)  # -> Collision, Index
shift_paths_2 = ShiftPaths(Data=collision_one_many.Collision, Offset=-1)
dispatch = Dispatch(List=shift_paths, DispatchPattern=shift_paths_2)  # -> ListA, ListB

# ---- group: neighnors
cluster = Cluster_2(data=dispatch.ListA, index=number_slider_3)
custom_preview = CustomPreview(Geometry=cluster, Material=ColourSwatch(SwatchColor=RGB(0, 255, 255)))

# ---- group: chosen
cluster_2 = Cluster(data=brep_2, index=number_slider_3)
custom_preview_2 = CustomPreview(Geometry=cluster_2, Material=ColourSwatch(SwatchColor=RGB(255, 0, 255)))

# ---- group: remaining
cluster_3 = Cluster_2(data=dispatch.ListB, index=number_slider_3)
custom_preview_3 = CustomPreview(Geometry=cluster_3, Material=ColourSwatch(SwatchColor=RGBA(0, 0, 0, 30)))

# ----
concatenate = Concatenate(FragmentA=rhino_doc_dir, FragmentB="\..\..\tests\test_data")
write = BooleanToggle(False)
curve = Curve(clean_tree)
point = Point([Point(86.76928911, -127.2445631, -19.37751744), Point(143.7858549, -51.99464317, -19.10207946), Point(147.829954, 43.2017592, -19.37751721), Point(93.88212151, 120.6812427, -19.10207734), Point(4.594655082, 153.9447279, -19.37752297), Point(-85.76352569, 126.5797497, -19.10207527), Point(-144.9903003, 51.94131528, -19.37752138), Point(-146.8868997, -42.45066267, -19.10207763), Point(-94.20359944, -121.8432232, -19.37752327), Point(-5.017569033, -152.8157061, -19.10207823)])
integer = Integer()
colourful = Colourful(geo=pipe)
end_points_2 = EndPoints(Curve=curve)  # -> Start, End
panel_2 = Panel(collision_one_many.Collision)
ghpython_script = GhPythonScript(lines=curve, fixed_nodes=point, write=write, file_dir=concatenate, file_name="reciprocal_sphere", radius=number_slider)  # -> out, a; inputs lines: list of Curve, connectivity: tree of Int32, fixed_nodes: list of Point3d
# ---------- ghpython_script: Python ----------
import rhinoscriptsyntax as rs
import Rhino.Geometry.Plane as Plane
import Rhino.Geometry.Point3d as Point3d
import Rhino.Geometry.Vector3d as Vector3d
import Rhino.Geometry.Curve as Curve
import Rhino.Geometry.Quaternion as Quat
import Grasshopper.DataTree as DataTree # Add, AddRange(list, GHPath(i, j))
import Grasshopper.Kernel.Data.GH_Path as GHPath
import System

from ghpythonlib.treehelpers import list_to_tree, tree_to_list
import os
import json
from compas.geometry import distance_point_point
from compas_ghpython import draw_pipes, draw_frame, draw_network

from compas.datastructures import Network
#Curve.PointAtStart

def point2list(p):
    return [p.X, p.Y, p.Z]

def line2list(l):
    return [point2list(l.PointAtStart), point2list(l.PointAtEnd)]

line_list = [line2list(l) for l in lines]

net = Network.from_lines(line_list)

for v, attr in net.nodes(True):
    net.node_attribute(v, "fixed", False)
    pt = [attr['x'], attr['y'], attr['z']]
    for fp in fixed_nodes:
        if distance_point_point(pt, point2list(fp)) < 1e-6:
            net.node_attribute(v, "fixed", True)
            break

for e in net.edges():
    net.edge_attribute(e, 'shrink', shrink)
    net.edge_attribute(e, 'radius', radius)
    net.edge_attribute(e, 'fixed', False)
    for n in e:
        if net.node_attribute(n, 'fixed'):
            net.edge_attribute(e, 'fixed', True)

#print(list(net.edges(True)))

ground_nodes = [v for v, attr in net.nodes(True) if attr['fixed']]
print('grounded nodes : {}'.format(ground_nodes))

#print net.to_nodes_and_edges()
data = net.to_data()
#print data

if write:
    file_path = os.path.join(file_dir, file_name+'_raw_bar_graph.json')
    with open(file_path, 'w') as outfile:
        json.dump(data, outfile, indent=2)
    print 'data wrote to {}'.format(file_path)

a = list_to_tree(draw_network(Network.from_data(data)))

# sanity check
#with open(os.path.join(file_dir, file_name)) as json_file:
#    data = json.load(json_file)
#
#net_read = Network.from_data(data)
#nodes_read, edges_read = net_read.to_nodes_and_edges()

#print [e for e in net_read.edges()]
#print [v for v, attr in net_read.nodes(True) if attr['fixed'] == True]
# ---------- end ghpython_script ----------
ghpython_script_2 = GhPythonScript()  # -> out, a; inputs lines: list of Curve, fixed_nodes: list of Point3d
# ---------- ghpython_script_2: Python ----------
import rhinoscriptsyntax as rs
import Rhino.Geometry.Plane as Plane
import Rhino.Geometry.Point3d as Point3d
import Rhino.Geometry.Vector3d as Vector3d
import Rhino.Geometry.Curve as Curve
import Rhino.Geometry.Quaternion as Quat
import Grasshopper.DataTree as DataTree # Add, AddRange(list, GHPath(i, j))
import Grasshopper.Kernel.Data.GH_Path as GHPath
import System

from ghpythonlib.treehelpers import list_to_tree, tree_to_list
import os
import json
from compas.geometry import distance_point_point
from compas_ghpython import draw_pipes, draw_frame, draw_network

from compas.datastructures import Network
#Curve.PointAtStart

def point2list(p):
    return [p.X, p.Y, p.Z]

def line2list(l):
    return [point2list(l.PointAtStart), point2list(l.PointAtEnd)]

line_list = [line2list(l) for l in lines]

net = Network.from_lines(line_list)

for v, attr in net.nodes(True):
    net.node_attribute(v, "fixed", False)
    pt = [attr['x'], attr['y'], attr['z']]
    for fp in fixed_nodes:
        if distance_point_point(pt, point2list(fp)) < 1e-6:
            net.node_attribute(v, "fixed", True)
            break

for e in net.edges():
    net.edge_attribute(e, 'shrink', shrink)
    net.edge_attribute(e, 'radius', radius)
    net.edge_attribute(e, 'fixed', False)
    for n in e:
        if net.node_attribute(n, 'fixed'):
            net.edge_attribute(e, 'fixed', True)

#print(list(net.edges(True)))

ground_nodes = [v for v, attr in net.nodes(True) if attr['fixed']]
print('grounded nodes : {}'.format(ground_nodes))

#print net.to_nodes_and_edges()
data = net.to_data()
#print data

if write:
    file_path = os.path.join(file_dir, file_name+'_skeleton.json')
    with open(file_path, 'w') as outfile:
        json.dump(data, outfile, indent=2)
    print 'data wrote to {}'.format(file_path)

a = list_to_tree(draw_network(Network.from_data(data)))

# sanity check
#with open(os.path.join(file_dir, file_name)) as json_file:
#    data = json.load(json_file)
#
#net_read = Network.from_data(data)
#nodes_read, edges_read = net_read.to_nodes_and_edges()

#print [e for e in net_read.edges()]
#print [v for v, attr in net_read.nodes(True) if attr['fixed'] == True]
# ---------- end ghpython_script_2 ----------

# ==== cluster Colourful: Display objects in bright colours
geo = ClusterInput()
geo_2 = Geometry(geo)
clean = CleanTree(RemoveNulls=True, RemoveInvalid=True, RemoveEmpty=False, Tree=flatten(geo_2))
S = Shader([{diffuse=RGB(11, 125, 222), emission=RGB(3, 38, 67), shine=0.5, specular=RGB(255, 255, 255), transparency=0}, {diffuse=RGB(222, 37, 11), emission=RGB(67, 11, 3), shine=0.5, specular=RGB(255, 255, 255), transparency=0}, {diffuse=RGB(71, 222, 11), emission=RGB(21, 67, 3), shine=0.5, specular=RGB(255, 255, 255), transparency=0}, {diffuse=RGB(222, 194, 11), emission=RGB(67, 58, 3), shine=0.5, specular=RGB(255, 255, 255), transparency=0}])
lng = ListLength(List=clean)
repeat = RepeatData(Data=S, Length=lng)
preview = CustomPreview(Geometry=clean, Shader=repeat)

# ==== cluster Cluster
index = ClusterInput()
data = ClusterInput()
data_2 = Data(data)
tree_statistics = TreeStatistics(Tree=data_2)  # -> Paths, Length, Count
list_item = ListItem(List=tree_statistics.Paths, Index=index, Wrap=True)
tree_branch = TreeBranch(Tree=data_2, Path=list_item, MaintainPaths=True)
branch = ClusterOutput(tree_branch)

# ==== cluster Cluster_2
data = ClusterInput()
data_2 = Data(data)
tree_statistics = TreeStatistics(Tree=data_2)  # -> Paths, Length, Count
index = ClusterInput()
list_item = ListItem(List=tree_statistics.Paths, Index=index, Wrap=True)
tree_branch = TreeBranch(Tree=data_2, Path=list_item, MaintainPaths=True)
branch = ClusterOutput(tree_branch)
