# Grasshopper definition parse_extrusion_frame.gh (Grasshopper 1.0.7)

panel = Panel("D:\code_ws\pb_ws\pb-construction\assembly_instances\extrusion")
ghpython_script = GhPythonScript()  # -> a
# ---------- ghpython_script: Python ----------
__author__ = "yijiangh"
__version__ = "2019.04.28"

import rhinoscriptsyntax as rs

a = [125, 126, 115, 122, 111, 108, 23, 22, 98, 75, 64, 34, 61, 65, 59, 60, 39, 36, 44, 67]
# ---------- end ghpython_script ----------
ghpython_script_2 = GhPythonScript(
    file_path=panel,
    file_name="djmm_test_block_S1_03-14-2019_w_layer.json",
    use_partial_ids=Toggle(False),
    partial_ids=ghpython_script,
    scale="1")  # -> out, node_points, ground_nodes, elements, element_vids, partial_elements, partial_node_ids, partial_ground_nodes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; inputs use_partial_ids: Boolean, partial_ids: list of Int32
# ---------- ghpython_script_2: Python ----------
__author__ = "yijiangh"
__version__ = "2019.04.28"

import json
import os
import rhinoscriptsyntax as rs
import Rhino.Geometry as rg
import ghpythonlib.components as ghcomp
import ghpythonlib.treehelpers as th
import Grasshopper.DataTree as DataTree # Add, AddRange(list, GHPath(i, j))
import Grasshopper.Kernel.Data.GH_Path as GHPath
import System

def parse_point(json_point, scale=1.0):
#    return scale * np.array([json_point['X'], json_point['Y'], json_point['Z']])
    return rg.Point3d(scale*json_point['X'], scale*json_point['Y'], scale*json_point['Z'])

def parse_elements(json_data, parse_layers=False):
    if not parse_layers:
        return [json_element['end_node_ids']
            for json_element in json_data['element_list']]
#    else:
#        return [AssemblyElement(node_ids=json_element['end_node_ids'], layer_id=json_element['layer_id'], e_id=i)
#                for i, json_element in enumerate(json_data['element_list'])]

def parse_node_points(json_data, scale=1.0):
#    origin = parse_origin(json_data)
    return [parse_point(json_node['point'],scale) for json_node in json_data['node_list']]

def parse_ground_nodes(json_data):
    return {i for i, json_node in enumerate(json_data['node_list']) if json_node['is_grounded'] == 1}

# main

fp = os.path.join(file_path, file_name)

with open(fp, 'r') as f:
    json_data = json.loads(f.read())

element_vids = parse_elements(json_data, parse_layers=False)
node_points = parse_node_points(json_data, scale)
ground_nodes = parse_ground_nodes(json_data)

elements = []
for vids in element_vids:
    elements.append(rg.Line(node_points[vids[0]], node_points[vids[1]]))
    
    
print('Assembly: {} | Model: {} | Unit: {}'.format(
json_data['assembly_type'], json_data['model_type'], json_data['unit'])) # extrusion, spatial_frame, millimeter
print('Nodes: {} | Ground: {} | Elements: {}'.format(
len(node_points), len(ground_nodes), len(elements)))

partial_node_ids = set()
partial_elements = []
partial_ground_nodes = []
if not use_partial_ids:
    partial_ids = list(range(len(elements)))
    
for c_e in partial_ids:
    partial_node_ids.update([element_vids[c_e][0], element_vids[c_e][1]])
    partial_elements.append(rg.Line(node_points[element_vids[c_e][0]], node_points[element_vids[c_e][1]]))
    if element_vids[c_e][0] in ground_nodes:
        partial_ground_nodes.append(element_vids[c_e][0])
    if element_vids[c_e][1] in ground_nodes:
        partial_ground_nodes.append(element_vids[c_e][1])
        

material_name = json_data['material_properties']['material_name']
E = json_data['material_properties']['youngs_modulus']
E_unit = json_data['material_properties']['youngs_modulus_unit']

G = json_data['material_properties']['shear_modulus']
G_unit = json_data['material_properties']['shear_modulus_unit']

#sigma = json_data['material_properties']['tensile_yeild_stress']
#sigma_unit = json_data['material_properties']['tensile_yeild_stress_unit']

rho = json_data['material_properties']['density']
rho_unit = json_data['material_properties']['density_unit']

if 'radius' in json_data['material_properties']:
    r = json_data['material_properties']['radius']
    r_unit = json_data['material_properties']['radius_unit']
    
element_vids = th.list_to_tree(element_vids)
# ---------- end ghpython_script_2 ----------
curve = Curve(reparameterize(simplify(graft(ghpython_script_2.elements))))
