# Grasshopper definition STABLE_double_tangent_bar_generation.gh (Grasshopper 1.0.7)
# plug-ins: karambaGH

# ---- group: SP's design
point = Point([<point referenced from the Rhino model> x4])
point_2 = Point(<point referenced from the Rhino model>)
point_3 = Point(<point referenced from the Rhino model>)
point_4 = Point(<point referenced from the Rhino model>)
point_5 = Point(<point referenced from the Rhino model>)
pt = Point(<point referenced from the Rhino model>)
pt_2 = Point(<point referenced from the Rhino model>)
point_6 = Point(<point referenced from the Rhino model>)
pt_3 = Point(<point referenced from the Rhino model>)
point_7 = Point(<point referenced from the Rhino model>)
point_8 = Point(<point referenced from the Rhino model>)
pt_4 = Point(<point referenced from the Rhino model>)
pt_5 = Point(<point referenced from the Rhino model>)
pt_6 = Point(<point referenced from the Rhino model>)
# caliberated TCP value
pt_7 = Point(<point referenced from the Rhino model>)
pt_8 = Point(<point referenced from the Rhino model>)
point_9 = Point(<point referenced from the Rhino model>)
point_10 = Point([<point referenced from the Rhino model> x4])
pt_9 = Point(<point referenced from the Rhino model>)
pt_10 = Point(<point referenced from the Rhino model>)
# original TCP
# EE visual mesh
# EE visual mesh
# Y moving distance
# connect escape distance after printing
pt_11 = Point(<point referenced from the Rhino model>)
pt_12 = Point(<point referenced from the Rhino model>)
pt_13 = Point(<point referenced from the Rhino model>)
pt_14 = Point(<point referenced from the Rhino model>)
point_11 = Point([<point referenced from the Rhino model> x4])
pt_15 = Point(<point referenced from the Rhino model>)
pt_16 = Point(<point referenced from the Rhino model>)
pt_17 = Point(<point referenced from the Rhino model>)
pt_18 = Point(<point referenced from the Rhino model>)
pt_19 = Point(<point referenced from the Rhino model>)
pt_20 = Point(<point referenced from the Rhino model>)
pt_21 = Point(<point referenced from the Rhino model>)
pt_22 = Point(<point referenced from the Rhino model>)
pt_23 = Point(<point referenced from the Rhino model>)
pt_24 = Point(<point referenced from the Rhino model>)
pt_25 = Point(<point referenced from the Rhino model>)
merge = Merge(
    Data1=point_11,
    Data2=pt_15,
    Data3=pt_16,
    Data4=pt_13,
    Data5=pt_17,
    Data6=pt_18,
    Data7=pt_19,
    Data8=pt_20,
    Data9=pt_21,
    Data10=pt_23,
    Data11=pt_24,
    Data12=pt_25)
merge_2 = Merge(
    Data1=point_10,
    Data2=pt_9,
    Data3=pt_4,
    Data4=pt_22,
    Data5=pt_12,
    Data6=pt_14,
    Data7=pt_8,
    Data8=pt_5,
    Data9=pt_6,
    Data10=pt_7,
    Data11=pt_10,
    Data12=pt_11)
merge_3 = Merge(
    Data1=point,
    Data2=point_2,
    Data3=point_4,
    Data4=point_5,
    Data5=point_6,
    Data6=point_8,
    Data7=point_9,
    Data8=point_7,
    Data9=point_3,
    Data10=pt,
    Data11=pt_3,
    Data12=pt_2)

# ----
point_12 = Point([<point referenced from the Rhino model> x3])
bounding_box = BoundingBox(Content=point_12, Plane=PlaneXY(0, 0, 0), UnionBox=True)  # -> Box, Box_2
cluster = Cluster(box=bounding_box.Box)  # -> result_2, result, result_3
panel = Panel([cluster.result_2, cluster.result, cluster.result_3])
point_13 = Point(<point referenced from the Rhino model>)
point_14 = Point(<point referenced from the Rhino model>)
point_15 = Point(<point referenced from the Rhino model>)
point_16 = Point(Point(6481.435028, 3190.881196, 607.2112234))
point_17 = Point(<point referenced from the Rhino model>)
point_18 = Point(<point referenced from the Rhino model>)
point_19 = Point(<point referenced from the Rhino model>)
point_20 = Point(<point referenced from the Rhino model>)
point_21 = Point(<point referenced from the Rhino model>)
point_22 = Point(<point referenced from the Rhino model>)
point_23 = Point(<point referenced from the Rhino model>)
point_24 = Point(<point referenced from the Rhino model>)
point_25 = Point(<point referenced from the Rhino model>)
point_26 = Point(<point referenced from the Rhino model>)

# ---- group: four tets
point_27 = Point([<point referenced from the Rhino model> x4])

# ---- group: arch
point_28 = Point(<point referenced from the Rhino model>)
point_29 = Point([<point referenced from the Rhino model> x3])
point_30 = Point(<point referenced from the Rhino model>)
point_31 = Point(<point referenced from the Rhino model>)
point_32 = Point(<point referenced from the Rhino model>)
point_33 = Point(<point referenced from the Rhino model>)
point_34 = Point(<point referenced from the Rhino model>)
point_35 = Point(<point referenced from the Rhino model>)
point_36 = Point(<point referenced from the Rhino model>)
point_37 = Point(<point referenced from the Rhino model>)
point_38 = Point(<point referenced from the Rhino model>)
point_39 = Point(<point referenced from the Rhino model>)
point_40 = Point(<point referenced from the Rhino model>)
point_41 = Point(<point referenced from the Rhino model>)
merge_4 = Merge(
    Data1=point_29,
    Data2=point_37,
    Data3=point_30,
    Data4=point_28,
    Data5=point_33,
    Data6=point_32,
    Data7=point_36,
    Data8=point_38,
    Data9=point_41,
    Data10=point_31,
    Data11=point_34,
    Data12=point_35,
    Data13=point_39,
    Data14=point_40)
point_42 = Point([Point(6593.842065, 2712.30633, 183.6191698), Point(6353.967588, 3173.312558, 183.6191698), Point(5876.295547, 2739.732427, 183.6191698), Point(6196.171486, 2854.272936, 441.7774907), Point(6284.605688, 2616.172792, 600.5210053), Point(6411.26103, 2891.95742, 677.7694034), Point(5919.322158, 2630.558348, 846.8409579), Point(6193.118327, 2338.090237, 887.9558937), Point(5939.57737, 2204.908495, 708.1002675), Point(6203.431912, 2046.021212, 708.1002675), Point(5945.148516, 1860.855589, 954.5422198), Point(5765.329049, 1831.176293, 708.6495055), Point(5558.230439, 1904.968133, 923.4195225), Point(5558.230439, 1904.968133, 542.8868367), Point(5882.933419, 1993.450976, 488.3801524), Point(5760.573209, 1727.71816, 199.3540457)])

# ----
# Yijiang's 12 bar feasible design
# base tri
point_43 = Point([Point(391.4737498, -36.03747471, -3.651680708), Point(544.4091608, -18.67770667, -3.651680708), Point(452.5567608, 100.9620354, -3.651680708)])
point_44 = Point([Point(391.4737498, -36.03747471, -3.651680708), Point(544.4091608, -18.67770667, -3.651680708), Point(452.5567608, 100.9620354, -3.651680708), Point(445.002397, -26.40318888, 65.68185223), Point(445.0880041, 61.57939256, 80.02722349), Point(503.0356477, 43.28816029, 57.05850849)])

merge_5 = Merge(Data1=point_12, Data2=point_16, Data3=point_14, Data4=point_25, Data5=point_15, Data6=point_17, Data7=point_23)

# ----
# table model in the origin
brep = Brep(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)

merge_6 = Merge(
    Data1=point_27,
    Data2=point_26,
    Data3=point_19,
    Data4=point_21,
    Data5=point_22,
    Data6=point_24,
    Data7=point_20,
    Data8=point_18,
    Data9=point_13)
point_45 = Point([point_12, point_16])

# ---- group: three tets
point_46 = Point([Point(516.5039228, -36.03747471, -3.651680708), Point(669.4393338, -18.67770667, -3.651680708), Point(577.5869338, 100.9620354, -3.651680708), Point(592.8617742, 28.896685, 65.68185223), Point(516.4216173, 42.51219415, 59.94148286), Point(539.0520635, -9.655376275, 87.8988448)])

# ---- group: two tet
# testing design
point_47 = Point([Point(516.5039228, -36.03747471, -3.651680708), Point(669.4393338, -18.67770667, -3.651680708), Point(577.5869338, 100.9620354, -3.651680708), Point(592.8617742, 28.896685, 65.68185223), Point(516.4216173, 42.51219415, 59.94148286)])

# ----
point_48 = Point("600, 0, -14.23")
point_49 = Point(merge_3)
move = Move(Geometry=brep, Motion=point_48)  # -> Geometry, Transform
unit_x = UnitX(Factor=Slider(39, range=0..100))
list_item = ListItem(List=point_49, Index=0, Wrap=True)  # -> Item, Item1, Item2
custom_preview = CustomPreview(Geometry=move.Geometry, Shader=ColourSwatch(SwatchColor=RGBA(79, 79, 79, 15)))

# ---- group: base triangle
# Please choose "list_order" if you want
# to use the hand-picked order
point_50 = Point([list_item.Item, list_item.Item1, list_item.Item2])

# ----
move_2 = Move(Geometry=point_49, Motion=unit_x)  # -> Geometry, Transform
point_list = PointList(Points=move_2.Geometry, Size=Slider(92, range=1..100))
curve = Curve([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])
end_points = EndPoints(Curve=curve)  # -> Start, End
ordering_heuristic = ValueList({"dijkstra", "list_order", "point2triangle_distance", "tet_surface_area", "tet_volume"}, selected="list_order")
remove_duplicate_points_karamba3d = RemoveDuplicatePointsKaramba3D(Point=[end_points.Start, end_points.End], LimitDistance=0.005)  # -> OutPoint, Info, Indexes
# Not every triple pair has a built triangle!
search_method = ValueList({"point2point", "point2triangle"}, selected="point2point")
point_51 = Point(remove_duplicate_points_karamba3d.OutPoint)
deconstruct = Deconstruct(Point=point_51)  # -> XComponent, YComponent, ZComponent

# ----
# Shortest Distance
# Method
ghpython_script = GhPythonScript(
    points=point_49,
    base_tri_pts=point_50,
    ordering_heuristic=ordering_heuristic,
    search_method=search_method,
    penalty_cost=Slider(8.9, range=1..10))  # -> out, simplify(tet_node_ids); inputs points: list of Point3d, base_tri_pts: list of Point3d
# ---------- ghpython_script: Python ----------
from itertools import combinations

import System
import Grasshopper.Kernel.Data.GH_Path as ghpath
import Grasshopper.DataTree as datatree
from ghpythonlib.treehelpers import list_to_tree, tree_to_list

#from compas_ghpython import unload_modules
#unload_modules("coop_assembly")

#from coop_assembly.help_functions import find_point_id, tet_surface_area, \
#    tet_volume, distance_point_triangle
#from coop_assembly.geometry_generation.tet_sequencing import \
#    compute_distance_from_grounded_node
#from coop_assembly.geometry_generation.tet_sequencing import \
#    get_pt2tri_search_heuristic_fn, \
#    point2point_shortest_distance_tet_sequencing, \
#    point2triangle_tet_sequencing

from compas.rpc import Proxy
cp_h = Proxy('coop_assembly.help_functions') #, python='python', capture_output=False)
cp_ts = Proxy('coop_assembly.geometry_generation.tet_sequencing') #, python='python', capture_output=False)
print('rpc address: ', cp_h.address)

#if restart:
#    cp_h.stop_server()
#    cp_h.start_server()
#    #
#    cp_ts.stop_server()
#    cp_ts.start_server()

points = [[p.X, p.Y, p.Z] for p in points]
base_tri_pts = [[p.X, p.Y, p.Z] for p in base_tri_pts]

start_tri_ids = [cp_h.find_point_id(base_pt, points) for base_pt in base_tri_pts]
assert len(start_tri_ids) == 3, 'start triangle should only have three points!'
print('base triangle ids: {}'.format(start_tri_ids))

all_pt_ids = list(range(len(points)))

if search_method == 'point2point':
    cost_from_node = {}
    if ordering_heuristic == 'dijkstra':
        elements = list(combinations(all_pt_ids, 2))
        cost_from_node = cp_ts.compute_distance_from_grounded_node(elements, points, start_tri_ids)
    elif ordering_heuristic == 'list_order':
        for pt_id in all_pt_ids:
            if pt_id in start_tri_ids:
                cost_from_node[pt_id] = 0
            else:
                # just shift by 1 to distinguish index 0 from the grounded ones
                cost_from_node[pt_id] = pt_id
    else:
        raise NotImplementedError('ordering heuristic not implemented!')
        
    print('cost_from_node: {}'.format(cost_from_node))
    
    tet_node_ids = cp_ts.point2point_shortest_distance_tet_sequencing(points, cost_from_node)
     
elif search_method == 'point2triangle':
    heuristic_fn = None
    penalty_cost = penalty_cost or 2.0
#    heuristic_fn = cp_ts.get_pt2tri_search_heuristic_fn(points, penalty_cost, ordering_heuristic)
    tet_node_ids = cp_ts.point2triangle_tet_sequencing(\
        points, start_tri_ids, penalty_cost=penalty_cost, heuristic=ordering_heuristic, verbose=True)
else:
    raise NotImplementedError('search method not implemented!')

print tet_node_ids

tet_node_ids = list_to_tree([tet_ids+[pt_id] for tet_ids, pt_id in tet_node_ids], lambda x : x)
# ---------- end ghpython_script ----------

sort_list = SortList(Keys=deconstruct.ZComponent, ValuesValuesA=point_51)  # -> Keys, ValuesValuesA
split_list = SplitList(List=sort_list.ValuesValuesA, Index=Slider(7, range=3..12))  # -> ListA, ListB
panel_2 = Panel(ghpython_script.out)
rhino_doc_dir = RhinoDocDir()  # -> rhino_doc_dir
# ---------- rhino_doc_dir: Python ----------
import scriptcontext as sc
from os import path

rhino_doc_dir = path.abspath(path.dirname(sc.doc.Path))
# ---------- end rhino_doc_dir ----------
# 1" outer diameter and 1/8" wall thickness, up to 3' long.
# 1 inch = 25.4 mm
bar_diameter = Slider(25.4, range=0.01..50)

# ---- group: to coop_assembly
integer = Integer(ghpython_script.tet_node_ids)

# ----
panel_3 = Panel(rhino_doc_dir)
panel_4 = Panel(integer)
write = BooleanToggle(False)
concatenate = Concatenate(Fragment_A=Slider(1, range=1..7), A="_exp", Fragment_B="_tets.json")
run = BooleanToggle(True)
check_collision = BooleanToggle(True)
verbose = BooleanToggle(False)
pb_verify = BooleanToggle(False)
correct = BooleanToggle(False)
division = Division(A=bar_diameter, B=2)
panel_5 = Panel(concatenate)
point_52 = Point(point_49)

boolean_toggle = BooleanToggle(False)  # disabled
ghpython_script_2 = GhPythonScript(viewer=boolean_toggle)  # -> out, a; disabled
# ---------- ghpython_script_2: Python ----------
import rhinoscriptsyntax as rs
import Rhino.Geometry.Plane as Plane
import Rhino.Geometry.Point3d as Point3d
import Rhino.Geometry.Vector3d as Vector3d
import Rhino.Geometry.Quaternion as Quat
import Grasshopper.DataTree as DataTree # Add, AddRange(list, GHPath(i, j))
import Grasshopper.Kernel.Data.GH_Path as GHPath
import System

from ghpythonlib.treehelpers import list_to_tree, tree_to_list
import os
#import json
#from compas.geometry import Frame
#from compas_ghpython import draw_pipes, draw_frame

from compas.rpc import Proxy
cp_exe = Proxy('coop_assembly.geometry_generation.execute')

cp_exe.test_connect(viewer) #, capture_output=True
# ---------- end ghpython_script_2 ----------

ghpython_script_3 = PythonScript(
    points=point_52,
    tet_point_ids=integer,
    radius=division,
    run=run,
    correct=correct,
    check_collision=check_collision,
    verify=pb_verify,
    verbose=verbose,
    write=write,
    file_dir="D:\code_ws\pb_ws\coop_assembly\tests\test_data",
    file_name=panel_5)  # -> out, new_ideal_verts, new_ideal_network, bar_vertex_ids, ideal_vertex_ids, bar_end_pts, bar_axis_lines, connector_ids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; inputs points: list of Point3d, tet_point_ids: tree of Int32, base_tri_pts: list of Point3d, check_collision: Boolean, verify: Boolean, verbose: Boolean
# ---------- ghpython_script_3: Python ----------
import warnings
import System
import Grasshopper.Kernel.Data.GH_Path as ghpath
import Grasshopper.DataTree as datatree
import Rhino.Geometry.Point3d as Point3d
import Rhino.Geometry.Line as Line
from ghpythonlib.treehelpers import tree_to_list, list_to_tree

#from compas.utilities.xfunc import XFunc
#fn = XFunc("coop_assembly.geometry_generation.execute.execute_from_points", python="python")
from compas.rpc import Proxy
cp_exe = Proxy('coop_assembly.geometry_generation.execute')

tet_point_ids = tree_to_list(tet_point_ids, lambda x: x) if tet_point_ids.BranchCount > 1 else [tet_point_ids.Branch(0)]
tet_ids = [[tuple(t_ids[0:3]), t_ids[3]] for t_ids in tet_point_ids]
print('tet_ids: {}'.format(tet_ids))

run = run and not (len(tet_point_ids)==0 or tet_point_ids is None or len(points)==0 or points is None)

points = [(p[0], p[1], p[2]) for p in points]

if run:
    endpts_from_element = cp_exe.execute_from_points(points, tet_ids, radius, correct=correct, check_collision=check_collision, 
        verbose=verbose, viewer=False, verify=verify,
        write=write, save_dir=file_dir, file_name=file_name)
#    print endpts_from_element
    
    bar_end_pts = datatree[Point3d]()
    bar_axis_lines = datatree[Line]()
    for bar, pts in endpts_from_element.items():
        rpts = [Point3d(*p) for p in pts]
        bar_end_pts.AddRange(rpts, ghpath(int(bar)))
        bar_axis_lines.Add(Line(*rpts), ghpath(int(bar)))
# ---------- end ghpython_script_3 ----------
panel_6 = Panel(ghpython_script_3.out)
curve_2 = Curve(ghpython_script_3.bar_axis_lines)
visualize_bar = ValueList({"no-show": 0, "tet-group": 1, "bar-one-by-one": 2, "all": 3}, selected="all")
pipe = Pipe(Curve=curve_2, Radius=division, Caps=0)  # -> simplify(Pipe)
brep_2 = Brep(pipe)
assembled_bar = ColourSwatch(SwatchColor=RGB(92, 207, 255))
stream_gate = StreamGate(Stream=brep_2, Gate=visualize_bar)  # -> Target0, Target1, Target2, Target3
length = Length(Curve=curve_2)
custom_preview_2 = CustomPreview(Geometry=stream_gate.Target3, Shader=assembled_bar)
panel_7 = Panel(length)

curve_3 = Curve(flatten(curve_2))
end_points_2 = EndPoints(Curve=flatten(curve_3))  # -> Start, End
length_2 = Length(Curve=curve_3)
point_53 = Point([end_points_2.Start, end_points_2.End])
vector_xyz = VectorXYZ(XComponent=Slider(961, range=-1000..1000), YComponent=0, ZComponent=Slider(689, range=-1000..1000))  # -> Vector, Length
number = Number(division)
bounding_box_2 = BoundingBox(Content=point_53, Plane=PlaneXY(0, 0, 0), UnionBox=True)  # -> Box, Box_2
volume = Volume(Geometry=bounding_box_2.Box)  # -> Volume, Centroid
point_54 = Point(volume.Centroid)
sort_list_2 = SortList(Keys=length_2)  # -> Keys, ValuesValuesA
list_length = ListLength(List=flatten(curve_3))
move_3 = Move(Geometry=point_54, Motion=vector_xyz.Vector)  # -> Geometry, Transform
list_item_2 = ListItem(List=sort_list_2.Keys, Index=0, Wrap=True)  # -> Item1, Item
concatenate_2 = Concatenate(Fragment_A="bar length: max - ", Fragment_B=list_item_2.Item, A=", min - ", B=list_item_2.Item1, C=" (mm)")

cluster_2 = Cluster(box=bounding_box_2.Box)  # -> result_2, result, result_3
concatenate_3 = Concatenate(Fragment_A="radius: ", Fragment_B=number, A=" (mm)")

integer_2 = Integer(cluster_2.result_2)
integer_3 = Integer(cluster_2.result)
integer_4 = Integer(cluster_2.result_3)
concatenate_4 = Concatenate(Fragment_A="x:", Fragment_B=integer_2, A=", y:", B=integer_3, C=", z:", D=integer_4, E=" (mm)")
concatenate_5 = Concatenate(
    Fragment_A="Number of bars:",
    Fragment_B=list_length,
    B=concatenate_4,
    D=concatenate_3,
    F=concatenate_2,
    H="(3 ft = 915 mm)")
text_tag = TextTag(Location=move_3.Geometry, Text=concatenate_5, Colour=ColourSwatch(SwatchColor=RGB(0, 0, 0)))

# ==== cluster Cluster
box = ClusterInput()
deconstruct_box = DeconstructBox(Box=box)  # -> Plane, X, Y, Z
deconstruct_domain = DeconstructDomain(Domain=deconstruct_box.X)  # -> Start, End
deconstruct_domain_2 = DeconstructDomain(Domain=deconstruct_box.Y)  # -> Start, End
deconstruct_domain_3 = DeconstructDomain(Domain=deconstruct_box.Z)  # -> Start, End
subtraction = Subtraction(A=deconstruct_domain_2.End, B=deconstruct_domain_2.Start)
subtraction_2 = Subtraction(A=deconstruct_domain.End, B=deconstruct_domain.Start)
subtraction_3 = Subtraction(A=deconstruct_domain_3.End, B=deconstruct_domain_3.Start)
result = ClusterOutput(subtraction)
result_2 = ClusterOutput(subtraction_2)
result_3 = ClusterOutput(subtraction_3)
