# Grasshopper definition export_meshes_to_objs.gh (Grasshopper 1.0.7)
# plug-ins: LunchBox

# ---- group: itj_TC
mesh = Mesh([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])

# ----
mesh_2 = Mesh([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])

# ---- group: link2
link2_extraacm = Mesh(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)

# ---- group: PG1000
mesh_3 = Mesh([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])

# ---- group: PG500
mesh_4 = Mesh([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])

# ---- group: link3
link3_extraacm = Mesh(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)

# ----
merge = Merge(Data1=link2_extraacm, Data2=link3_extraacm)
panel = Panel("D:\code_ws\pb_ws\compas_fab_pychoreo\tests\data\itj_rfl_obstacles")
panel_2 = Panel("itj_rfl_pipe_acm")
mesh_5 = Mesh(simplify(graft(mesh_4)))
tree_statistics = TreeStatistics(Tree=mesh_5)  # -> Paths, Length, Count
list_item = ListItem(List=tree_statistics.Paths, Index=Slider(53, range=0..53), Wrap=True)
tree_branch = TreeBranch(Tree=mesh_5, Path=list_item, MaintainPaths=True)

# ---- group: link2
link2_extraacm_2 = Mesh(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)

# ---- group: link3
link3_extraacm_2 = Mesh(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)

# ----
concatenate = Concatenate(FragmentA="D:\code_ws\pb_ws\compas_fab_pychoreo\examples\itj\data\", FragmentB="itj_PG500")
button = Button()
deconstruct_path = DeconstructPath(Branch=tree_statistics.Paths)  # -> simplify(Indices)
concatenate_2 = Concatenate(Fragment_A="itj_PG500", B="_", A=deconstruct_path, Fragment_B=".obj")
mkdir = Mkdir(fp=concatenate)  # -> out, fp
# ---------- mkdir: Python ----------
import os

if not os.path.exists(fp):
    os.mkdir(fp)
    print('Dir made: {}'.format(fp))
else:
    print('Dir exists!')
a = fp
# ---------- end mkdir ----------
panel_3 = Panel(concatenate_2)
object_save = ObjectSave(
    BakeToggle=Toggle(True),
    FileDirectory=mkdir.fp,
    FileName=concatenate_2,
    GeometryObjects=mesh_5,
    Layer="GH_Export",
    ObjectName="GH_Obj",
    ObjectColor=RGB(255, 255, 255),
    LayerColor=RGB(255, 255, 255))
