# Grasshopper definition 02_robot_artist_grasshopper.ghx (Grasshopper 1.0.7)

reload = Button()

# ----
# Robot
load = Button()
python = PythonScript(load=load)  # -> robot
# ---------- python: Python ----------
from scriptcontext import sticky as st

import compas

from compas.robots import RobotModel
from compas.robots import GithubPackageMeshLoader
from compas_fab.robots import Robot
from compas_ghpython.artists import RobotModelArtist

# Robot meshes are usually in meters
# Set a high precision to prevent parsing errors
# and configure Rhino itself in meters
compas.PRECISION = '12f'

# Store robot in component-based key
robot_key = 'robot_{}'.format(str(ghenv.Component.InstanceGuid))

if robot_key not in st:
    st[robot_key] = None

if load:
    # Load robot (try other repo/package combinations, e.g. 'abb_irb120_support')
    repo    = 'ros-industrial/abb'
    package = 'abb_irb6600_support'
    branch  = 'kinetic-devel'

    github = GithubPackageMeshLoader(repo, package, branch)
    
    model = RobotModel.from_urdf_file(github.load_urdf('irb6640.urdf'))
    model.load_geometry(github)
    artist = RobotModelArtist(model)
    robot = Robot(model, artist)

    st[robot_key] = robot

robot = st[robot_key]
# ---------- end python ----------
robot = Data(python)

py = PythonScript(reload=reload)
# ---------- py: Python ----------
if reload:
    from compas_ghpython import unload_modules
    unload_modules('compas')
# ---------- end py ----------

# ---- group: forward kinematics
# Configuration
a1 = Slider(29, range=-360..360)
a2 = Slider(27, range=-360..360)
a3 = Slider(-14, range=-360..360)
a4 = Slider(-71, range=-360..360)
a5 = Slider(33, range=-360..360)
a6 = Slider(0, range=-360..360)
forward_kinematics = PythonScript(robot=robot, a1=a1, a2=a2, a3=a3, a4=a4, a5=a5, a6=a6)  # -> out, configuration
# ---------- forward_kinematics: Python ----------
import math
from compas_fab.robots import Configuration

if robot:
    joint_values = [a1, a2, a3, a4, a5, a6]
    joint_names = robot.get_configurable_joint_names()
    configuration = Configuration.from_revolute_values([math.radians(a) for a in joint_values])
    print configuration
# ---------- end forward_kinematics ----------

# ----
panel = Panel(forward_kinematics.out)

# ----
# Visualisation
show_end_effector_frame = BooleanToggle(False)
show_base_frame = BooleanToggle(False)
show_collision = BooleanToggle(False)
show_frames = BooleanToggle(False)
show_visual = BooleanToggle(True)
visualize = PythonScript(
    robot=robot,
    configuration=forward_kinematics.configuration,
    show_visual=show_visual,
    show_collision=show_collision,
    show_frames=show_frames,
    show_base_frame=show_base_frame,
    show_end_effector_frame=show_end_effector_frame)  # -> visual, collision, frames, ee_frame, base_frame
# ---------- visualize: Python ----------
"""Visualizes a robot.
    Inputs:
        robot: The robot
        configuration: :class:`compas_fab.robots.Configuration`
            The robot's full configuration to display.
        show_visual: bool
           Whether or not to show the robot's visual meshes.
        show_collision: bool
           Whether or not to show the robot's collision meshes.
        show_frames: bool
           Whether or not to show the robot's joint frames.
        show_base_frame: bool
           Whether or not to show the robot's base frame.
        show_end_effector_frame: bool
            Whether or not to show the robot's end-effector frame.
    Output:
        visual: The robot's visual meshes.
        collision: The robot's collision meshes.
        frames: The robot's joint frames.
        base_frame: The robot's base frame.
        ee_frame: The robot's end-effector frame.
"""
from __future__ import print_function

if robot and configuration:
    group = group or robot.main_group_name if robot.semantics else None

    robot.update(configuration, group, visual=show_visual, collision=show_collision)

    if show_visual:
        visual = robot.artist.draw_visual()

    if show_collision:
        collision = robot.artist.draw_collision()

    if show_frames:
        axes = robot.transformed_axes(configuration, group)
        frames = robot.transformed_frames(configuration, group)

    if show_base_frame:
        frames = robot.transformed_frames(configuration, group)
        base_frame = frames[0]

    if show_end_effector_frame:
        ee_frame = robot.forward_kinematics(configuration, group)
        print("End-effector", ee_frame)
# ---------- end visualize ----------
draw = GhPythonScript(frames=[visualize.frames, visualize.ee_frame, visualize.base_frame], scale=Slider(0.1, range=0..1))  # -> P, V, C, W; inputs frames: list
# ---------- draw: Python ----------
from System.Drawing import Color
from compas_ghpython.utilities import draw_frame

red = Color.FromArgb(255, 0, 0)
green = Color.FromArgb(0, 255, 0)
blue = Color.FromArgb(0, 0, 255)

P = []
V = []
C = []

scale = float(scale)

for frame in frames:
    if not frame:
        continue
    plane = draw_frame(frame)
    P += [plane.Origin] * 3
    V.append(plane.XAxis * scale)
    V.append(plane.YAxis * scale)
    V.append(plane.ZAxis * scale)
    C += [red, green, blue]

W = 3
# ---------- end draw ----------
geo = Geometry(visualize.collision)
geo_2 = Geometry(visualize.visual)
vdisex = VectorDisplayEx(Point=draw.P, Vector=draw.V, Colour=draw.C, Width=draw.W)
