# Grasshopper definition collision_checker_conf.ghx (Grasshopper 1.0.7)

rhino_doc_dir = RhinoDocDir()  # -> rhino_doc_dir
# ---------- rhino_doc_dir: Python ----------
import scriptcontext as sc
from os import path

rhino_doc_dir = path.abspath(path.dirname(sc.doc.Path))
# ---------- end rhino_doc_dir ----------
panel = Panel("abb_irb4600_40_255")
ghpython_script = GhPythonScript(current_path=rhino_doc_dir)  # -> out, pkg_path, urdf_path
# ---------- ghpython_script: Python ----------
import os

pkg_path = os.path.join(current_path, '..', '..', 'data', 'robots', 'abb_irb4600_40_255')
urdf_path = os.path.join(pkg_path, 'urdf', 'abb_irb4600_40_255.urdf')
# ---------- end ghpython_script ----------
boolean_toggle = BooleanToggle(True)

# ----
# Robot
load = Button()
ghpython_script_2 = PythonScript(load=load)  # -> out, robot
# ---------- ghpython_script_2: Python ----------
from scriptcontext import sticky as st
import os
import compas

from compas.robots import RobotModel
from compas.robots import GithubPackageMeshLoader
from compas.robots import LocalPackageMeshLoader
from compas_fab.ghpython import RobotArtist

# Robot meshes are usually in meters
# Set a high percision to prevent parsing errors
# and configure Rhino itself in meters
compas.PRECISION = '12f'

# Store robot in component-based key
robot_key = 'robot_{}'.format(str(ghenv.Component.InstanceGuid))

if robot_key not in st:
    st[robot_key] = None

if load:
    # Load robot (try other repo/package combinations, e.g. 'abb_irb120_support')
    repo    = 'ros-industrial/abb'
    package = 'abb_irb6600_support'
    branch  = 'kinetic-devel'

    github = GithubPackageMeshLoader(repo, package, branch)

    robot = RobotModel.from_urdf_file(github.load_urdf('irb6640.urdf'))
    robot.load_geometry(github)
    robot.artist = RobotArtist(robot)

#    # Create robot model from URDF
#    robot = RobotModel.from_urdf_file(urdf_path)
#    
#    # Also load geometry
#    loader = LocalPackageMeshLoader(pkg_path, pkg_name)
#    robot.load_geometry(loader)
#    robot.artist = RobotArtist(robot)

    st[robot_key] = robot

robot = st[robot_key]
# ---------- end ghpython_script_2 ----------
robot = Data(ghpython_script_2.robot)

reload = Button()
py = PythonScript(reload=reload)
# ---------- py: Python ----------
if reload:
    from compas_ghpython import unload_modules
    unload_modules('compas')
# ---------- end py ----------

# ---- group: forward kinematics
# Configuration
a1 = Slider(0, range=-360..360)
a2 = Slider(0, range=-360..360)
a4 = Slider(0, range=-360..360)
a5 = Slider(0, range=-360..360)
a3 = Slider(0, range=-360..360)
a6 = Slider(0, range=-360..360)
forward_kinematics = PythonScript(robot=robot, a1=a1, a2=a2, a3=a3, a4=a4, a5=a5, a6=a6)  # -> out, configuration
# ---------- forward_kinematics: Python ----------
import math
from compas_fab.robots import Configuration

if robot:
    joint_values = [a1, a2, a3, a4, a5, a6]
    joint_names = robot.get_configurable_joint_names()
    configuration = Configuration.from_revolute_values([math.radians(a) for a in joint_values])
    
    print [math.radians(a) for a in joint_values]
# ---------- end forward_kinematics ----------

# ----
panel_2 = Panel(forward_kinematics.out)
configurations_at_pickup = Data(forward_kinematics.configuration)
mesh = Mesh([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])

# ---- group: env obstacles
brep = Brep([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])

# ----
scale = Scale(Geometry=mesh, Center=Point(0, 0, 0), Factor="1e-3")  # -> Geometry, Transform

# ----
# Visualisation
value_list = ValueList({"forward_kinematics": 0, "inverse_kinematics": 1, "calculated_path": 2}, selected="forward_kinematics")
stream_filter = StreamFilter(Gate=value_list, Stream0=configurations_at_pickup)
show_end_effector_frame = BooleanToggle(True)
show_base_frame = BooleanToggle(True)
show_collision = BooleanToggle(False)
show_frames = BooleanToggle(True)
show_visual = BooleanToggle(True)
visualize = PythonScript(
    robot=robot,
    configuration=stream_filter,
    show_visual=show_visual,
    show_collision=show_collision,
    show_frames=show_frames,
    show_base_frame=show_base_frame,
    show_end_effector_frame=show_end_effector_frame)  # -> visual, collision, frames, ee_frame, base_frame
# ---------- visualize: Python ----------
"""Visualizes a robot.
    Inputs:
        robot: The robot
        configuration: :class:`compas_fab.robots.Configuration`
            The robot's full configuration to display.
        show_visual: bool
           Whether or not to show the robot's visual meshes.
        show_collision: bool
           Whether or not to show the robot's collision meshes.
        show_frames: bool
           Whether or not to show the robot's joint frames.
        show_base_frame: bool
           Whether or not to show the robot's base frame.
        show_end_effector_frame: bool
            Whether or not to show the robot's end-effector frame.
    Output:
        visual: The robot's visual meshes.
        collision: The robot's collision meshes.
        frames: The robot's joint frames.
        base_frame: The robot's base frame.
        ee_frame: The robot's end-effector frame.
"""
from __future__ import print_function

if robot and configuration:
    group = None
#    group = group or robot.main_group_name if robot.semantics else None
    robot.update(configuration, group, visual=show_visual, collision=show_collision)
#    robot.artist.update(configuration, visual=show_visual, collision=show_collision)
    
    joint_state = dict(zip(configuration.joint_names, configuration.values))
    
    print(joint_state)

    if show_visual:
        visual = robot.artist.draw_visual()

    if show_collision:
        collision = robot.artist.draw_collision()

    if show_frames:
        axes = robot.transformed_axes(joint_state)
        frames = robot.transformed_frames(joint_state)

    if show_base_frame:
        frames = robot.transformed_frames(joint_state)
        base_frame = frames[0]

    if show_end_effector_frame:
        ee_frame = robot.forward_kinematics(joint_state)
        print("End-effector", ee_frame)
# ---------- end visualize ----------
geometry = Geometry(visualize.collision)
geometry_2 = Geometry(visualize.visual)
draw = GhPythonScript(frames=[visualize.frames, visualize.ee_frame, visualize.base_frame], scale=Slider(0.1, range=0..1))  # -> P, V, C, W, flatten(planes); inputs frames: list
# ---------- draw: Python ----------
from System.Drawing import Color
from compas_ghpython import draw_frame

red = Color.FromArgb(255, 0, 0)
green = Color.FromArgb(0, 255, 0)
blue = Color.FromArgb(0, 0, 255)

P = []
V = []
C = []
planes = []

scale = float(scale)

for frame in frames:
    if not frame:
        continue
    plane = draw_frame(frame)
    P += [plane.Origin] * 3
    V.append(plane.XAxis * scale)
    V.append(plane.YAxis * scale)
    V.append(plane.ZAxis * scale)
    C += [red, green, blue]
    planes.append(plane)

W = 3
# ---------- end draw ----------
vector_display_ex = VectorDisplayEx(Point=draw.P, Vector=draw.V, Colour=draw.C, Width=draw.W)

list_item = ListItem(List=visualize.frames, Index=Slider(8, range=0..43), Wrap=True)
ghpython_script_3 = GhPythonScript(x=list_item)  # -> out, a
# ---------- ghpython_script_3: Python ----------
from compas_ghpython import draw_frame

a = draw_frame(x)
# ---------- end ghpython_script_3 ----------
xy_plane = XYPlane(Origin=Point(0, 0, 0))
plane = Plane(ghpython_script_3.a)
scale_2 = Scale(Geometry=plane, Center=Point(0, 0, 0), Factor="1")  # -> Geometry, Transform
orient = Orient(Geometry=scale.Geometry, Source=xy_plane, Target=scale_2.Geometry)  # -> Geometry, Transform
scale_3 = Scale(Geometry=[geometry_2, geometry], Center=Point(0, 0, 0), Factor="1")  # -> Geometry, Transform
